# Grasshopper definition BuddyRingsDuo.gh (Grasshopper 1.0.8)
# plug-ins: Pufferfish, Wombat

geo_algorithm_name = Panel("BuddyRingsDuo")
is_production_mode = BooleanToggle(True)
toggle_job_make_it_go = BooleanToggle(True)
axial_band_thickness_mm = Panel("1.65")
factoryautomatorpy = Python3Script(is_production_mode=is_production_mode, geo_algorithm_name=geo_algorithm_name, toggleJob=toggle_job_make_it_go)  # -> out, c_left_mm, c_right_mm, full_perimeter_mm, right_forward_offset_mm, b_left_slit, b_right_slit, band_width_mm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; inputs is_production_mode: Boolean, toggleJob: Boolean
# ---------- factoryautomatorpy: Python ----------
from pathlib import Path
import sys
from importlib import reload #FOR DEV
import time

ghFileDir = str(Path.joinpath(Path(ghenv.Component.OnPingDocument().FilePath).resolve().parents[0], "src"))
print(f"{ghFileDir=}")

if ghFileDir not in sys.path:
    print("ghFileDir needed to be included")
    sys.path.append(ghFileDir)

import splintcommon
reload(splintcommon) #FOR DEV
from splintcommon import mark_generation_start
mark_generation_start()
splintcommon.log(f'FactoryAutomatorPY Running at: ({time.strftime("%H:%M:%S", time.localtime())})')
# ==================== Component Code ===========================

def float_range(start, stop, count):
    current = start
    step = (stop - start) / (count - 1)
    result_range = []
    for c in range(count):
        result_range.append(start + (step * c))
    return result_range

job_data, objectID, root_filename, output_dir, raw_data = splintcommon.load_job_data(is_production_mode, geo_algorithm_name)

# This mapping must match the schema of the data in the DB for this geometry type
c_left_mm = job_data["c_left_mm"]
c_right_mm = job_data["c_right_mm"]
full_perimeter_mm = job_data["full_perimeter_mm"]
right_forward_offset_mm = job_data["right_forward_offset_mm"]
b_left_slit = job_data.get("b_left_slit", False)
b_right_slit = job_data.get("b_right_slit", False)
band_width_mm = job_data.get("band_width_mm", 7.5)

splintcommon.log(f"Result data {c_left_mm=} {c_right_mm=} {full_perimeter_mm=} {right_forward_offset_mm=} {b_left_slit=} {b_right_slit=}")
# ---------- end factoryautomatorpy ----------
# BuddyRings
panel = Panel(factoryautomatorpy.out)
output_dir_out = Text(factoryautomatorpy.output_dir)
root_filename_out = Text(factoryautomatorpy.root_filename)
axial_band_thickness_mm_2 = Number(axial_band_thickness_mm)
b_left_slit = Boolean(factoryautomatorpy.b_left_slit)
b_right_slit = Boolean(factoryautomatorpy.b_right_slit)
c_left_mm = Panel(factoryautomatorpy.c_left_mm)
full_perimeter_mm = Panel(factoryautomatorpy.full_perimeter_mm)
c_right_mm = Panel(factoryautomatorpy.c_right_mm)
right_forward_offset_mm = Panel(factoryautomatorpy.right_forward_offset_mm)
objectid = Panel(factoryautomatorpy.objectID)
panel_2 = Panel(b_left_slit)
panel_3 = Panel(b_right_slit)

# ----
# Finger Circles
min_center_gap = Panel("1.0")
c_left = Number(c_left_mm)
full_perimeter = Number(full_perimeter_mm)
c_right = Number(c_right_mm)
axial_band_thickness_mm_3 = Number(axial_band_thickness_mm)
two_sphere_dist_solver_py = Python3Script(c1=c_left, c2=c_right, full_perimeter=full_perimeter, min_center_gap=min_center_gap)  # -> out, r1, r2, gap, center_to_center; inputs c1: Double, c2: Double, full_perimeter: Double, min_center_gap: Double
# ---------- two_sphere_dist_solver_py: Python ----------
import math

# Inputs (from GH component)
circumference_1 = c1  # larger circle circumference
circumference_2 = c2  # smaller circle circumference
belt_perimeter = full_perimeter    # convex hull perimeter measurement
is_radius_reversed = False

# Derive radii
r1 = circumference_1 / (2 * math.pi)
r2 = circumference_2 / (2 * math.pi)

# Ensure r1 >= r2
if r2 > r1:
    is_radius_reversed = True
    r1, r2 = r2, r1

def hull_perimeter(d, r1, r2):
    """Convex hull perimeter of two disks with center distance d."""
    tangent_len = 2 * math.sqrt(d**2 - (r1 - r2)**2)
    arc_base = math.pi * (r1 + r2)
    arc_correction = 2 * (r1 - r2) * math.asin((r1 - r2) / d)
    return tangent_len + arc_base + arc_correction

# Bisection solve for center-to-center distance
d_lo = r1 + r2 + 1e-9  # circles just touching
d_hi = belt_perimeter / 2.0
tolerance = 1e-9

for _ in range(200):
    d_mid = (d_lo + d_hi) / 2.0
    if hull_perimeter(d_mid, r1, r2) < belt_perimeter:
        d_lo = d_mid
    else:
        d_hi = d_mid
    if (d_hi - d_lo) < tolerance:
        break

center_distance = (d_lo + d_hi) / 2.0
gap = center_distance - r1 - r2

if (gap < min_center_gap):
    gap = min_center_gap

#Now unreverse the radius if necessary
if is_radius_reversed:
    r1, r2 = r2, r1

center_to_center = r1 + r2 + gap
# ---------- end two_sphere_dist_solver_py ----------
addition = Addition(A=two_sphere_dist_solver_py.r1, B=axial_band_thickness_mm_3)
addition_2 = Addition(A=two_sphere_dist_solver_py.r2, B=axial_band_thickness_mm_3)
yz_plane = YZPlane(Origin=Point(0, 0, 0))
unit_y = UnitY(Factor=expr("-x", two_sphere_dist_solver_py.center_to_center))
circle_left = Circle(Plane=yz_plane, Radius=addition)
circle_left_2 = Circle(Plane=yz_plane, Radius=two_sphere_dist_solver_py.r1)
circle_right = Circle(Plane=yz_plane, Radius=two_sphere_dist_solver_py.r2)
circle_right_2 = Circle(Plane=yz_plane, Radius=addition_2)
move = Move(Geometry=circle_right, Motion=unit_y)  # -> Geometry, Transform
transform = Transform(Geometry=circle_right_2, Transform=move.Transform)
outer_circle_left = Circle(circle_left)
outer_circle_right = Circle(transform)
circle_right_3 = Circle(move.Geometry)
circle_left_3 = Circle(circle_left_2)
center_to_center_dist = Number(two_sphere_dist_solver_py.center_to_center)
r_right_outer = Number(addition_2)
r_left_outer = Number(addition)
r_right = Number(two_sphere_dist_solver_py.r2)
r_left = Number(two_sphere_dist_solver_py.r1)

# ----
# Create Outer Shell Wall
# Connecting radius coefficient: 0.9 seems to work very well.
# 
# I experimented with both circle closest point distances and circle center distances. Closest point yielded the most predictable results.
outer_circle_right_2 = Circle(outer_circle_right)
outer_circle_left_2 = Circle(outer_circle_left)
r_right_outer_2 = Number(r_right_outer)
r_left_outer_2 = Number(r_left_outer)
curve_curve_closest_point = CurveCurveClosestPoint(CurveA=outer_circle_left_2, CurveB=outer_circle_right_2)  # -> PointOnA, ParamOnA, PointOnB, ParamOnB
connecting_radius_coefficient = Slider(0.9, range=0.2..3)
distance = Distance(PointA=curve_curve_closest_point.PointOnA, PointB=curve_curve_closest_point.PointOnB)
multiplication = Multiplication(A=distance, B=connecting_radius_coefficient)
python_3_script = Python3Script(circle1=outer_circle_left_2, circle2=outer_circle_right_2, hourglass_r=multiplication)  # -> out, a; inputs circle1: Circle, circle2: Circle, hourglass_r: Double
# ---------- python_3_script: Python ----------
import Rhino.Geometry as rg
import math


def create_hourglass(circle1, circle2, hourglass_r, tolerance=0.01):
    """Create an hourglass-shaped closed curve joining two non-overlapping circles."""
    c1 = circle1.Center
    c2 = circle2.Center
    r1 = circle1.Radius
    r2 = circle2.Radius

    # Direction from c1 to c2
    axis = c2 - c1
    dist = axis.Length
    axis.Unitize()

    # Perpendicular direction in the circle plane
    normal = circle1.Plane.ZAxis
    perp = rg.Vector3d.CrossProduct(normal, axis)
    perp.Unitize()

    print("C1: r={:.3f}, C2: r={:.3f}, dist={:.3f}, hourglass_r={:.3f}".format(
        r1, r2, dist, hourglass_r))

    # Construction radii (externally tangent)
    R1 = r1 + hourglass_r
    R2 = r2 + hourglass_r

    # Circle-circle intersection: find tangent circle centers
    # x = offset along axis from c1, y = perpendicular offset
    x = (dist * dist + R1 * R1 - R2 * R2) / (2.0 * dist)
    y_sq = R1 * R1 - x * x

    if y_sq < 0:
        print("ERROR: no tangent circles exist (y^2={:.3f}). Adjust hourglass_r.".format(y_sq))
        return None

    y = math.sqrt(y_sq)
    base = c1 + axis * x
    t1_center = base + perp * y
    t2_center = base - perp * y

    print("T1 center: {}, T2 center: {}".format(t1_center, t2_center))

    # 4 tangent points (on original circles, toward tangent circle centers)
    def tangent_pt(circ_center, circ_r, tang_center):
        v = tang_center - circ_center
        v.Unitize()
        return circ_center + v * circ_r

    p_c1_t1 = tangent_pt(c1, r1, t1_center)
    p_c1_t2 = tangent_pt(c1, r1, t2_center)
    p_c2_t1 = tangent_pt(c2, r2, t1_center)
    p_c2_t2 = tangent_pt(c2, r2, t2_center)

    # Interior points for 3-point arc construction
    c1_far = c1 - axis * r1                    # C1 farthest from C2
    c2_far = c2 + axis * r2                    # C2 farthest from C1
    t1_inner = t1_center - perp * hourglass_r  # T1 closest to centerline
    t2_inner = t2_center + perp * hourglass_r  # T2 closest to centerline

    # 4 arcs in continuous path order
    arc_c1 = rg.Arc(p_c1_t2, c1_far, p_c1_t1)   # C1 outer (away from C2)
    arc_t1 = rg.Arc(p_c1_t1, t1_inner, p_c2_t1)  # T1 waist (concave inward)
    arc_c2 = rg.Arc(p_c2_t1, c2_far, p_c2_t2)    # C2 outer (away from C1)
    arc_t2 = rg.Arc(p_c2_t2, t2_inner, p_c1_t2)  # T2 waist (concave inward)

    curves = [
        rg.ArcCurve(arc_c1),
        rg.ArcCurve(arc_t1),
        rg.ArcCurve(arc_c2),
        rg.ArcCurve(arc_t2),
    ]

    print("Arc lengths: C1={:.3f}, T1={:.3f}, C2={:.3f}, T2={:.3f}".format(
        curves[0].GetLength(), curves[1].GetLength(),
        curves[2].GetLength(), curves[3].GetLength()))

    joined = rg.Curve.JoinCurves(curves, tolerance)
    if joined and len(joined) > 0:
        result = joined[0]
        print("Joined: closed={}, length={:.3f}".format(result.IsClosed, result.GetLength()))
        return result
    else:
        print("WARNING: JoinCurves failed, returning individual arcs")
        return curves


# GH component inputs: circle1, circle2, hourglass_r, tolerance
a = create_hourglass(circle1, circle2, hourglass_r, 0.1)
# ---------- end python_3_script ----------
outer_perimeter_curve = Curve(python_3_script.a)

# ----
# Solid Blank
initial_circle_left = Circle(circle_left_3)
initial_circle_right = Circle(circle_right_3)
outer_perimeter_curve_2 = Curve(outer_perimeter_curve)
merge = Merge(Data1=outer_perimeter_curve_2, Data2=initial_circle_left, Data3=initial_circle_right)  # -> flatten(Result)
boundary_surfaces = BoundarySurfaces(Edges=merge)
unit_x = UnitX(Factor="150")
extrude = Extrude(Base=boundary_surfaces, Direction=unit_x)
multiplication_2 = Multiplication(A=unit_x, B="-0.50")
move_2 = Move(Geometry=extrude, Motion=multiplication_2)  # -> Geometry, Transform
blank_positioned = Brep(move_2.Geometry)

# ----
# Front Edge Geometry
outer_perimeter_curve_3 = Curve(outer_perimeter_curve)
initial_circle_left_2 = Circle(circle_left_3)
initial_circle_right_2 = Circle(circle_right_3)
right_forward_offset_mm_2 = Number(right_forward_offset_mm)
merge_2 = Merge(Data1=outer_perimeter_curve_3, Data2=initial_circle_left_2, Data3=initial_circle_right_2)  # -> flatten(Result)
boundary_surfaces_2 = BoundarySurfaces(Edges=merge_2)
unit_x_2 = UnitX(Factor="50")
unit_x_3 = UnitX(Factor=right_forward_offset_mm_2)
move_3 = Move(Geometry=initial_circle_right_2, Motion=unit_x_3)  # -> Geometry, Transform
transform_2 = Transform(Geometry=outer_perimeter_curve_3, Transform=move_3.Transform)
multiplication_3 = Multiplication(A=unit_x_2, B="-0.50")
front_outer_perimeter_positioned_right = Curve(transform_2)
front_outer_perimeter_positioned_left = Curve(outer_perimeter_curve_3)
front_circle_left_positioned = Circle(initial_circle_left_2)
front_circle_right_positioned = Circle(move_3.Geometry)

# ----
# Back Edge Geometry
minimum_band_width_mm = Number(factoryautomatorpy.band_width_mm)
outer_perimeter_positioned_left = Curve(front_outer_perimeter_positioned_left)
circle_right_positioned = Circle(front_circle_right_positioned)
circle_left_positioned = Circle(front_circle_left_positioned)
outer_perimeter_positioned_right = Curve(front_outer_perimeter_positioned_right)
unit_x_4 = UnitX(Factor=minimum_band_width_mm)
move_4 = Move(Geometry=circle_left_positioned, Motion=unit_x_4)  # -> Geometry, Transform
transform_3 = Transform(Geometry=circle_right_positioned, Transform=move_4.Transform)
transform_4 = Transform(Geometry=outer_perimeter_positioned_right, Transform=move_4.Transform)
transform_5 = Transform(Geometry=outer_perimeter_positioned_left, Transform=move_4.Transform)
back_outer_perimeter_positioned_right = Curve(transform_4)
back_outer_perimeter_positioned_left = Curve(transform_5)
back_circle_right_positioned = Circle(transform_3)
back_circle_left_positioned = Circle(move_4.Geometry)

b_left_slit_2 = Boolean(b_left_slit)
r_left_2 = Number(r_left)
unit_y_2 = UnitY(Factor=1)
unit_z = UnitZ(Factor="-1")
annotation_location = Panel("0, -10, -30")

# ----
# Initial Geometry
outer_circle_right_3 = Circle(outer_circle_right)
outer_circle_left_3 = Circle(outer_circle_left)
circle_right_4 = Circle(circle_right_3)
circle_left_4 = Circle(circle_left_3)
r_right_outer_3 = Number(r_right_outer)
r_left_3 = Number(r_left)
r_left_outer_3 = Number(r_left_outer)
r_right_2 = Number(r_right)
merge_3 = Merge(Data1=r_left_3, Data2=r_left_outer_3, Data3=r_right_2, Data4=r_right_outer_3)  # -> flatten(Result)
merge_4 = Merge(Data1=circle_left_4, Data2=outer_circle_left_3, Data3=circle_right_4, Data4=outer_circle_right_3)  # -> flatten(Result)
area = Area(Geometry=merge_4)  # -> Area, Centroid
deconstruct = Deconstruct(Point=area.Centroid)  # -> XComponent, YComponent, ZComponent
addition_3 = Addition(A=deconstruct.ZComponent, B=merge_3)
construct_point = ConstructPoint(XCoordinate=deconstruct.XComponent, YCoordinate=deconstruct.YComponent, ZCoordinate=addition_3)
annotation_dot = AnnotationDot(Location=construct_point, PrimaryText=merge_3)  # -> AnnotationDot, Location, PrimaryText, TextHeight
annotation_dot_2 = AnnotationDot(annotation_dot.AnnotationDot)
circle = Circle(merge_4)

blank_positioned_2 = Brep(blank_positioned)
annotation_dot_3 = AnnotationDot(Location=annotation_location, PrimaryText="Left Slit")  # -> AnnotationDot, Location, PrimaryText, TextHeight
annotation_dot_4 = AnnotationDot(Location=annotation_location, PrimaryText="Intersected Solid")  # -> AnnotationDot, Location, PrimaryText, TextHeight
annotation_dot_5 = AnnotationDot(Location=annotation_location, PrimaryText="Right Slit")  # -> AnnotationDot, Location, PrimaryText, TextHeight
annotation_dot_6 = AnnotationDot(Location=annotation_location, PrimaryText="Object ID")  # -> AnnotationDot, Location, PrimaryText, TextHeight
annotation_dot_7 = AnnotationDot(Location=annotation_location, PrimaryText="Direction Indicator")  # -> AnnotationDot, Location, PrimaryText, TextHeight
annotation_dot_8 = AnnotationDot(Location=annotation_location, PrimaryText="Mesh Smoothing")  # -> AnnotationDot, Location, PrimaryText, TextHeight
annotation_dot_9 = AnnotationDot(Location=annotation_location, PrimaryText="Print Bed Orientation")  # -> AnnotationDot, Location, PrimaryText, TextHeight

# ----
# Solid Intersection Template
blank_positioned_3 = Brep(blank_positioned)
front_outer_perimeter_positioned_left_2 = Curve(front_outer_perimeter_positioned_left)
front_perimeter_positioned_right = Curve(front_outer_perimeter_positioned_right)
back_outer_perimeter_positioned_right_2 = Curve(back_outer_perimeter_positioned_right)
back_outer_perimeter_positioned_left_2 = Curve(back_outer_perimeter_positioned_left)
far_left_back = Panel("-1000, 1000, 0")
far_left_forward = Panel("1000, 1000, 0")
far_right_forward = Panel("1000, -1000, 0")
far_right_backward = Panel("-1000, -1000, 0")
point = Point(far_left_forward)
point_2 = Point(far_left_back)
point_3 = Point(far_right_forward)
point_4 = Point(far_right_backward)
curve_closest_point = CurveClosestPoint(Point=point_2, Curve=front_outer_perimeter_positioned_left_2)  # -> Point, Parameter, Distance
curve_closest_point_2 = CurveClosestPoint(Point=point_3, Curve=back_outer_perimeter_positioned_right_2)  # -> Point, Parameter, Distance
curve_closest_point_3 = CurveClosestPoint(Point=point_4, Curve=front_perimeter_positioned_right)  # -> Point, Parameter, Distance
curve_closest_point_4 = CurveClosestPoint(Point=point, Curve=back_outer_perimeter_positioned_left_2)  # -> Point, Parameter, Distance
merge_5 = Merge(
    Data1=curve_closest_point_4.Point,
    Data2=curve_closest_point_2.Point,
    Data3=curve_closest_point_3.Point,
    Data4=curve_closest_point.Point)  # -> flatten(Result)
polyline = PolyLine(Vertices=merge_5, Closed=True)
unit_z_2 = UnitZ(Factor="-100")
boundary_surfaces_3 = BoundarySurfaces(Edges=polyline)
reverse = Reverse(Vector=unit_z_2)
move_5 = Move(Geometry=boundary_surfaces_3, Motion=unit_z_2)  # -> Geometry, Transform
multiplication_4 = Multiplication(A=reverse, B="2")
extrude_2 = Extrude(Base=move_5.Geometry, Direction=multiplication_4)
blank_positioned_4 = Brep(blank_positioned_3)
solid_intersection = SolidIntersection(BrepsA=extrude_2, BrepsB=blank_positioned_4)
python_3_script_2 = Python3Script(fillet_brep=solid_intersection, fillet_r="0.4", x=Toggle(True))  # -> out, output_brep, flatten(sharp_edges); inputs fillet_brep: Brep, fillet_r: Double
# ---------- python_3_script_2: Python ----------
# This file represents a stub for a GhPython component in Grasshopper.
# It sets up the environment to import and use the splintcommon or other external modules.

from pathlib import Path
import sys
from importlib import reload #FOR DEV
import time

# Walk up through nested clusters to find the root GH document (necessary for use in nested clusters)
doc = ghenv.Component.OnPingDocument()
while not doc.FilePath and doc.Owner:
    doc = doc.Owner.OnPingDocument()
ghFileDir = str(Path(doc.FilePath).resolve().parent / "src")

print(f"{ghFileDir=}")

if ghFileDir not in sys.path:
    print("ghFileDir needed to be included")
    sys.path.append(ghFileDir)

import splintcommon
reload(splintcommon) #FOR DEV
from splintcommon import mark_generation_start
mark_generation_start()

#splintcommon module is now available for use in this GhPython component
splintcommon.log(f'Gh FilletSharpEdges Node initialized at {time.ctime()}')

#Component code here

import BrepFillet
reload(BrepFillet)
from BrepFillet import fillet_sharp_edges, find_sharp_edges

# fillet_r = 0.1
output_brep = fillet_sharp_edges(fillet_brep, fillet_r, 60.0, 0.1)

# sharp_edges, sharp_angles = find_sharp_edges(fillet_brep, 60.0)

# print(f"{type(sharp_edges)}")
# print(f"{sharp_edges=}")
# ---------- end python_3_script_2 ----------
panel_4 = Panel(python_3_script_2.out)
horizontal_outline_surface = Geometry(boundary_surfaces_3)
horizontal_outline = Geometry(polyline)
horizontal_cutter = Brep(extrude_2)
splint_brep = Brep(python_3_script_2.output_brep)

print_bed_laydown_line = Line(StartPoint=curve_closest_point.Point, EndPoint=curve_closest_point_3.Point)
horizontal_cutter_2 = Brep(extrude_2)

print_bed_laydown_line_2 = Line(print_bed_laydown_line)

print_bed_laydown_line_3 = Line(print_bed_laydown_line_2)
unit_vector = UnitVector(Vector=print_bed_laydown_line_3)
end_points = EndPoints(Curve=print_bed_laydown_line_3)  # -> Start, End
point_5 = Point(end_points.Start)
point_6 = Point(end_points.End)

# ----
# Solid Construction Geometry
front_circle_left_positioned_2 = Circle(front_circle_left_positioned)
front_outer_perimeter_positioned_left_3 = Curve(front_outer_perimeter_positioned_left)
front_circle_right_positioned_2 = Circle(front_circle_right_positioned)
front_outer_perimeter_positioned_right_2 = Curve(front_outer_perimeter_positioned_right)
back_circle_left_positioned_2 = Circle(back_circle_left_positioned)
back_outer_perimeter_positioned_left_3 = Curve(back_outer_perimeter_positioned_left)
back_circle_right_positioned_2 = Circle(back_circle_right_positioned)
back_outer_perimeter_positioned_right_3 = Curve(back_outer_perimeter_positioned_right)
horizontal_outline_surface_2 = Geometry(horizontal_outline_surface)
horizontal_outline_2 = Geometry(horizontal_outline)
merge_6 = Merge(
    Data1=front_circle_left_positioned_2,
    Data2=front_outer_perimeter_positioned_left_3,
    Data3=front_circle_right_positioned_2,
    Data4=front_outer_perimeter_positioned_right_2)  # -> flatten(Result)
merge_7 = Merge(
    Data1=back_circle_left_positioned_2,
    Data2=back_outer_perimeter_positioned_left_3,
    Data3=back_circle_right_positioned_2,
    Data4=back_outer_perimeter_positioned_right_3)  # -> flatten(Result)
merge_8 = Merge(Data1=horizontal_outline_2, Data2=horizontal_outline_surface_2)  # -> flatten(Result)
horizontal_geometry = Geometry(merge_8)
back_geometry = Geometry(merge_7)
front_geometry = Geometry(merge_6)

horizontal_cutter_3 = Brep(horizontal_cutter)
splint_brep_2 = Brep(splint_brep)
print_bed_laydown_line_4 = Line(print_bed_laydown_line_2)

# ----
# Laydown Line Perp Calcs
print_bed_laydown_line_5 = Line(print_bed_laydown_line_2)
perp_frame = PerpFrame(Curve=print_bed_laydown_line_5, Parameter="0.3")
line_sdl = LineSDL(Start=perp_frame, Direction="0, -100, 0", Length="50")
xy_plane = XYPlane(Origin=Point(0, 0, 0))
deconstruct_plane = DeconstructPlane(Plane=perp_frame)  # -> Origin, XAxis, YAxis, ZAxis
orient = Orient(Geometry=line_sdl, Source=xy_plane, Target=perp_frame)  # -> Geometry, Transform
unit_vector_2 = UnitVector(Vector=print_bed_laydown_line_5)
reverse_2 = Reverse(Vector=unit_vector_2)
unit_vector_3 = UnitVector(Vector=orient.Geometry)
construct_plane = ConstructPlane(Origin=deconstruct_plane.Origin, XAxis=unit_vector_3, YAxis=reverse_2)
vizplane = VizPlane(plane=construct_plane)  # -> tip_2, line_2, annotation_dot_2
tip = Brep(vizplane.tip_2)
line = Line(vizplane.line_2)
annotation_dot_10 = AnnotationDot(vizplane.annotation_dot_2)
laydown_line_perp_dir = Vector(unit_vector_3)
laydown_plane = Plane(construct_plane)

# ----
# Left Slit
laydown_line_perp_dir_2 = Vector(laydown_line_perp_dir)
splint_brep_3 = Brep(splint_brep)
b_left_slit_3 = Boolean(b_left_slit_2)
laydown_plane_2 = Plane(laydown_plane)
shortcircuit_slit_py = Python3Script(is_slit_active=b_left_slit_3, splint_brep=splint_brep_3)  # -> out, brep_to_slit, brep_to_shortcircuit; inputs is_slit_active: Boolean, splint_brep: Brep
# ---------- shortcircuit_slit_py: Python ----------
if is_slit_active:
    brep_to_slit = splint_brep
    brep_to_shortcircuit = None
else:
    brep_to_slit = None
    brep_to_shortcircuit = splint_brep
# ---------- end shortcircuit_slit_py ----------
unit_z_3 = UnitZ(Factor=1)
box_center_slice_py = Python3Script(target_brep=shortcircuit_slit_py.brep_to_slit, view_vector=laydown_line_perp_dir_2, bbox_plane=laydown_plane_2)  # -> out, slice_surface, y_shift; inputs target_brep: Brep, view_vector: Vector3d, bbox_plane: Plane
# ---------- box_center_slice_py: Python ----------
# This file represents a stub for a GhPython component in Grasshopper.
# It sets up the environment to import and use the splintcommon or other external modules.

from pathlib import Path
import sys
from importlib import reload #FOR DEV
import time

# In normal GH doc
ghFileDir = None
try:
    ghFileDir = str(Path.joinpath(Path(ghenv.Component.OnPingDocument().FilePath).resolve().parents[0], "src"))
except:
    # In GH Cluster
    ghFileDir = str(Path.joinpath(Path(ghenv.Component.OnPingDocument().Owner.OnPingDocument().FilePath).resolve().parents[0], "src"))

print(f"{ghFileDir=}")

if ghFileDir not in sys.path:
    print("ghFileDir needed to be included")
    sys.path.append(ghFileDir)

import splintcommon
reload(splintcommon) #FOR DEV

#splintcommon module is now available for use in this GhPython component
splintcommon.log(f'GhPython Node initialized at {time.ctime()}')

import FeatureIdentification
reload(FeatureIdentification) #FOR DEV
from FeatureIdentification import box_center_slice

import Rhino.Geometry as rg

# Get a slice plane at the center, facing +Y direction
slice_surface, sizes = box_center_slice(
    target_brep=target_brep,
    bbox_plane=bbox_plane, #rg.Plane.WorldXY,
    choose_side_vector=view_vector,
    return_size=True,
)

print(f"{sizes=}")

y_shift = sizes[1] * .6

print(f"{y_shift=}")
# ---------- end box_center_slice_py ----------
box_center_slice_py_2 = Python3Script(target_brep=shortcircuit_slit_py.brep_to_slit, view_vector=unit_z_3)  # -> out, slice_surface, y_shift; inputs target_brep: Brep, view_vector: Vector3d
# ---------- box_center_slice_py_2: Python ----------
# This file represents a stub for a GhPython component in Grasshopper.
# It sets up the environment to import and use the splintcommon or other external modules.

from pathlib import Path
import sys
from importlib import reload #FOR DEV
import time

# In normal GH doc
ghFileDir = None
try:
    ghFileDir = str(Path.joinpath(Path(ghenv.Component.OnPingDocument().FilePath).resolve().parents[0], "src"))
except:
    # In GH Cluster
    ghFileDir = str(Path.joinpath(Path(ghenv.Component.OnPingDocument().Owner.OnPingDocument().FilePath).resolve().parents[0], "src"))

print(f"{ghFileDir=}")

if ghFileDir not in sys.path:
    print("ghFileDir needed to be included")
    sys.path.append(ghFileDir)

import splintcommon
reload(splintcommon) #FOR DEV

#splintcommon module is now available for use in this GhPython component
splintcommon.log(f'GhPython Node initialized at {time.ctime()}')

import FeatureIdentification
reload(FeatureIdentification) #FOR DEV
from FeatureIdentification import box_center_slice

import Rhino.Geometry as rg

# Get a slice plane at the center, facing +Y direction
slice_surface, sizes = box_center_slice(
    target_brep=target_brep,
    bbox_plane=rg.Plane.WorldXY,
    choose_side_vector=view_vector,
    return_size=True,
)

print(f"{sizes=}")

y_shift = sizes[1] * .6

print(f"{y_shift=}")
# ---------- end box_center_slice_py_2 ----------
unit_y_3 = UnitY(Factor=box_center_slice_py.y_shift)
move_6 = Move(Geometry=box_center_slice_py_2.slice_surface, Motion=unit_y_3)  # -> Geometry, Transform
slitbot_py = Python3Script(splint_brep=shortcircuit_slit_py.brep_to_slit, slit_panel=move_6.Geometry, slit_thickness="0.3")  # -> out, brep_out, flatten(side_a_edges), flatten(side_b_edges), side_a_cutter, side_b_cutter; inputs splint_brep: Brep, slit_panel: Brep, slit_thickness: Double
# ---------- slitbot_py: Python ----------
# This file represents a stub for a GhPython component in Grasshopper.
# It sets up the environment to import and use the splintcommon or other external modules.

from pathlib import Path
import sys
from importlib import reload #FOR DEV
import time

# Walk up through nested clusters to find the root GH document (necessary for use in nested clusters)
doc = ghenv.Component.OnPingDocument()
while not doc.FilePath and doc.Owner:
    doc = doc.Owner.OnPingDocument()
ghFileDir = str(Path(doc.FilePath).resolve().parent / "src")

print(f"{ghFileDir=}")

if ghFileDir not in sys.path:
    print("ghFileDir needed to be included")
    sys.path.append(ghFileDir)

import splintcommon
reload(splintcommon) #FOR DEV
from splintcommon import mark_generation_start
mark_generation_start()

#splintcommon module is now available for use in this GhPython component
splintcommon.log(f'GhPython Node initialized at {time.ctime()}')

#Component code here

import BrepSlit
reload(BrepSlit)
from BrepSlit import cut_slit

fillet_radius = 0.3

brep_out, side_a_edges, side_b_edges, side_a_cutter, side_b_cutter = cut_slit(splint_brep, slit_panel, slit_thickness, fillet_radius)

print(f"{side_a_edges=}")
print(f"{side_b_edges=}")
# ---------- end slitbot_py ----------
shortcircuit_slit_py_2 = Python3Script(is_slit_active=b_left_slit_3, slit_brep=slitbot_py.brep_out, splint_brep=shortcircuit_slit_py.brep_to_shortcircuit)  # -> out, out_brep; inputs is_slit_active: Boolean, slit_brep: Brep, splint_brep: Brep
# ---------- shortcircuit_slit_py_2: Python ----------
print(f"{is_slit_active=}")
if is_slit_active:
    print("Returning the slit brep")
    out_brep = slit_brep
else:
    print("Returning the boring splint")
    out_brep = splint_brep
# ---------- end shortcircuit_slit_py_2 ----------
splint_brep_left_slit = Brep(shortcircuit_slit_py_2.out_brep)

# ----
# Right Slit
laydown_line_perp_dir_3 = Vector(laydown_line_perp_dir)
splint_brep_4 = Brep(splint_brep_left_slit)
laydown_plane_3 = Plane(laydown_plane)
b_right_slit_2 = Boolean(b_right_slit)
shortcircuit_slit_py_3 = Python3Script(is_slit_active=b_right_slit_2, splint_brep=splint_brep_4)  # -> out, brep_to_slit, brep_to_shortcircuit; inputs is_slit_active: Boolean, splint_brep: Brep; same code as shortcircuit_slit_py
unit_z_4 = UnitZ(Factor=1)
box_center_slice_py_3 = Python3Script(target_brep=shortcircuit_slit_py_3.brep_to_slit, view_vector=laydown_line_perp_dir_3, bbox_plane=laydown_plane_3)  # -> out, slice_surface, y_shift; inputs target_brep: Brep, view_vector: Vector3d, bbox_plane: Plane; same code as box_center_slice_py
box_center_slice_py_4 = Python3Script(target_brep=shortcircuit_slit_py_3.brep_to_slit, view_vector=unit_z_4)  # -> out, slice_surface, y_shift; inputs target_brep: Brep, view_vector: Vector3d; same code as box_center_slice_py_2
unit_y_4 = UnitY(Factor=box_center_slice_py_3.y_shift)
reverse_3 = Reverse(Vector=unit_y_4)
move_7 = Move(Geometry=box_center_slice_py_4.slice_surface, Motion=reverse_3)  # -> Geometry, Transform
slitbot_py_2 = Python3Script(splint_brep=shortcircuit_slit_py_3.brep_to_slit, slit_panel=move_7.Geometry, slit_thickness="0.3")  # -> out, brep_out, flatten(side_a_edges), flatten(side_b_edges), side_a_cutter, side_b_cutter; inputs splint_brep: Brep, slit_panel: Brep, slit_thickness: Double; same code as slitbot_py
shortcircuit_slit_py_4 = Python3Script(is_slit_active=b_right_slit_2, slit_brep=slitbot_py_2.brep_out, splint_brep=shortcircuit_slit_py_3.brep_to_shortcircuit)  # -> out, out_brep; inputs is_slit_active: Boolean, slit_brep: Brep, splint_brep: Brep; same code as shortcircuit_slit_py_2
splint_brep_right_slit = Brep(shortcircuit_slit_py_4.out_brep)

panel_5 = Panel(slitbot_py_2.out)
panel_6 = Panel(slitbot_py.out)
laydown_line_perp_dir_4 = Vector(laydown_line_perp_dir)
splint_brep_right_slit_2 = Brep(splint_brep_right_slit)
splint_brep_left_slit_2 = Brep(splint_brep_left_slit)
merge_9 = Merge(Data1=splint_brep_left_slit_2, Data2=annotation_dot_3.AnnotationDot)  # -> flatten(Result)
merge_10 = Merge(Data1=splint_brep_right_slit_2, Data2=annotation_dot_5.AnnotationDot)  # -> flatten(Result)

# ----
# ID Embossing Gun
text_size = Slider(3.3, range=2.5..6)
axial_band_thickness_mm_4 = Number(axial_band_thickness_mm_2)
objectid_2 = Text(objectid)
finishedsplintbrep = Brep(splint_brep_right_slit)
panel_7 = Panel(objectid_2)
vizvector = Arrow(direction=Vector(0, 0, 1), arrowlen="4", text="up")  # -> cone_2, line, annotation_dot_2
vizvector_2 = Arrow(direction=Vector(0, 0, 1), arrowlen="4", text="proj")  # -> cone_2, line, annotation_dot_2
tip_2 = Brep(vizvector.cone_2)
line_2 = Line(vizvector.line)
annotation_dot_11 = AnnotationDot(vizvector.annotation_dot_2)

vizvector_3 = Arrow(start=deconstruct_plane.Origin, direction=unit_vector_3, arrowlen="4", text="Xw")  # -> cone_2, line, annotation_dot_2

very_specific_text_origin_finder_cl = VerySpecificTextOriginFinderCL(target_brep_2=finishedsplintbrep, target_brep=finishedsplintbrep)
text_origin_pt = Point(very_specific_text_origin_finder_cl)

textgun_py = Python3Script(
    splint_brep=finishedsplintbrep,
    object_id=objectid_2,
    text_up_vector=laydown_line_perp_dir_4,
    wall_thickness_mm=axial_band_thickness_mm_4,
    text_size=text_size,
    text_projection_vector=unit_z,
    extrusion_depth_factor="0.29",
    projection_origin=text_origin_pt,
    x=Toggle(False))  # -> out, embossedBrep, originalTextBreps, final_text_plane, projected_letters; inputs splint_brep: Brep, object_id: String, text_up_vector: Vector3d, text_size: Double, text_projection_vector: Vector3d, extrusion_depth_factor: Double, projection_origin: Point3d
# ---------- textgun_py: Python ----------
# This file represents a stub for a GhPython component in Grasshopper.
# It sets up the environment to import and use the splintcommon or other external modules.

from pathlib import Path
import sys
from importlib import reload #FOR DEV ONLY
import time

# In normal GH doc
ghFileDir = None
try:
    ghFileDir = str(Path.joinpath(Path(ghenv.Component.OnPingDocument().FilePath).resolve().parents[0], "src"))
except:
    # In GH Cluster
    ghFileDir = str(Path.joinpath(Path(ghenv.Component.OnPingDocument().Owner.OnPingDocument().FilePath).resolve().parents[0], "src"))

print(f"{ghFileDir=}")

if ghFileDir not in sys.path:
    print("ghFileDir needed to be included")
    sys.path.append(ghFileDir)

import splintcommon
reload(splintcommon) #FOR DEV

#splintcommon module is now available for use in this GhPython component
splintcommon.log(f'GhPython Node initialized at {time.ctime()}')

import TextGun
reload(TextGun) #FOR DEV
from TextGun import emboss_text

embossedBrep, originalTextBreps, projected_letters, final_text_plane = emboss_text(
    target_brep=splint_brep,
    text_content=object_id,
    wall_thickness_mm=wall_thickness_mm,
    text_size=text_size,
    text_up_vector=text_up_vector,
    text_projection_vector=text_projection_vector,
    extrusion_depth_factor=extrusion_depth_factor,
    projection_origin=projection_origin,
    emboss_inside=True,
    align_to_surface_normal=True
)
# ---------- end textgun_py ----------
plane = Plane(textgun_py.final_text_plane)
vizplane_2 = VizPlane(plane=plane)  # -> tip_2, line_2, annotation_dot_2
brep = Brep(textgun_py.originalTextBreps)
panel_8 = Panel(textgun_py.out)
tip_3 = Brep(vizplane_2.tip_2)
line_3 = Line(vizplane_2.line_2)
annotation_dot_12 = AnnotationDot(vizplane_2.annotation_dot_2)
plane_2 = Plane(textgun_py.final_text_plane)
projected_letters_brep = Brep(graft(textgun_py.projected_letters))
splint_with_embossed_id = Brep(textgun_py.embossedBrep)
panel_9 = Panel(projected_letters_brep)

splint_with_embossed_id_2 = Brep(splint_with_embossed_id)
projected_letters_brep_2 = Brep(graft(projected_letters_brep))

# ----
# Direction Indicator
ball_r_to_wall_ratio = Slider(0.68, range=0.6..1)
splint_body = Brep(splint_with_embossed_id)
axial_band_thickness_mm_5 = Number(axial_band_thickness_mm_2)
unit_y_5 = UnitY(Factor=1)
unit_y_6 = UnitY(Factor=1)
unit_z_5 = UnitZ(Factor=1)
xy_plane_2 = XYPlane(Origin=Point(0, 0, 0))
multiplication_5 = Multiplication(A=axial_band_thickness_mm_5, B=ball_r_to_wall_ratio)
# Find center pillar yz position
box_center_slice_py_5 = Python3Script(target_brep=splint_body, view_vector=unit_y_6)  # -> out, slice_surface, y_shift; inputs target_brep: Brep, view_vector: Vector3d; same code as box_center_slice_py_2
nub_radius = Panel(multiplication_5)
# Find center pillar xy position
box_center_slice_py_6 = Python3Script(target_brep=splint_body, view_vector=unit_z_5, bbox_plane=xy_plane_2)  # -> out, slice_surface, y_shift; inputs target_brep: Brep, view_vector: Vector3d, bbox_plane: Plane; same code as box_center_slice_py
area_2 = Area(Geometry=box_center_slice_py_5.slice_surface)  # -> Area, Centroid
deconstruct_2 = Deconstruct(Point=area_2.Centroid)  # -> XComponent, YComponent, ZComponent
unit_z_6 = UnitZ(Factor="-100")
negative = Negative(Value="100")
splint_body_2 = Brep(splint_body)

area_3 = Area(Geometry=box_center_slice_py_6.slice_surface)  # -> Area, Centroid
brep_2 = Brep(box_center_slice_py_6.slice_surface)
xy_plane_3 = XYPlane(Origin=area_3.Centroid)
scale_nu = ScaleNU(Geometry=box_center_slice_py_6.slice_surface, Plane=xy_plane_3, ScaleX="1.1", ScaleY="0.6", ScaleZ=1)  # -> Geometry, Transform

brep_brep = BrepBrep(BrepA=splint_body, BrepB=scale_nu.Geometry)  # -> Curves, Points
list_item = ListItem(List=brep_brep.Curves, Index="0", Wrap=True)
panel_10 = Panel(list_item)
area_4 = Area(Geometry=list_item)  # -> Area, Centroid
central_post_centroid = Point(area_4.Centroid)
central_post_centroid_2 = Point(central_post_centroid)
deconstruct_3 = Deconstruct(Point=central_post_centroid_2)  # -> XComponent, YComponent, ZComponent
construct_point_2 = ConstructPoint(XCoordinate=deconstruct_2.XComponent, YCoordinate=deconstruct_3.YComponent, ZCoordinate=deconstruct_2.ZComponent)
move_to_point = MoveToPoint(Geometry=box_center_slice_py_5.slice_surface, PointA=area_2.Centroid, PointB=construct_point_2)  # -> Moved, Vector, Transform
brep_brep_2 = BrepBrep(BrepA=splint_body, BrepB=move_to_point.Moved)  # -> Curves, Points
list_item_2 = ListItem(List=brep_brep_2.Curves, Index="0", Wrap=True)
central_post_cross_section = Curve(list_item_2)
move_8 = Move(Geometry=central_post_centroid, Motion=unit_z_6)  # -> Geometry, Transform
curve_closest_point_5 = CurveClosestPoint(Point=move_8.Geometry, Curve=central_post_cross_section)  # -> Point, Parameter, Distance
deconstruct_4 = Deconstruct(Point=curve_closest_point_5.Point)  # -> XComponent, YComponent, ZComponent
construct_point_3 = ConstructPoint(XCoordinate="100", YCoordinate=deconstruct_4.YComponent, ZCoordinate=negative)
curve_closest_point_6 = CurveClosestPoint(Point=construct_point_3, Curve=central_post_cross_section)  # -> Point, Parameter, Distance
line_4 = Line(StartPoint=curve_closest_point_5.Point, EndPoint=curve_closest_point_6.Point)
point_on_curve = PointOnCurve(line_4, parameter=0.564)
point_7 = Point(point_on_curve)
xy_plane_4 = XYPlane(Origin=point_7)
sphere = Sphere(Base=xy_plane_4, Radius=nub_radius)
solid_difference = SolidDifference(BrepsA=splint_body_2, BrepsB=sphere)
splints_w_direction_indicator = Brep(solid_difference)

direction_sphere = Geometry(sphere)

# ----
# Final Meshing
# And Smoothing
number_slider = Slider(0.12, range=0.05..0.2)
splint_brep_5 = Brep(splints_w_direction_indicator)
shrinkwrap = ShrinkWrap(
    Geometry=splint_brep_5,
    EdgeLength=number_slider,
    Offset=0,
    Smoothing=Slider(8, range=0..10),
    Optimization=10,
    FillHoles=True)
splint_smooth_mesh = Mesh(shrinkwrap)

splints_w_direction_indicator_2 = Brep(splints_w_direction_indicator)
direction_sphere_2 = Geometry(direction_sphere)
splint_smooth_mesh_2 = Mesh(splint_smooth_mesh)

# ----
# Print Bed Orientation
print_bed_laydown_line_6 = Line(print_bed_laydown_line_2)
splint = Geometry(splint_smooth_mesh)
rotate_axis = RotateAxis(Geometry=splint, Angle=degrees("90"), Axis=print_bed_laydown_line_6)  # -> Geometry, Transform
oriented_splint = Geometry(rotate_axis.Geometry)

oriented_splint_2 = Geometry(oriented_splint)

# ----
# Probe Construction
splint_brep_6 = Brep(splints_w_direction_indicator)
front_circle_left_positioned_3 = Circle(front_circle_left_positioned)
back_circle_left_positioned_3 = Circle(back_circle_left_positioned)
back_circle_right_positioned_3 = Circle(back_circle_right_positioned)
front_circle_right_positioned_3 = Circle(front_circle_right_positioned)
unit_y_7 = UnitY(Factor=1)
yz_plane_2 = YZPlane(Origin=Point(0, 0, 0))
bounding_box = BoundingBox(Content=[front_circle_left_positioned_3, back_circle_left_positioned_3], Plane=PlaneXY(0, 0, 0), UnionBox=True)  # -> Box, Box_2
bounding_box_2 = BoundingBox(Content=[front_circle_right_positioned_3, back_circle_right_positioned_3], Plane=PlaneXY(0, 0, 0), UnionBox=True)  # -> Box, Box_2
box_center_slice_py_7 = Python3Script(target_brep=splint_brep_6, view_vector=unit_y_7, bbox_plane=yz_plane_2)  # -> out, slice_surface, y_shift; inputs target_brep: Brep, view_vector: Vector3d, bbox_plane: Plane; same code as box_center_slice_py
volume = Volume(Geometry=bounding_box.Box)  # -> Volume, Centroid
volume_2 = Volume(Geometry=bounding_box_2.Box)  # -> Volume, Centroid
area_5 = Area(Geometry=box_center_slice_py_7.slice_surface)  # -> Area, Centroid
deconstruct_5 = Deconstruct(Point=volume_2.Centroid)  # -> XComponent, YComponent, ZComponent
deconstruct_6 = Deconstruct(Point=volume.Centroid)  # -> XComponent, YComponent, ZComponent
deconstruct_7 = Deconstruct(Point=area_5.Centroid)  # -> XComponent, YComponent, ZComponent
construct_point_4 = ConstructPoint(XCoordinate=deconstruct_7.XComponent, YCoordinate=deconstruct_5.YComponent, ZCoordinate=deconstruct_7.ZComponent)
construct_point_5 = ConstructPoint(XCoordinate=deconstruct_7.XComponent, YCoordinate=deconstruct_6.YComponent, ZCoordinate=deconstruct_7.ZComponent)
unit_z_7 = UnitZ(Factor=1)

scale = Scale(Geometry=box_center_slice_py_7.slice_surface, Center=area_5.Centroid, Factor="1.6")  # -> Geometry, Transform

move_to_point_2 = MoveToPoint(Geometry=scale.Geometry, PointA=area_5.Centroid, PointB=construct_point_4)  # -> Moved, Vector, Transform
move_to_point_3 = MoveToPoint(Geometry=scale.Geometry, PointA=area_5.Centroid, PointB=construct_point_5)  # -> Moved, Vector, Transform
brep_brep_3 = BrepBrep(BrepA=splint_brep_6, BrepB=move_to_point_2.Moved)  # -> Curves, Points
brep_brep_4 = BrepBrep(BrepA=splint_brep_6, BrepB=move_to_point_3.Moved)  # -> Curves, Points
area_6 = Area(Geometry=brep_brep_3.Curves)  # -> Area, Centroid
area_7 = Area(Geometry=brep_brep_4.Curves)  # -> Area, Centroid
average = Average(Input=area_6.Centroid)
deconstruct_8 = Deconstruct(Point=average)  # -> XComponent, YComponent, ZComponent
average_2 = Average(Input=area_7.Centroid)
average_3 = Average(Input=[average_2, average])
deconstruct_9 = Deconstruct(Point=average_3)  # -> XComponent, YComponent, ZComponent
deconstruct_10 = Deconstruct(Point=average_2)  # -> XComponent, YComponent, ZComponent
construct_point_6 = ConstructPoint(XCoordinate=deconstruct_9.XComponent, YCoordinate=deconstruct_8.YComponent, ZCoordinate=deconstruct_8.ZComponent)
construct_point_7 = ConstructPoint(XCoordinate=deconstruct_9.XComponent, YCoordinate=deconstruct_10.YComponent, ZCoordinate=deconstruct_10.ZComponent)
line_5 = Line(StartPoint=construct_point_7, EndPoint=construct_point_6)
line_sdl_2 = LineSDL(Start=average, Direction=unit_z_7, Length="30")
line_sdl_3 = LineSDL(Start=average_2, Direction=unit_z_7, Length="30")
middle_wall_probe_line = Line(line_5)
right_probe_line = Line(line_sdl_2)
left_probe_line = Line(line_sdl_3)

# ----
# Wall Probe Data
middle_wall_probe_line_2 = Line(middle_wall_probe_line)
right_probe_line_2 = Line(right_probe_line)
left_probe_line_2 = Line(left_probe_line)
splint_smooth_mesh_3 = Mesh(splint_smooth_mesh)
wall_probe_data = Python3Script(
    splint_mesh=splint_smooth_mesh_3,
    left_probe_line=left_probe_line_2,
    right_probe_line=right_probe_line_2,
    middle_wall_probe_line=middle_wall_probe_line_2)  # -> out, preview_geos, py_wall_probe_data; inputs splint_mesh: Mesh, left_probe_line: Line, right_probe_line: Line, middle_wall_probe_line: Line
# ---------- wall_probe_data: Python ----------
# This file represents a stub for a GhPython component in Grasshopper.
# It sets up the environment to import and use the splintcommon or other external modules.

from pathlib import Path
import sys
from importlib import reload #FOR DEV
import time

# Walk up through nested clusters to find the root GH document (necessary for use in nested clusters)
doc = ghenv.Component.OnPingDocument()
while not doc.FilePath and doc.Owner:
    doc = doc.Owner.OnPingDocument()
ghFileDir = str(Path(doc.FilePath).resolve().parent / "src")

print(f"{ghFileDir=}")

if ghFileDir not in sys.path:
    print("ghFileDir needed to be included")
    sys.path.append(ghFileDir)

import splintcommon
reload(splintcommon) #FOR DEV
from splintcommon import mark_generation_start
mark_generation_start()

#splintcommon module is now available for use in this GhPython component
splintcommon.log(f'GhPython Node initialized at {time.ctime()}')

#Component code here

import splintmeasurement
reload(splintmeasurement) 
from splintmeasurement import measure_mesh_wall_thickness
preview_geos = []
py_wall_probe_data = {}

# LEFT upwards probe line
probe_data = measure_mesh_wall_thickness(splint_mesh, left_probe_line)
print(f"{probe_data=}")
py_wall_probe_data["left_ring_wall_thickness_mm"] = probe_data.get("thickness_mm", "None")
preview_geos.append(left_probe_line)
preview_geos.append(probe_data.get("inner_point", "None")) #"thickness_mm": None, "inner_point": inner_point, "outer_point": None
preview_geos.append(probe_data.get("outer_point", "None"))

# RIGHT upwards probe line
right_probe_data = measure_mesh_wall_thickness(splint_mesh, right_probe_line)
print(f"{right_probe_data=}")
py_wall_probe_data["right_ring_wall_thickness_mm"] = right_probe_data.get("thickness_mm", "None")
preview_geos.append(right_probe_line)
preview_geos.append(right_probe_data.get("inner_point", "None")) #"thickness_mm": None, "inner_point": inner_point, "outer_point": None
preview_geos.append(right_probe_data.get("outer_point", "None"))

# MIDDLE - left to right side probe line
middle_probe_data = measure_mesh_wall_thickness(splint_mesh, right_probe_line)
print(f"{middle_probe_data=}")
py_wall_probe_data["middle_wall_thickness_mm"] = middle_probe_data.get("thickness_mm", "None")
preview_geos.append(middle_wall_probe_line)
preview_geos.append(middle_probe_data.get("inner_point", "None")) #"thickness_mm": None, "inner_point": inner_point, "outer_point": None
preview_geos.append(middle_probe_data.get("outer_point", "None"))

# probe_thicknesses, preview_geo = measure_mesh_wall_thickness(splint_mesh, ray_lines, far_distance=200.0):
print(f"{py_wall_probe_data=}")

py_wall_probe_data = [py_wall_probe_data]
# ---------- end wall_probe_data ----------
panel_11 = Panel(wall_probe_data.py_wall_probe_data)
probe_preview_geometry = Geometry(wall_probe_data.preview_geos)
panel_12 = Panel(wall_probe_data.out)
py_wall_probe_data = Data(wall_probe_data.py_wall_probe_data)
list_item_3 = ListItem(List=probe_preview_geometry, Index=Slider(0, range=0..4), Wrap=False)

probe_preview_geometry_2 = Geometry(probe_preview_geometry)

# ----
# Preview Steps
merge_11 = Merge(Data1=splint_brep_2, Data2=annotation_dot_4.AnnotationDot)  # -> flatten(Result)
merge_12 = Merge(Data1=front_geometry, Data2=back_geometry, Data3=horizontal_geometry)  # -> flatten(Result)
merge_13 = Merge(Data1=horizontal_cutter_3, Data2=blank_positioned_2)  # -> flatten(Result)
merge_14 = Merge(Data1=circle, Data2=annotation_dot_2)  # -> flatten(Result)
merge_15 = Merge(Data1=splint_with_embossed_id_2, Data2=projected_letters_brep_2, Data3=annotation_dot_6.AnnotationDot)  # -> flatten(Result)
merge_16 = Merge(Data1=splints_w_direction_indicator_2, Data2=direction_sphere_2, Data3=annotation_dot_7.AnnotationDot)  # -> flatten(Result)
merge_17 = Merge(Data1=splint_smooth_mesh_2, Data2=annotation_dot_8.AnnotationDot, Data3=probe_preview_geometry_2)  # -> flatten(Result)
merge_18 = Merge(Data1=print_bed_laydown_line_4, Data2=oriented_splint_2, Data3=annotation_dot_9.AnnotationDot)  # -> flatten(Result)
movecomplex_cl = MoveComplexCL(base_move_vector="60, 0, 0", geo_data=merge_14, is_simple=True)
movecomplex_cl_2 = MoveComplexCL(base_move_vector="250, 0, 0", geo_data=merge_13, is_simple=True)
movecomplex_cl_3 = MoveComplexCL(base_move_vector="350, 0, 0", geo_data=merge_11, is_simple=True)
movecomplex_cl_4 = MoveComplexCL(base_move_vector="400, 0, 0", geo_data=merge_9, is_simple=True)
movecomplex_cl_5 = MoveComplexCL(base_move_vector="120, 0, 0", geo_data=merge_12, is_simple=True)
movecomplex_cl_6 = MoveComplexCL(base_move_vector="450, 0, 0", geo_data=merge_10, is_simple=True)
movecomplex_cl_7 = MoveComplexCL(base_move_vector="500, 0, 0", geo_data=merge_15, is_simple=True)
movecomplex_cl_8 = MoveComplexCL(base_move_vector="550, 0, 0", geo_data=merge_16, is_simple=True)
movecomplex_cl_9 = MoveComplexCL(base_move_vector="600, 0, 0", geo_data=merge_17, is_simple=True)
movecomplex_cl_10 = MoveComplexCL(base_move_vector="650, 0, 0", geo_data=merge_18, is_simple=True)
merge_19 = Merge(
    Data1=movecomplex_cl,
    Data2=movecomplex_cl_5,
    Data3=movecomplex_cl_2,
    Data4=movecomplex_cl_3,
    Data5=movecomplex_cl_4,
    Data6=movecomplex_cl_6,
    Data7=movecomplex_cl_7,
    Data8=movecomplex_cl_8,
    Data9=movecomplex_cl_9,
    Data10=movecomplex_cl_10)  # -> flatten(Result)
random_color = RandomColor(Data=merge_19, Seed=2, FastMode=False)
# Bake Me
custom_preview = CustomPreview(Geometry=merge_19, Material=random_color)

# ----
# Report Results
dev_activate_toggle = BooleanToggle(True)
axial_band_thickness_mm_6 = Number(axial_band_thickness_mm_2)
py_wall_probe_data_2 = Data(py_wall_probe_data)
root_filename_out_2 = Text(root_filename_out)
output_dir_out_2 = Text(output_dir_out)
splint_mesh = Mesh(oriented_splint)
panel_13 = Panel(py_wall_probe_data_2)
savemeshpy = Python3Script(
    final_splint_mesh=splint_mesh,
    output_dir=output_dir_out_2,
    root_filename=root_filename_out_2,
    bool_activate=dev_activate_toggle,
    axial_band_thickness_mm=axial_band_thickness_mm_6,
    py_wall_probe_data=py_wall_probe_data_2)  # -> out; inputs final_splint_mesh: Mesh, axial_band_thickness_mm: Double
# ---------- savemeshpy: Python ----------
# This file represents a stub for a GhPython component in Grasshopper.
# It sets up the environment to import and use the splintcommon or other external modules.

from pathlib import Path
import sys
from importlib import reload #FOR DEV
import time

# Walk up through nested clusters to find the root GH document (necessary for use in nested clusters)
doc = ghenv.Component.OnPingDocument()
while not doc.FilePath and doc.Owner:
    doc = doc.Owner.OnPingDocument()
ghFileDir = str(Path(doc.FilePath).resolve().parent / "src")

print(f"{ghFileDir=}")

if ghFileDir not in sys.path:
    print("ghFileDir needed to be included")
    sys.path.append(ghFileDir)

import splintcommon
reload(splintcommon) #FOR DEV
from splintcommon import log, gh_decode

#splintcommon module is now available for use in this GhPython component
splintcommon.log(f'GhPython Node initialized at {time.ctime()}')

#Component code here

import splintmeshes
reload(splintmeshes)
from splintmeshes import save_job_output

wall_probe_data = gh_decode(py_wall_probe_data)

# With error handling
try:
    log(f"Logging to {output_dir=} {root_filename=}")
    #splintmeshes.save_mesh(final_splint_mesh, output_dir, root_filename, format_type="stl")

    save_job_output(final_splint_mesh, output_dir, root_filename, "stl", custom_metadata={
        "wall_probe_data": wall_probe_data,
        "axial_band_thickness_mm": axial_band_thickness_mm,
    })
    log(f"Export succeeded: {output_dir=} {root_filename=}")
except splintmeshes.MeshExportError as e:
    log("Export failed: {}".format(e))
except ValueError as e:
    log("Bad input: {}".format(e))
# ---------- end savemeshpy ----------
panel_14 = Panel(savemeshpy)

# ==== cluster VizPlane
plane = ClusterInput()
deconstruct_plane = DeconstructPlane(Plane=plane)  # -> Origin, XAxis, YAxis, ZAxis
arrow = Arrow(start=deconstruct_plane.Origin, direction=deconstruct_plane.XAxis, arrowlen="3", text="X")  # -> cone_2, line, annotation_dot_2
arrow_2 = Arrow(start=deconstruct_plane.Origin, direction=deconstruct_plane.YAxis, arrowlen="3", text="Y")  # -> cone_2, line, annotation_dot_2
arrow_3 = Arrow(start=deconstruct_plane.Origin, direction=deconstruct_plane.ZAxis, arrowlen="3", text="Z")  # -> cone_2, line, annotation_dot_2
tip = Brep([arrow.cone_2, arrow_2.cone_2, arrow_3.cone_2])
line = Line([arrow.line, arrow_2.line, arrow_3.line])
annotation_dot = AnnotationDot([arrow.annotation_dot_2, arrow_2.annotation_dot_2, arrow_3.annotation_dot_2])
tip_2 = ClusterOutput(tip)
line_2 = ClusterOutput(line)
annotation_dot_2 = ClusterOutput(annotation_dot)

# ==== cluster VerySpecificTextOriginFinderCL
target_brep = ClusterInput()
target_brep_2 = ClusterInput()
unit_z = UnitZ(Factor=1)
box_center_slice_py = Python3Script(target_brep=target_brep, view_vector=unit_z)  # -> out, slice_surface, y_size; inputs target_brep: Brep, view_vector: Vector3d
# ---------- box_center_slice_py: Python ----------
# This file represents a stub for a GhPython component in Grasshopper.
# It sets up the environment to import and use the splintcommon or other external modules.

from pathlib import Path
import sys
from importlib import reload #FOR DEV
import time

# In normal GH doc
ghFileDir = None
try:
    ghFileDir = str(Path.joinpath(Path(ghenv.Component.OnPingDocument().FilePath).resolve().parents[0], "src"))
except:
    # In GH Cluster
    ghFileDir = str(Path.joinpath(Path(ghenv.Component.OnPingDocument().Owner.OnPingDocument().FilePath).resolve().parents[0], "src"))

print(f"{ghFileDir=}")

if ghFileDir not in sys.path:
    print("ghFileDir needed to be included")
    sys.path.append(ghFileDir)

import splintcommon
reload(splintcommon) #FOR DEV

#splintcommon module is now available for use in this GhPython component
splintcommon.log(f'GhPython Node initialized at {time.ctime()}')

import FeatureIdentification
reload(FeatureIdentification) #FOR DEV
from FeatureIdentification import box_center_slice

import Rhino.Geometry as rg

# Get a slice plane at the center, facing +Y direction
slice_surface, sizes = box_center_slice(
    target_brep=target_brep,
    bbox_plane=rg.Plane.WorldXY,
    choose_side_vector=view_vector,
    return_size=True,
)

print(f"{sizes=}")

y_size = sizes[1]

print(f"{y_size=}")
# ---------- end box_center_slice_py ----------
target_brep_3 = Brep(target_brep_2)
slit_nudge_z = Panel("0.25")
unit_z_2 = UnitZ(Factor=slit_nudge_z)
move = Move(Geometry=box_center_slice_py.slice_surface, Motion=unit_z_2)  # -> Geometry, Transform
brep_brep = BrepBrep(BrepA=target_brep_3, BrepB=move.Geometry)  # -> Curves, Points
area = Area(Geometry=brep_brep.Curves)  # -> Area, Centroid
deconstruct = Deconstruct(Point=area.Centroid)  # -> XComponent, YComponent, ZComponent
sort_list = SortList(Keys=deconstruct.YComponent, ValuesValuesA=brep_brep.Curves)  # -> Keys, ValuesValuesA
extreme_left_back = Panel("-1000, 1000, 0")
extreme_left_front = Panel("1000, 1000, 0")
extreme_right_back = Panel("-1000, -1000, 0")
extreme_right_front = Panel("1000, -1000, 0")
left_index = Panel("2")
middle_index = Panel("1")
list_item = ListItem(List=sort_list.ValuesValuesA, Index=left_index, Wrap=True)
list_item_2 = ListItem(List=sort_list.ValuesValuesA, Index=middle_index, Wrap=True)
extreme_right_front_pt = Point(extreme_right_front)
extreme_right_back_pt = Point(extreme_right_back)
extreme_left_front_pt = Point(extreme_left_front)
extreme_left_back_pt = Point(extreme_left_back)
middle_support_curve = Curve(list_item_2)
left_ring_extreme = Curve(list_item)
center_front = CurveClosestPoint(Point=extreme_left_front_pt, Curve=middle_support_curve)  # -> Point, Parameter, Distance
left_wall_front = CurveClosestPoint(Point=extreme_right_front_pt, Curve=left_ring_extreme)  # -> Point, Parameter, Distance
center_back = CurveClosestPoint(Point=extreme_left_back_pt, Curve=middle_support_curve)  # -> Point, Parameter, Distance
left_wall_back = CurveClosestPoint(Point=extreme_right_back_pt, Curve=left_ring_extreme)  # -> Point, Parameter, Distance
merge = Merge(Data1=left_wall_front.Point, Data2=left_wall_back.Point, Data3=center_front.Point, Data4=center_back.Point)  # -> flatten(Result)
average = Average(Input=merge)
projection_center_pt = Point(average)
projection_center_pt_2 = ClusterOutput(projection_center_pt)

# ==== cluster MoveComplexCL
base_move_vector = ClusterInput()
is_simple = ClusterInput()
geo_data = ClusterInput()
is_simple_2 = Boolean(is_simple)
geo_data_2 = Geometry(geo_data)
base_move_vector_2 = Vector(base_move_vector)
pick_n_choose = PickNChoose(Pattern=is_simple_2, Stream0="40", Stream1="0")
transpose_py = Python3Script(data=geo_data_2)  # -> out, result; inputs data: tree of GeometryBase
# ---------- transpose_py: Python ----------
# Input: data (Tree Access)
# Output: result

from Grasshopper import DataTree
from Grasshopper.Kernel.Data import GH_Path

branches = [list(data.Branch(i)) for i in range(data.BranchCount)]

print("Branch count: {}".format(data.BranchCount))
for i, b in enumerate(branches):
    print("  Branch {}: {} items, path {}".format(i, len(b), data.Path(i)))

count = min(len(b) for b in branches)
print("Transposing: {} branches x {} items".format(len(branches), count))

result = DataTree[object]()
for i in range(count):
    path = GH_Path(i)
    for b in branches:
        result.Add(b[i], path)

print("Output: {} branches x {} items each".format(result.BranchCount, result.Branch(0).Count if result.BranchCount > 0 else 0))
# ---------- end transpose_py ----------
panel = Panel(transpose_py.out)
python_3_script = Python3Script(data=transpose_py.result, base_vector=base_move_vector_2, z_separation=pick_n_choose)  # -> out, vectors; inputs data: tree, base_vector: Vector3d, z_separation: Double
# ---------- python_3_script: Python ----------
# This file represents a stub for a GhPython component in Grasshopper.
# It sets up the environment to import and use the splintcommon or other external modules.

from pathlib import Path
import sys
from importlib import reload #FOR DEV
import time

# Walk up through nested clusters to find the root GH document (necessary for use in nested clusters)
doc = ghenv.Component.OnPingDocument()
while not doc.FilePath and doc.Owner:
    doc = doc.Owner.OnPingDocument()
ghFileDir = str(Path(doc.FilePath).resolve().parent / "src")

print(f"{ghFileDir=}")

if ghFileDir not in sys.path:
    print("ghFileDir needed to be included")
    sys.path.append(ghFileDir)

import splintcommon
reload(splintcommon) #FOR DEV

#splintcommon module is now available for use in this GhPython component
splintcommon.log(f'GhPython Node initialized at {time.ctime()}')

#Your code here

# Inputs:
#   data         (Tree Access, type hint: ghdoc Object)
#   base_vector  (Item Access, type hint: Vector3d)
#   z_separation (Item Access, type hint: float)
# Output:
#   vectors

import Rhino.Geometry as rg
from Grasshopper import DataTree
from Grasshopper.Kernel.Data import GH_Path

branch_count = data.BranchCount
print("Branches: {}, z_separation: {}".format(branch_count, z_separation))

vectors = DataTree[rg.Vector3d]()

for i in range(branch_count):
    path = data.Path(i)
    item_count = data.Branch(i).Count
    vec = rg.Vector3d(base_vector.X, base_vector.Y, base_vector.Z + z_separation * i)
    print("  Branch {} ({}): {} items, vec Z={:.2f}".format(i, path, item_count, vec.Z))
    # One vector per item so the tree matches the geometry tree for Move
    for j in range(item_count):
        vectors.Add(vec, path)
# ---------- end python_3_script ----------
move = Move(Geometry=transpose_py.result, Motion=python_3_script.vectors)  # -> Geometry, Transform
panel_2 = Panel(move.Geometry)
geometry = Geometry(move.Geometry)
geometry_2 = ClusterOutput(geometry)

# ==== cluster Arrow
arrowlen = ClusterInput()
text = ClusterInput()
arrowlen_2 = Number(arrowlen)
text_2 = Text(text)
start = ClusterInput()
direction = ClusterInput()
division = Division(A=arrowlen_2, B="4")
line_sdl = LineSDL(Start=start, Direction=direction, Length=arrowlen_2)
end_points = EndPoints(Curve=line_sdl)  # -> Start, End
line = ClusterOutput(line_sdl)
plane_normal = PlaneNormal(Origin=end_points.End, ZAxis=line_sdl)
annotation_dot = AnnotationDot(Location=end_points.End, PrimaryText=text_2)  # -> AnnotationDot, Location, PrimaryText, TextHeight
cone = Cone(Base=plane_normal, Radius=division, Length=division)  # -> Cone, Tip
cone_2 = ClusterOutput(cone.Cone)
annotation_dot_2 = ClusterOutput(annotation_dot.AnnotationDot)
