# Grasshopper definition InfinityExtend.gh (Grasshopper 1.0.8)
# plug-ins: Pufferfish, Wombat

brepinspect_py = Python3Script()  # -> out; inputs brepToTest: Brep
# ---------- brepinspect_py: Python ----------
# This file represents a stub for a GhPython component in Grasshopper.
# It sets up the environment to import and use the splintcommon or other external modules.

from pathlib import Path
import sys
from importlib import reload #FOR DEV ONLY
import time

# In normal GH doc
ghFileDir = None
try:
    ghFileDir = str(Path.joinpath(Path(ghenv.Component.OnPingDocument().FilePath).resolve().parents[0], "src"))
except:
    # In GH Cluster
    ghFileDir = str(Path.joinpath(Path(ghenv.Component.OnPingDocument().Owner.OnPingDocument().FilePath).resolve().parents[0], "src"))

print(f"{ghFileDir=}")

if ghFileDir not in sys.path:
    print("ghFileDir needed to be included")
    sys.path.append(ghFileDir)

import splintcommon
reload(splintcommon) #FOR DEV ONLY

#splintcommon module is now available for use in this GhPython component
splintcommon.log(f'GhPython Node initialized at {time.ctime()}')

import BrepInspect
reload(BrepInspect)

BrepInspect.inspect_solid_brep(brepToTest)
# ---------- end brepinspect_py ----------
panel = Panel(brepinspect_py)
vizplane = VizPlane(plane=PlaneXY(0, 0, 0))  # -> tip_2, line_2, annotation_dot_2
ext_ln_pts = ExtLnPts()
vizvector = VizVector(direction=Vector(0, 0, 1))  # -> cone_2, line, annotation_dot_2
vizplane_2 = VizPlane(plane=PlaneXY(0, 0, 0))  # -> tip_2, line_2, annotation_dot_2

# ---- group: Internal Parameters
central_band_strap_width_mm = Panel("8.5")
extent_band_strap_width_mm = Panel("5.0")
mid_joint_rise_factor = Panel("1.0")
axial_band_thickness_mm = Panel("1.50")

# ----
# InfinityExtend
is_production_mode = BooleanToggle(True)
toggle_job_make_it_go = BooleanToggle(False)
geo_algorithm_name = Panel("InfinityExtend")
geo_algorithm_name_2 = Panel("InfinityExtend")
factoryautomatorpy = Python3Script(is_production_mode=is_production_mode, geo_algorithm_name=geo_algorithm_name, toggleJob=toggle_job_make_it_go)  # -> out, inter_phalanx_distance_mm, root_circumference_mm, mid_circumference_mm, tip_circumference_mm, flexion_degrees, root_filename, output_dir, objectID, raw_data; inputs is_production_mode: Boolean, toggleJob: Boolean
# ---------- factoryautomatorpy: Python ----------
from pathlib import Path
import sys
from importlib import reload #FOR DEV
import time

ghFileDir = str(Path.joinpath(Path(ghenv.Component.OnPingDocument().FilePath).resolve().parents[0], "src"))
print(f"{ghFileDir=}")

if ghFileDir not in sys.path:
    print("ghFileDir needed to be included")
    sys.path.append(ghFileDir)

import splintcommon
reload(splintcommon) #FOR DEV
from splintcommon import mark_generation_start
mark_generation_start()
splintcommon.log(f'FactoryAutomatorPY Running at: ({time.strftime("%H:%M:%S", time.localtime())})')
# ==================== Component Code ===========================

def float_range(start, stop, count):
    current = start
    step = (stop - start) / (count - 1)
    result_range = []
    for c in range(count):
        result_range.append(start + (step * c))
    return result_range

job_data, objectID, root_filename, output_dir, raw_data = splintcommon.load_job_data(is_production_mode, geo_algorithm_name)

# This mapping must match the schema of the data in the DB for this geometry type
inter_phalanx_distance_mm = job_data["inter_phalanx_distance_mm"]
root_circumference_mm = job_data["root_circumference_mm"]
mid_circumference_mm = job_data["mid_circumference_mm"]
tip_circumference_mm = job_data["tip_circumference_mm"]
objectID = job_data["objectID"]

# Special Case, this splint can do a contraction version
if "flexion_degrees" in job_data:
    flexion_degrees = job_data["flexion_degrees"]
else:
    try:
        contracture_flexion_start = job_data["contracture_flexion_start"]
        contracture_flexion_end = job_data["contracture_flexion_end"]
        contracture_flexion_count = job_data["contracture_flexion_count"]

        flexion_degrees = float_range(contracture_flexion_start, contracture_flexion_end, contracture_flexion_count)
    except:
        raise Exception("The required flexion parameters are not present for a contracture splint")


splintcommon.log(f"Result data {geo_algorithm_name=} {objectID=} {inter_phalanx_distance_mm=} {root_circumference_mm=} {mid_circumference_mm=} {tip_circumference_mm=}")
# ---------- end factoryautomatorpy ----------
panel_2 = Panel(factoryautomatorpy.raw_data)
panel_3 = Panel(factoryautomatorpy.root_filename)
panel_4 = Panel(factoryautomatorpy.out)

# ----
# Finger Preform Solid
# Notes: The infinity_flex is not specific to one joint, but we will model it surrounding the pip joint
# inter_phalanx_distance spans half of the proximal phalanx and half of the middle phalanx and so we will use half of it for the model's proximal_len and middle_len
root_circ = Number(factoryautomatorpy.root_circumference_mm)
mid_circ = Number(factoryautomatorpy.mid_circumference_mm)
inter_phalanx_distance = Number(factoryautomatorpy.inter_phalanx_distance_mm)
awial_band_thickness_mm = Number(axial_band_thickness_mm)
flexion_degrees = Number(factoryautomatorpy.flexion_degrees)
tip_circ = Number(factoryautomatorpy.tip_circumference_mm)
extent_band_width = Number(extent_band_strap_width_mm)
fingermodel_py = Python3Script(
    toggle=Toggle(False),
    shell_thickness=awial_band_thickness_mm,
    root_circ=root_circ,
    mid_circ=mid_circ,
    tip_circ=tip_circ,
    flexion_degrees=flexion_degrees,
    inter_phalanx_distance=inter_phalanx_distance,
    extent_band_width=extent_band_width)  # -> out, cFinger_brep, cCenterline, cComponents, sCenterline, sFinger_brep, sComponents, splintBlank, splintBlankCenterline
# ---------- fingermodel_py: Python ----------
# This file represents a stub for a GhPython component in Grasshopper.
# It sets up the environment to import and use the splintcommon or other external modules.

from pathlib import Path
import sys
from importlib import reload #FOR DEV ONLY
import time

# In normal GH doc
ghFileDir = None
try:
    ghFileDir = str(Path.joinpath(Path(ghenv.Component.OnPingDocument().FilePath).resolve().parents[0], "src"))
except:
    # In GH Cluster
    ghFileDir = str(Path.joinpath(Path(ghenv.Component.OnPingDocument().Owner.OnPingDocument().FilePath).resolve().parents[0], "src"))

print(f"{ghFileDir=}")

if ghFileDir not in sys.path:
    print("ghFileDir needed to be included")
    sys.path.append(ghFileDir)

import splintcommon
reload(splintcommon) #FOR DEV ONLY

#splintcommon module is now available for use in this GhPython component
splintcommon.log(f'GhPython Node initialized at {time.ctime()}')


from importlib import reload
import FingerModel
reload(FingerModel)

from FingerModel import create_finger_model, FingerParams
from dataclasses import replace

import BrepDifference
reload(BrepDifference) #FOR DEV ONLY
from BrepDifference import robust_brep_difference

# Refresher, order of elements:
# metacarpel numb, mcp, proximal, pip, middle, dip, distal

# input values to work with:
# shell_thickness
# root_circ ~= mcp_circ 
# mid_circ ~=
# tip_circ
# flexion_degrees
# inter_phalanx_distance
# extent_band_width

# The model input values that we need to provide or compute:

trimDistAroundPIP = (inter_phalanx_distance/2) + (extent_band_width/2)

coreParams = FingerParams(
    # Segment range - generate full finger or subset
    start_at="proximal",
    end_at="middle",

    # Joint circumferences (mm)
    mcp_circ=root_circ,
    proximal_mid_circ=root_circ,
    pip_circ=mid_circ,
    middle_mid_circ=tip_circ,
    dip_circ=tip_circ,
    # distal_mid_circ=60.0,
    # tip_circ=45.0,

    # Metacarpal stub length
    metacarpal_len=20.0,

    # Phalanx lengths (mm)
    proximal_len=inter_phalanx_distance,
    middle_len=inter_phalanx_distance,
    # distal_len=None,
    
    # Joint angles (degrees) - positive = curl toward palm
    # mcp_flex=0.0,
    pip_flex=flexion_degrees,
    # dip_flex=0.0,

    # mcp_lateral=0.0,
    # pip_lateral=0.0,
    # dip_lateral=0.0,   
)

# Create the finger model
cCenterline, cFinger_brep, cComponents, cJointPositions = create_finger_model(
    coreParams,
    tolerance=None,      # Use document tolerance
    return_parts=True    # Return individual components
)

# Create the shell params
shellParams = replace(coreParams, shell_thickness=2.0, start_at="proximal", end_at="middle")
shellParams.trim_start=("pip", -1 * trimDistAroundPIP)  # 10mm before MCP joint
shellParams.trim_end=("pip", trimDistAroundPIP)

# Create the shell model
sCenterline, sFinger_brep, sComponents, sJointPositions = create_finger_model(
    shellParams,
    tolerance=None,      # Use document tolerance
    return_parts=True    # Return individual components
)

# Subtract inner from shell to create hollow splint
splintBlank, success, method = robust_brep_difference(
    minuend=sFinger_brep,      # subtract FROM this (larger)
    subtrahend=cFinger_brep,   # subtract this (smaller)
    base_tolerance=0.001
)

splintBlankCenterline = sCenterline

if success:
    print(f"Hollow splint created via {method}")
    # result_brep is now a hollow shell
else:
    print(f"Difference failed: {method}")
# ---------- end fingermodel_py ----------
circ2rad = Python3Script(circumference=mid_circ)  # -> radius
# ---------- circ2rad: Python ----------
from math import pi

radius = circumference / (2 * pi)

print(f"{circumference=} {radius=}")
# ---------- end circ2rad ----------
inner_shell_brep = Brep(fingermodel_py.cFinger_brep)
outer_shell_brep = Brep(fingermodel_py.sFinger_brep)
material_shell_brep = Brep(fingermodel_py.splintBlank)
mid_splint_radius = Number(circ2rad)
splint_centerline = Curve(fingermodel_py.splintBlankCenterline)

# ----
# Central Finger Line Geometry
splint_centerline_2 = Curve(splint_centerline)
explode = Explode(Curve=splint_centerline_2, Recursive=True)  # -> Segments, Vertices
list_item = ListItem(List=explode.Segments, Index="0", Wrap=False)
list_item_2 = ListItem(List=explode.Segments, Index="1", Wrap=False)
unit_vector = UnitVector(Vector=list_item)
end_points = EndPoints(Curve=list_item_2)  # -> Start, End
end_points_2 = EndPoints(Curve=list_item)  # -> Start, End
firstsegmentdirection = Vector(flatten(unit_vector))
secondsegmentline = Line(flatten(list_item_2))
secondsegmentend = Point(flatten(end_points.End))
firstsegmentstart = Point(flatten(end_points_2.Start))
firstsegmentline = Line(flatten(list_item))
firstsegmentend = Point(flatten(end_points_2.End))

wall_thickness = Number(axial_band_thickness_mm)
objectid = Text(factoryautomatorpy.objectID)

# ----
# Alignment Work
secondsegmentend_2 = Point(secondsegmentend)
firstsegmentstart_2 = Point(firstsegmentstart)
line = Line(StartPoint=firstsegmentstart_2, EndPoint=secondsegmentend_2)
average_center_line = Line(line)

panel_5 = Panel(fingermodel_py.out)

# ----
# Preform
# Orientation
# Adjustment
firstsegmentdirection_2 = Vector(firstsegmentdirection)
secondsegmentline_2 = Line(secondsegmentline)
firstsegmentstart_3 = Point(firstsegmentstart)
firstsegmentend_2 = Point(firstsegmentend)
firstsegmentline_2 = Line(firstsegmentline)
average_center_line_2 = Line(average_center_line)
secondsegmentend_3 = Point(secondsegmentend)
material_shell_brep_2 = Brep(material_shell_brep)
inner_shell_brep_2 = Brep(inner_shell_brep)
outer_shell_brep_2 = Brep(outer_shell_brep)
xz_plane = XZPlane(Origin=Point(0, 0, 0))
angle = Angle(VectorA=average_center_line_2, VectorB=firstsegmentdirection_2, Plane=xz_plane)  # -> Angle, Reflex
finger_model_rotate = Rotate(Geometry=material_shell_brep_2, Angle=angle.Angle, Plane=xz_plane)  # -> Geometry, Transform
outer_barrel_transform = Transform(Geometry=outer_shell_brep_2, Transform=finger_model_rotate.Transform)
inner_barrel_transform = Transform(Geometry=inner_shell_brep_2, Transform=finger_model_rotate.Transform)
center_line_transform = Transform(Geometry=average_center_line_2, Transform=finger_model_rotate.Transform)
root_line_transform = Transform(Geometry=firstsegmentline_2, Transform=finger_model_rotate.Transform)
tip_line_transform = Transform(Geometry=secondsegmentline_2, Transform=finger_model_rotate.Transform)
first_orientation_shift_transform = Transform(finger_model_rotate.Transform)
firstsegmentline_3 = Line(root_line_transform)
secondsegmentline_3 = Line(tip_line_transform)
average_center_line_3 = Line(center_line_transform)
inner_shell_brep_3 = Brep(inner_barrel_transform)
outer_shell_brep_3 = Brep(outer_barrel_transform)

number_slider = Slider(3, range=0..5)
list_item_3 = ListItem(Index=number_slider, Wrap=False)
list_item_4 = ListItem(Index=number_slider, Wrap=False)

# ----
# Outer Bottom Bands Creation
outer_band_width_mm = Panel(extent_band_strap_width_mm)
outer_shell_brep_4 = Brep(outer_shell_brep_3)
mid_circumference = Number(mid_circ)
circ2rad_2 = Python3Script(circumference=mid_circumference)  # -> radius; same code as circ2rad
unit_y = UnitY(Factor=1)
multiplication = Multiplication(A=circ2rad_2, B="-1")
unit_z = UnitZ(Factor=multiplication)
box_center_slice_py = Python3Script(target_brep=outer_shell_brep_4, view_vector=unit_y)  # -> out, slice_surface; inputs target_brep: Brep, view_vector: Vector3d
# ---------- box_center_slice_py: Python ----------
# This file represents a stub for a GhPython component in Grasshopper.
# It sets up the environment to import and use the splintcommon or other external modules.

from pathlib import Path
import sys
from importlib import reload #FOR DEV
import time

# In normal GH doc
ghFileDir = None
try:
    ghFileDir = str(Path.joinpath(Path(ghenv.Component.OnPingDocument().FilePath).resolve().parents[0], "src"))
except:
    # In GH Cluster
    ghFileDir = str(Path.joinpath(Path(ghenv.Component.OnPingDocument().Owner.OnPingDocument().FilePath).resolve().parents[0], "src"))

print(f"{ghFileDir=}")

if ghFileDir not in sys.path:
    print("ghFileDir needed to be included")
    sys.path.append(ghFileDir)

import splintcommon
reload(splintcommon) #FOR DEV

#splintcommon module is now available for use in this GhPython component
splintcommon.log(f'GhPython Node initialized at {time.ctime()}')

import FeatureIdentification
reload(FeatureIdentification) #FOR DEV
from FeatureIdentification import box_center_slice

import Rhino.Geometry as rg

# Get a slice plane at the center, facing +Y direction
slice_surface = box_center_slice(
    target_brep=target_brep,
    bbox_plane=rg.Plane.WorldXY,
    choose_side_vector=view_vector
)
# ---------- end box_center_slice_py ----------
move = Move(Geometry=box_center_slice_py.slice_surface, Motion=unit_z)  # -> Geometry, Transform
box_center_slice_py_2 = Python3Script(target_brep=outer_shell_brep_4, slice_surface=move.Geometry)  # -> out, result_curves, result_points; inputs target_brep: Brep, slice_surface: Surface
# ---------- box_center_slice_py_2: Python ----------
# This file represents a stub for a GhPython component in Grasshopper.
# It sets up the environment to import and use the splintcommon or other external modules.

from pathlib import Path
import sys
from importlib import reload #FOR DEV
import time

# In normal GH doc
ghFileDir = None
try:
    ghFileDir = str(Path.joinpath(Path(ghenv.Component.OnPingDocument().FilePath).resolve().parents[0], "src"))
except:
    # In GH Cluster
    ghFileDir = str(Path.joinpath(Path(ghenv.Component.OnPingDocument().Owner.OnPingDocument().FilePath).resolve().parents[0], "src"))

print(f"{ghFileDir=}")

if ghFileDir not in sys.path:
    print("ghFileDir needed to be included")
    sys.path.append(ghFileDir)

import splintcommon
reload(splintcommon) #FOR DEV

#splintcommon module is now available for use in this GhPython component
splintcommon.log(f'GhPython Node initialized at {time.ctime()}')

import FeatureIdentification
reload(FeatureIdentification) #FOR DEV
from FeatureIdentification import intersect_with_reference

import Rhino.Geometry as rg

result_curves, result_points = intersect_with_reference(
    target_brep = target_brep, 
    slice_surface = slice_surface, 
    view_direction = rg.Vector3d.YAxis, 
    up_vector=rg.Vector3d.ZAxis
)
# ---------- end box_center_slice_py_2 ----------
list_item_5 = ListItem(List=box_center_slice_py_2.result_points, Index="2", Wrap=False)  # -> flatten(Item)
list_item_6 = ListItem(List=box_center_slice_py_2.result_points, Index="3", Wrap=False)  # -> flatten(Item)
unit_x = UnitX(Factor=1)
unit_x_2 = UnitX(Factor="-1")
nudge = Panel("-2")
unit_z_2 = UnitZ(Factor=nudge)
left_band_guide = LineSDL(Start=list_item_6, Direction=unit_x, Length=outer_band_width_mm)
right_band_guide = LineSDL(Start=list_item_5, Direction=unit_x_2, Length=outer_band_width_mm)
move_2 = Move(Geometry=right_band_guide, Motion=unit_z_2)  # -> Geometry, Transform
move_3 = Move(Geometry=left_band_guide, Motion=unit_z_2)  # -> Geometry, Transform
panel_6 = Panel("-50, 0, 0")  # disabled
root_outer_band = Curve(move_3.Geometry)
tip_outer_band = Curve(move_2.Geometry)
entwine = Entwine(Branch00=outer_shell_brep_4, Branch01=root_outer_band, Branch02=tip_outer_band, FlattenInputs=True)  # disabled
cluster = Cluster_2(base_move_vector=panel_6, geo_data=entwine)  # -> geometry, out; disabled

nudge_up = Panel("0.5")
side_projection_angle = Panel("32")
number_slider_2 = Slider(0, range=0..5)
dev_activate_toggle = BooleanToggle(True)
root_filename_out = Text(factoryautomatorpy.root_filename)
output_dir_out = Text(factoryautomatorpy.output_dir)

# ----
# Top Center Band Creation
outer_shell_brep_5 = Brep(outer_shell_brep_3)
bottom_band_width_mm = Panel(central_band_strap_width_mm)
average_center_line_4 = Line(average_center_line_3)
ref_nudge = Panel("75")
unit_z_3 = UnitZ(Factor=ref_nudge)
unit_y_2 = UnitY(Factor=ref_nudge)
curve_middle = CurveMiddle(Curve=average_center_line_4)
move_well_below = Move(Geometry=curve_middle, Motion=unit_z_3)  # -> Geometry, Transform
low_ref_point = Point(move_well_below.Geometry)
move_4 = Move(Geometry=low_ref_point, Motion=unit_y_2)  # -> Geometry, Transform
point = Point(move_4.Geometry)
merge = Merge(Data1=curve_middle, Data2=low_ref_point, Data3=point)  # -> flatten(Result)
plane_fit = PlaneFit(Points=merge)  # -> Plane, Deviation
unit_x_3 = UnitX(Factor=1)
xy_plane = XYPlane(Origin=Point(0, 0, 0))
brep_plane = BrepPlane(Brep=outer_shell_brep_5, Plane=plane_fit.Plane)  # -> flatten(Curves), Points
line_sdl = LineSDL(Start=xy_plane, Direction=unit_x_3, Length=bottom_band_width_mm)
curve_closest_point = CurveClosestPoint(Point=low_ref_point, Curve=brep_plane.Curves)  # -> Point, Parameter, Distance
curve_middle_2 = CurveMiddle(Curve=line_sdl)
line_2 = Line(StartPoint=curve_middle_2, EndPoint=curve_closest_point.Point)
move_5 = Move(Geometry=line_sdl, Motion=line_2)  # -> Geometry, Transform
center_band_line = Curve(move_5.Geometry)
outer_shell_brep_6 = Brep(outer_shell_brep_5)
perp_frame = PerpFrame(Curve=center_band_line, Parameter="0")
end_points_3 = EndPoints(Curve=center_band_line)  # -> Start, End
brep_plane_2 = BrepPlane(Brep=outer_shell_brep_6, Plane=perp_frame)  # -> flatten(Curves), Points
curve_closest_point_2 = CurveClosestPoint(Point=end_points_3.Start, Curve=brep_plane_2.Curves)  # -> Point, Parameter, Distance
multiplication_2 = Multiplication(A=curve_closest_point_2.Distance, B="1.0")

addition = Addition(A=multiplication_2, B=nudge_up)

unit_z_4 = UnitZ(Factor=addition)
move_6 = Move(Geometry=center_band_line, Motion=unit_z_4)  # -> Geometry, Transform
central_top_band = Curve(move_6.Geometry)

# ----
# Side Cutter Profile
bottom_band_width_mm_2 = Panel(central_band_strap_width_mm)
mid_joint_rise_factor_2 = Panel(mid_joint_rise_factor)
root_top_band = Curve(root_outer_band)
outer_shell_brep_7 = Brep(outer_shell_brep_3)
bottom_band = Curve(central_top_band)
tip_top_band = Curve(tip_outer_band)
multiplication_3 = Multiplication(A=bottom_band_width_mm_2, B=mid_joint_rise_factor_2)
midpoint = Midpoint(Curve=bottom_band)
negative = Negative(Value=multiplication_3)
unit_z_5 = UnitZ(Factor=negative)
move_7 = Move(Geometry=midpoint, Motion=unit_z_5)  # -> Geometry, Transform
end_points_4 = EndPoints(Curve=bottom_band)  # -> Start, End
end_points_5 = EndPoints(Curve=root_top_band)  # -> Start, End
end_points_6 = EndPoints(Curve=tip_top_band)  # -> Start, End
top_right_band_right_pt = Point(end_points_6.Start)
bottom_left_pt = Point(end_points_4.Start)
top_left_band_left_pt = Point(end_points_5.Start)
top_left_band_right_pt = Point(end_points_5.End)
central_pt = Point(move_7.Geometry)
top_right_band_left_pt = Point(end_points_6.End)
bottom_right_pt = Point(end_points_4.End)
line_3 = Line(StartPoint=top_left_band_right_pt, EndPoint=central_pt)
line_4 = Line(StartPoint=central_pt, EndPoint=top_right_band_left_pt)
midpoint_2 = Midpoint(Curve=line_3)
midpoint_3 = Midpoint(Curve=line_4)
tip_slant_line = Line(StartPoint=top_right_band_right_pt, EndPoint=bottom_right_pt)
line_5 = Line(StartPoint=bottom_right_pt, EndPoint=bottom_left_pt)
line_6 = Line(StartPoint=bottom_left_pt, EndPoint=top_left_band_left_pt)
line_7 = Line(StartPoint=top_left_band_left_pt, EndPoint=top_left_band_right_pt)
line_8 = Line(StartPoint=top_right_band_left_pt, EndPoint=top_right_band_right_pt)
line_9 = Line(StartPoint=top_left_band_right_pt, EndPoint=midpoint_2)
line_10 = Line(StartPoint=midpoint_3, EndPoint=top_right_band_left_pt)
entwine_2 = Entwine(
    Branch00=line_5,
    Branch01=line_6,
    Branch02=line_7,
    Branch03=line_9,
    Branch04=line_10,
    Branch05=line_8,
    Branch06=tip_slant_line,
    FlattenInputs=True)
transpose_py = Python3Script(data=entwine_2)  # -> out, result; inputs data: tree of GeometryBase; same code as transpose_py
join_curves = JoinCurves(Curves=transpose_py.result, Preserve=False)  # -> flatten(Curves)
connect_curves = ConnectCurves(Curves=graft(join_curves), Continuity=2, Close=True, Bulge=Slider(0.6, range=0..2))  # -> flatten(Curve)
merge_2 = Merge(Data1=line_5, Data2=line_6, Data3=line_7, Data4=line_9, Data5=line_10, Data6=line_8, Data7=tip_slant_line)
entwine_3 = Entwine(
    Branch00=outer_shell_brep_7,
    Branch01=line_5,
    Branch02=line_6,
    Branch03=line_7,
    Branch04=line_9,
    Branch05=line_10,
    Branch06=line_8,
    Branch07=tip_slant_line,
    Branch08=bottom_band,
    Branch09=root_top_band,
    Branch010=tip_top_band,
    FlattenInputs=True)  # disabled
panel_7 = Panel("0, 0, 0")  # disabled
close_curve = CloseCurve(Curve=connect_curves, Tolerance=0)
xz_plane_2 = XZPlane(Origin=Point(0, 0, 0))
unit_y_3 = UnitY(Factor="-30")
cluster_2 = Cluster_2(base_move_vector=panel_7, geo_data=entwine_3)  # -> geometry, out; disabled
project = Project(Geometry=connect_curves, Plane=xz_plane_2)  # -> Geometry, Transform
planar = Planar(Curve=project.Geometry)  # -> Planar, Plane, Deviation
move_8 = Move(Geometry=project.Geometry, Motion=unit_y_3)  # -> Geometry, Transform
geometry = Geometry(cluster_2.geometry)  # disabled
tip_slant_line_2 = Line(flatten(tip_slant_line))
cutter_curve = Curve(flatten(move_8.Geometry))
panel_8 = Panel(planar.Planar)

# ----
# Side Cutter Applied
cutter_curve_2 = Curve(cutter_curve)
panel_9 = Panel(cutter_curve_2)
unit_y_4 = UnitY(Factor="60")
boundary_surfaces = BoundarySurfaces(Edges=cutter_curve_2)
extrude = Extrude(Base=boundary_surfaces, Direction=unit_y_4)
inner_shell_brep_4 = Brep(inner_shell_brep_3)
side_cutter_volume = Brep(graft(extrude))
preform_tube_brep = Brep(graft(finger_model_rotate.Geometry))
solid_intersection = SolidIntersection(BrepsA=preform_tube_brep, BrepsB=side_cutter_volume)  # -> flatten(Result)
entwine_4 = Entwine(Branch00=solid_intersection, FlattenInputs=True)  # disabled
panel_10 = Panel("-50, 0, 0")  # disabled
cluster_3 = Cluster_2(base_move_vector=panel_10, geo_data=entwine_4)  # -> geometry, out; disabled
side_cutter_volume_2 = Brep(flatten(side_cutter_volume))
splint_brep = Brep(solid_intersection)
side_cutter_surface = Surface(boundary_surfaces)

# ----
# ID Embossing Gun
text_size = Slider(3.3, range=2.5..6)
mid_splint_radius_2 = Number(mid_splint_radius)
objectid_text = Text(objectid)
wall_thickness_mm = Number(wall_thickness)
finishedsplintbrep = Brep(splint_brep)
unit_z_6 = UnitZ(Factor=1)
unit_y_5 = UnitY(Factor=1)
yz_plane = YZPlane(Origin=Point(0, 0, 0))
bounding_box = BoundingBox(Content=finishedsplintbrep, Plane=PlaneXY(0, 0, 0))  # -> Box, Box_2
intersection_z_offset = Panel("1.25")
volume = Volume(Geometry=bounding_box.Box)  # -> Volume, Centroid
rotate = Rotate(Geometry=unit_y_5, Angle=degrees(side_projection_angle), Plane=yz_plane)  # -> Geometry, Transform
transform = Transform(Geometry=unit_z_6, Transform=rotate.Transform)
negative_2 = Negative(Value=mid_splint_radius_2)
added_rotation = Panel("90")
box_center_slice_py_3 = Python3Script(target_brep=finishedsplintbrep, view_vector=rotate.Geometry)  # -> out, slice_surface; inputs target_brep: Brep, view_vector: Vector3d; same code as box_center_slice_py
multiplication_4 = Multiplication(A=negative_2, B=intersection_z_offset)
addition_2 = Addition(A=side_projection_angle, B=added_rotation)
unit_z_7 = UnitZ(Factor=multiplication_4)
line_sdl_2 = LineSDL(Start=volume.Centroid, Direction=rotate.Geometry, Length=Slider(4, range=0..10))
centroid = Point(volume.Centroid)
vizvector_2 = VizVector(start=volume.Centroid, direction=transform, arrowlen="4", text="up")  # -> cone_2, line, annotation_dot_2
vizvector_3 = VizVector(start=volume.Centroid, direction=rotate.Geometry, arrowlen="4", text="proj")  # -> cone_2, line, annotation_dot_2
move_9 = Move(Geometry=box_center_slice_py_3.slice_surface, Motion=unit_z_7)  # -> Geometry, Transform
unit_y_6 = UnitY(Factor=1)
yz_plane_2 = YZPlane(Origin=centroid)
unit_z_8 = UnitZ(Factor=1)
tip = Brep(vizvector_2.cone_2)
line_11 = Line(vizvector_2.line)
annotation_dot = AnnotationDot(vizvector_2.annotation_dot_2)
rotate_2 = Rotate(Geometry=move_9.Geometry, Angle=degrees(addition_2), Plane=yz_plane_2)  # -> Geometry, Transform
transform_2 = Transform(Geometry=unit_y_6, Transform=rotate_2.Transform)
transform_3 = Transform(Geometry=unit_z_8, Transform=rotate_2.Transform)
box_center_slice_py_4 = Python3Script(target_brep=finishedsplintbrep, slice_surface=rotate_2.Geometry, view_direction=transform_2, up_vector=transform_3)  # -> out, result_curves, result_points; inputs target_brep: Brep, slice_surface: Surface, view_direction: Vector3d, up_vector: Vector3d
# ---------- box_center_slice_py_4: Python ----------
# This file represents a stub for a GhPython component in Grasshopper.
# It sets up the environment to import and use the splintcommon or other external modules.

from pathlib import Path
import sys
from importlib import reload #FOR DEV
import time

# In normal GH doc
ghFileDir = None
try:
    ghFileDir = str(Path.joinpath(Path(ghenv.Component.OnPingDocument().FilePath).resolve().parents[0], "src"))
except:
    # In GH Cluster
    ghFileDir = str(Path.joinpath(Path(ghenv.Component.OnPingDocument().Owner.OnPingDocument().FilePath).resolve().parents[0], "src"))

print(f"{ghFileDir=}")

if ghFileDir not in sys.path:
    print("ghFileDir needed to be included")
    sys.path.append(ghFileDir)

import splintcommon
reload(splintcommon) #FOR DEV

#splintcommon module is now available for use in this GhPython component
splintcommon.log(f'GhPython Node initialized at {time.ctime()}')

import FeatureIdentification
reload(FeatureIdentification) #FOR DEV
from FeatureIdentification import intersect_with_reference

import Rhino.Geometry as rg

result_curves, result_points = intersect_with_reference(
    target_brep = target_brep, 
    slice_surface = slice_surface, 
    view_direction = view_direction, 
    up_vector=up_vector
)
# ---------- end box_center_slice_py_4 ----------
join_curves_2 = JoinCurves(Curves=box_center_slice_py_4.result_curves, Preserve=False)  # -> flatten(Curves)
centroid_2 = Point(volume.Centroid)
area = Area(Geometry=join_curves_2)  # -> Area, Centroid
deconstruct = Deconstruct(Point=area.Centroid)  # -> XComponent, YComponent, ZComponent
deconstruct_2 = Deconstruct(Point=centroid_2)  # -> XComponent, YComponent, ZComponent
panel_11 = Panel("-50, 0, 0")  # disabled
construct_point = ConstructPoint(XCoordinate=deconstruct.XComponent, YCoordinate=deconstruct_2.YComponent, ZCoordinate=deconstruct_2.ZComponent)

object_text_py = Python3Script(breps=finishedsplintbrep, objectId=objectid_text)  # -> out, textOutput; inputs breps: list of Brep, objectId: String
# ---------- object_text_py: Python ----------
"""Grasshopper Script"""
a = "Hello Python 3 in Grasshopper!"
print(a)

brepCount = 0
if breps is not None:
    brepCount = len(breps)


if brepCount <= 1:
    textOutput = f"-\n{objectId}"
else:
    textOutput = [f"{i}\n{objectId}" for i in range(1, brepCount + 1)]

print(f"{textOutput=}")
# ---------- end object_text_py ----------

objectid_w_index_text = Text(reverse(object_text_py.textOutput))
textgun_py = Python3Script(
    splint_brep=finishedsplintbrep,
    object_id=objectid_w_index_text,
    text_up_vector=transform,
    wall_thickness_mm=wall_thickness_mm,
    text_size=text_size,
    text_projection_vector=rotate.Geometry,
    extrusion_depth_factor="0.5",
    projection_origin=construct_point,
    x=Toggle(False))  # -> out, embossedBrep, originalTextBreps, final_text_plane, projected_letters; inputs splint_brep: Brep, object_id: String, text_up_vector: Vector3d, text_size: Double, text_projection_vector: Vector3d, extrusion_depth_factor: Double, projection_origin: Point3d
# ---------- textgun_py: Python ----------
# This file represents a stub for a GhPython component in Grasshopper.
# It sets up the environment to import and use the splintcommon or other external modules.

from pathlib import Path
import sys
from importlib import reload #FOR DEV ONLY
import time

# In normal GH doc
ghFileDir = None
try:
    ghFileDir = str(Path.joinpath(Path(ghenv.Component.OnPingDocument().FilePath).resolve().parents[0], "src"))
except:
    # In GH Cluster
    ghFileDir = str(Path.joinpath(Path(ghenv.Component.OnPingDocument().Owner.OnPingDocument().FilePath).resolve().parents[0], "src"))

print(f"{ghFileDir=}")

if ghFileDir not in sys.path:
    print("ghFileDir needed to be included")
    sys.path.append(ghFileDir)

import splintcommon
reload(splintcommon) #FOR DEV

#splintcommon module is now available for use in this GhPython component
splintcommon.log(f'GhPython Node initialized at {time.ctime()}')

import TextGun
reload(TextGun) #FOR DEV
from TextGun import emboss_text

embossedBrep, originalTextBreps, projected_letters, final_text_plane = emboss_text(
    target_brep=splint_brep,
    text_content=object_id,
    wall_thickness_mm=wall_thickness_mm,
    text_size=text_size,
    text_up_vector=text_up_vector,
    text_projection_vector=text_projection_vector,
    extrusion_depth_factor=extrusion_depth_factor,
    projection_origin=projection_origin,
    emboss_inside=True
)
# ---------- end textgun_py ----------
plane = Plane(textgun_py.final_text_plane)
vizplane_3 = VizPlane(plane=plane)  # -> tip_2, line_2, annotation_dot_2
brep = Brep(textgun_py.originalTextBreps)
plane_2 = Plane(textgun_py.final_text_plane)
tip_2 = Brep(vizplane_3.tip_2)
line_12 = Line(vizplane_3.line_2)
annotation_dot_2 = AnnotationDot(vizplane_3.annotation_dot_2)
splint_with_embossed_id = Brep(textgun_py.embossedBrep)
entwine_5 = Entwine(
    Branch00=finishedsplintbrep,
    Branch01=splint_with_embossed_id,
    Branch02=rotate_2.Geometry,
    Branch03=area.Centroid,
    Branch04=construct_point,
    FlattenInputs=True)  # disabled
cluster_4 = Cluster_2(base_move_vector=panel_11, geo_data=entwine_5)  # -> geometry, out; disabled
splint_with_embossed_id_2 = Brep(textgun_py.embossedBrep)
splint_with_embossed_id_3 = Brep(textgun_py.embossedBrep)

# ----
# Comfort Top Lip Trimmers
unit_y_7 = UnitY(Factor=1)
chamfer_side_limit_angle = Slider(-74, range=-90..90)
chamfer_edge_parameter = Slider(0.7, range=0..1)
mid_splint_radius_3 = Number(mid_splint_radius)
splint_brep_2 = Brep(splint_with_embossed_id_3)
box_center_slice_py_5 = Python3Script(target_brep=splint_brep_2, view_vector=unit_y_7)  # -> out, slice_surface; inputs target_brep: Brep, view_vector: Vector3d; same code as box_center_slice_py
multiplication_5 = Multiplication(A=mid_splint_radius_3, B=Slider(1.29, range=0.75..2))
area_2 = Area(Geometry=box_center_slice_py_5.slice_surface)  # -> Area, Centroid
xy_plane_2 = XYPlane(Origin=area_2.Centroid)
unit_z_9 = UnitZ(Factor=multiplication_5)
scale_nu = ScaleNU(Geometry=box_center_slice_py_5.slice_surface, Plane=xy_plane_2, ScaleX=Slider(1, range=0.1..1.1), ScaleY=1, ScaleZ=1)  # -> Geometry, Transform
move_10 = Move(Geometry=scale_nu.Geometry, Motion=unit_z_9)  # -> Geometry, Transform
box_center_slice_py_6 = Python3Script(target_brep=splint_brep_2, slice_surface=move_10.Geometry)  # -> out, result_curves, result_points; inputs target_brep: Brep, slice_surface: Surface; same code as box_center_slice_py_2
splint_center_point = Point(area_2.Centroid)
chamfer_side_limit_angle_2 = Number(chamfer_side_limit_angle)
splint_with_embossed_id_4 = Brep(splint_brep_2)
point_2 = Point(box_center_slice_py_6.result_points)
mid_radius = Number(multiplication_5)
curve = Curve(box_center_slice_py_6.result_curves)
yz_plane_3 = YZPlane(Origin=Point(0, 0, 0))
xy_plane_3 = XYPlane(Origin=Point(0, 0, 0))
unit_y_8 = UnitY(Factor=1)
mid_radius_2 = Number(mid_radius)
negative_3 = Negative(Value=chamfer_side_limit_angle_2)
rotate_3 = Rotate(Geometry=unit_y_8, Angle=degrees(negative_3), Plane=yz_plane_3)  # -> Geometry, Transform
transform_4 = Transform(Geometry=xy_plane_3, Transform=rotate_3.Transform)
rotate_4 = Rotate(Geometry=unit_y_8, Angle=degrees(chamfer_side_limit_angle_2), Plane=yz_plane_3)  # -> Geometry, Transform
transform_5 = Transform(Geometry=xy_plane_3, Transform=rotate_4.Transform)
box_center_slice_py_7 = Python3Script(target_brep=splint_with_embossed_id_4, bbox_plane=transform_5, view_vector=rotate_4.Geometry)  # -> out, slice_surface; inputs target_brep: Brep, bbox_plane: Plane, view_vector: Vector3d
# ---------- box_center_slice_py_7: Python ----------
# This file represents a stub for a GhPython component in Grasshopper.
# It sets up the environment to import and use the splintcommon or other external modules.

from pathlib import Path
import sys
from importlib import reload #FOR DEV
import time

# In normal GH doc
ghFileDir = None
try:
    ghFileDir = str(Path.joinpath(Path(ghenv.Component.OnPingDocument().FilePath).resolve().parents[0], "src"))
except:
    # In GH Cluster
    ghFileDir = str(Path.joinpath(Path(ghenv.Component.OnPingDocument().Owner.OnPingDocument().FilePath).resolve().parents[0], "src"))

print(f"{ghFileDir=}")

if ghFileDir not in sys.path:
    print("ghFileDir needed to be included")
    sys.path.append(ghFileDir)

import splintcommon
reload(splintcommon) #FOR DEV

#splintcommon module is now available for use in this GhPython component
splintcommon.log(f'GhPython Node initialized at {time.ctime()}')

import FeatureIdentification
reload(FeatureIdentification) #FOR DEV
from FeatureIdentification import box_center_slice

import Rhino.Geometry as rg

# Get a slice plane at the center, facing +Y direction
slice_surface = box_center_slice(
    target_brep=target_brep,
    bbox_plane=bbox_plane,
    choose_side_vector=view_vector
)
# ---------- end box_center_slice_py_7 ----------
deconstruct_plane = DeconstructPlane(Plane=transform_4)  # -> Origin, XAxis, YAxis, ZAxis
box_center_slice_py_8 = Python3Script(target_brep=splint_with_embossed_id_4, bbox_plane=transform_4, view_vector=rotate_3.Geometry)  # -> out, slice_surface; inputs target_brep: Brep, bbox_plane: Plane, view_vector: Vector3d; same code as box_center_slice_py_7
deconstruct_plane_2 = DeconstructPlane(Plane=transform_5)  # -> Origin, XAxis, YAxis, ZAxis
tl_point = ListItem(List=point_2, Index="0", Wrap=True)
bl_point = ListItem(List=point_2, Index="3", Wrap=True)
tr_point = ListItem(List=point_2, Index="1", Wrap=True)
br_point = ListItem(List=point_2, Index="2", Wrap=True)
multiplication_6 = Multiplication(A=deconstruct_plane.ZAxis, B=mid_radius_2)
line_13 = Line(StartPoint=tl_point, EndPoint=bl_point)
chamfer_edge_parameter_2 = Number(chamfer_edge_parameter)
line_14 = Line(StartPoint=tr_point, EndPoint=br_point)
multiplication_7 = Multiplication(A=deconstruct_plane_2.ZAxis, B=mid_radius)
move_11 = Move(Geometry=box_center_slice_py_8.slice_surface, Motion=multiplication_6)  # -> Geometry, Transform
move_12 = Move(Geometry=box_center_slice_py_7.slice_surface, Motion=multiplication_7)  # -> Geometry, Transform
reparameterize_curve = ReparameterizeCurve(Curve=line_14)  # -> Reparameterized, Original
reparameterize_curve_2 = ReparameterizeCurve(Curve=line_13)  # -> Reparameterized, Original
splint_center_point_2 = Point(splint_center_point)
box_center_slice_py_9 = Python3Script(target_brep=splint_with_embossed_id_4, slice_surface=move_11.Geometry)  # -> out, result_curves, result_points; inputs target_brep: Brep, slice_surface: Surface; same code as box_center_slice_py_2
box_center_slice_py_10 = Python3Script(target_brep=splint_with_embossed_id_4, slice_surface=move_12.Geometry)  # -> out, result_curves, result_points; inputs target_brep: Brep, slice_surface: Surface; same code as box_center_slice_py_2
evaluate_curve = EvaluateCurve(Curve=reparameterize_curve.Reparameterized, Parameter=chamfer_edge_parameter_2)  # -> Point, Tangent, Angle
evaluate_curve_2 = EvaluateCurve(Curve=reparameterize_curve_2.Reparameterized, Parameter=chamfer_edge_parameter_2)  # -> Point, Tangent, Angle
curve_2 = Curve(box_center_slice_py_10.result_curves)
righ_top_mid_lip = Point(evaluate_curve.Point)
left_top_mid_lip = Point(evaluate_curve_2.Point)
point_3 = Point(box_center_slice_py_10.result_points)
curve_3 = Curve(box_center_slice_py_9.result_curves)
point_4 = Point(box_center_slice_py_9.result_points)
splint_with_embossed_id_5 = Brep(graft(splint_brep_2))
tl_point_2 = ListItem(List=point_3, Index="3", Wrap=True)
left_bottom_mid_lip = Point(left_top_mid_lip)
righ_bottom_mid_lip = Point(righ_top_mid_lip)
tl_point_3 = ListItem(List=point_4, Index="3", Wrap=True)
tr_point_2 = ListItem(List=point_4, Index="2", Wrap=True)
tr_point_3 = ListItem(List=point_3, Index="2", Wrap=True)
conecreator = ConeCreator(list=splint_center_point_2, point_a=tr_point_3, point_b=righ_bottom_mid_lip, point_c=tr_point_2)
conecreator_2 = ConeCreator(list=splint_center_point_2, point_a=tl_point_3, point_b=left_bottom_mid_lip, point_c=tl_point_2)
panel_12 = Panel("-50, 0, 0")  # disabled
solid_difference = SolidDifference(BrepsA=splint_with_embossed_id_5, BrepsB=conecreator)  # -> simplify(Result)
solid_difference_2 = SolidDifference(BrepsA=solid_difference, BrepsB=conecreator_2)
entwine_6 = Entwine(Branch00=solid_difference_2, FlattenInputs=True)  # disabled
cluster_5 = Cluster_2(base_move_vector=panel_12, geo_data=entwine_6)  # -> geometry, out; disabled
comfort_trimmed_splint_brep = Brep(solid_difference_2)

# ----
# Comfort Bottom Lip Trimmers
mid_splint_radius_4 = Number(mid_splint_radius)
unit_y_9 = UnitY(Factor=1)
chamfer_side_limit_angle_3 = Slider(-74, range=-90..90)
chamfer_edge_parameter_3 = Slider(0.7, range=0..1)
splint_brep_3 = Brep(comfort_trimmed_splint_brep)
negative_4 = Negative(Value=mid_splint_radius_4)
box_center_slice_py_11 = Python3Script(target_brep=splint_brep_3, view_vector=unit_y_9)  # -> out, slice_surface; inputs target_brep: Brep, view_vector: Vector3d; same code as box_center_slice_py
multiplication_8 = Multiplication(A=negative_4, B=Slider(1.29, range=0.75..2))
area_3 = Area(Geometry=box_center_slice_py_11.slice_surface)  # -> Area, Centroid
xy_plane_4 = XYPlane(Origin=area_3.Centroid)
unit_z_10 = UnitZ(Factor=multiplication_8)
scale_nu_2 = ScaleNU(Geometry=box_center_slice_py_11.slice_surface, Plane=xy_plane_4, ScaleX=Slider(1, range=0.1..1.1), ScaleY=1, ScaleZ=1)  # -> Geometry, Transform
move_13 = Move(Geometry=scale_nu_2.Geometry, Motion=unit_z_10)  # -> Geometry, Transform
box_center_slice_py_12 = Python3Script(target_brep=splint_brep_3, slice_surface=move_13.Geometry)  # -> out, result_curves, result_points; inputs target_brep: Brep, slice_surface: Surface; same code as box_center_slice_py_2
splint_center_point_3 = Point(area_3.Centroid)
mid_radius_3 = Number(multiplication_8)
chamfer_side_limit_angle_4 = Number(chamfer_side_limit_angle_3)
splint_with_embossed_id_6 = Brep(splint_brep_3)
point_5 = Point(box_center_slice_py_12.result_points)
curve_4 = Curve(box_center_slice_py_12.result_curves)
yz_plane_4 = YZPlane(Origin=Point(0, 0, 0))
xy_plane_5 = XYPlane(Origin=Point(0, 0, 0))
unit_y_10 = UnitY(Factor=1)
mid_radius_4 = Number(mid_radius_3)
negative_5 = Negative(Value=chamfer_side_limit_angle_4)
rotate_5 = Rotate(Geometry=unit_y_10, Angle=degrees(negative_5), Plane=yz_plane_4)  # -> Geometry, Transform
transform_6 = Transform(Geometry=xy_plane_5, Transform=rotate_5.Transform)
rotate_6 = Rotate(Geometry=unit_y_10, Angle=degrees(chamfer_side_limit_angle_4), Plane=yz_plane_4)  # -> Geometry, Transform
transform_7 = Transform(Geometry=xy_plane_5, Transform=rotate_6.Transform)
box_center_slice_py_13 = Python3Script(target_brep=splint_with_embossed_id_6, bbox_plane=transform_7, view_vector=rotate_6.Geometry)  # -> out, slice_surface; inputs target_brep: Brep, bbox_plane: Plane, view_vector: Vector3d; same code as box_center_slice_py_7
deconstruct_plane_3 = DeconstructPlane(Plane=transform_6)  # -> Origin, XAxis, YAxis, ZAxis
box_center_slice_py_14 = Python3Script(target_brep=splint_with_embossed_id_6, bbox_plane=transform_6, view_vector=rotate_5.Geometry)  # -> out, slice_surface; inputs target_brep: Brep, bbox_plane: Plane, view_vector: Vector3d; same code as box_center_slice_py_7
deconstruct_plane_4 = DeconstructPlane(Plane=transform_7)  # -> Origin, XAxis, YAxis, ZAxis
tl_point_4 = ListItem(List=point_5, Index="0", Wrap=True)
bl_point_2 = ListItem(List=point_5, Index="3", Wrap=True)
tr_point_4 = ListItem(List=point_5, Index="1", Wrap=True)
br_point_2 = ListItem(List=point_5, Index="2", Wrap=True)
line_15 = Line(StartPoint=tl_point_4, EndPoint=bl_point_2)  # -> simplify(Line)
multiplication_9 = Multiplication(A=deconstruct_plane_3.ZAxis, B=mid_radius_4)
line_16 = Line(StartPoint=tr_point_4, EndPoint=br_point_2)  # -> simplify(Line)
chamfer_edge_parameter_4 = Number(chamfer_edge_parameter_3)
multiplication_10 = Multiplication(A=deconstruct_plane_4.ZAxis, B=mid_radius_3)
number_slider_3 = Slider(0, range=0..5)  # disabled
move_14 = Move(Geometry=box_center_slice_py_14.slice_surface, Motion=multiplication_9)  # -> Geometry, Transform
move_15 = Move(Geometry=box_center_slice_py_13.slice_surface, Motion=multiplication_10)  # -> Geometry, Transform
reparameterize_curve_3 = ReparameterizeCurve(Curve=line_16)  # -> Reparameterized, Original
reparameterize_curve_4 = ReparameterizeCurve(Curve=line_15)  # -> Reparameterized, Original
panel_13 = Panel("2")  # disabled
panel_14 = Panel("2")  # disabled
box_center_slice_py_15 = Python3Script(target_brep=splint_with_embossed_id_6, slice_surface=move_14.Geometry)  # -> out, result_curves, result_points; inputs target_brep: Brep, slice_surface: Surface; same code as box_center_slice_py_2
box_center_slice_py_16 = Python3Script(target_brep=splint_with_embossed_id_6, slice_surface=move_15.Geometry)  # -> out, result_curves, result_points; inputs target_brep: Brep, slice_surface: Surface; same code as box_center_slice_py_2
evaluate_curve_3 = EvaluateCurve(Curve=reparameterize_curve_3.Reparameterized, Parameter=chamfer_edge_parameter_4)  # -> Point, Tangent, Angle
evaluate_curve_4 = EvaluateCurve(Curve=reparameterize_curve_4.Reparameterized, Parameter=chamfer_edge_parameter_4)  # -> Point, Tangent, Angle
panel_15 = Panel("{0}")  # disabled
construct_path = ConstructPath(Indices=number_slider_3)  # disabled
trim_rectangles = Rectangle([move_15.Geometry, move_14.Geometry])
righ_top_mid_lip_2 = Point(flatten(evaluate_curve_3.Point))
righ_bottom_mid_lip_2 = Point(simplify(graft(righ_top_mid_lip_2)))  # disabled
point_6 = Point(simplify(box_center_slice_py_16.result_points))
tr_point_5 = ListItem(List=point_6, Index=panel_13, Wrap=True)  # disabled
left_top_mid_lip_2 = Point(flatten(evaluate_curve_4.Point))
point_7 = Point(simplify(box_center_slice_py_15.result_points))
tr_point_6 = ListItem(List=point_7, Index=panel_14, Wrap=True)  # disabled
curve_5 = Curve(box_center_slice_py_16.result_curves)
curve_6 = Curve(box_center_slice_py_15.result_curves)
tree_branch = TreeBranch(Tree=trim_rectangles, Path=construct_path, MaintainPaths=True)  # disabled
tree_branch_2 = TreeBranch(Tree=tr_point_5, Path=construct_path, MaintainPaths=True)  # disabled
tree_branch_3 = TreeBranch(Tree=righ_bottom_mid_lip_2, Path=construct_path, MaintainPaths=True)  # disabled
tree_branch_4 = TreeBranch(Tree=tr_point_6, Path=construct_path, MaintainPaths=True)  # disabled
left_bottom_mid_lip_2 = Point(simplify(graft(left_top_mid_lip_2)))
righ_bottom_mid_lip_3 = Point(simplify(graft(righ_top_mid_lip_2)))
panel_16 = Panel(tr_point_6)  # disabled
outerbarreltrimmer_cl = OuterBarrelTrimmer_CL(trim_rectangles=tree_branch, point_a=tree_branch_2, point_b=tree_branch_3, point_c=tree_branch_4)  # -> graft(trimmer_brep_2), graft(trim_surface_2); disabled
tr_point_7 = ListItem(List=point_6, Index="2", Wrap=True)  # -> simplify(graft(Item))
tr_point_8 = ListItem(List=point_7, Index="2", Wrap=True)  # -> simplify(graft(Item))
tl_point_5 = ListItem(List=point_7, Index="3", Wrap=True)  # -> simplify(graft(Item))
tl_point_6 = ListItem(List=point_6, Index="3", Wrap=True)  # -> simplify(graft(Item))
splint_brep_4 = Brep(splint_brep_3)
splint_brep_5 = Brep(splint_brep_4)  # disabled
tree_branch_5 = TreeBranch(Tree=splint_brep_5, Path=construct_path, MaintainPaths=True)  # -> graft(Branch); disabled
outerbarreltrimmer_cl_2 = OuterBarrelTrimmer_CL(trim_rectangles=trim_rectangles, point_a=tr_point_7, point_b=righ_bottom_mid_lip_3, point_c=tr_point_8)  # -> simplify(graft(trimmer_brep_2)), trim_surface_2
outerbarreltrimmer_cl_3 = OuterBarrelTrimmer_CL(trim_rectangles=trim_rectangles, point_a=tl_point_5, point_b=left_bottom_mid_lip_2, point_c=tl_point_6)  # -> simplify(graft(trimmer_brep_2)), trim_surface_2
entwine_7 = Entwine(Branch00=tree_branch_5, FlattenInputs=True)  # disabled
panel_17 = Panel("-50, 0, 0")  # disabled
cluster_6 = Cluster_2(base_move_vector=panel_17, geo_data=entwine_7)  # -> geometry, out; disabled
solid_difference_3 = SolidDifference(BrepsA=splint_brep_4, BrepsB=outerbarreltrimmer_cl_2.trimmer_brep_2)
entwine_8 = Entwine(Branch00=solid_difference_3, Branch01=outerbarreltrimmer_cl_3.trimmer_brep_2, FlattenInputs=True)  # disabled
solid_difference_4 = SolidDifference(BrepsA=solid_difference_3, BrepsB=outerbarreltrimmer_cl_3.trimmer_brep_2)
panel_18 = Panel(solid_difference_4)
cluster_7 = Cluster_2(base_move_vector="-50, 0, 0", geo_data=entwine_8)  # -> geometry, out; disabled
comfort_trimmed_splint_brep_2 = Brep(flatten(solid_difference_4))
panel_19 = Panel(comfort_trimmed_splint_brep_2)

# ----
# Direction Indicator
splint_body = Brep(comfort_trimmed_splint_brep_2)
wall_thickness_2 = Number(wall_thickness)
mid_splint_radius_5 = Number(mid_splint_radius)
unit_y_11 = UnitY(Factor=1)
box_center_slice_py_17 = Python3Script(target_brep=splint_body, view_vector=unit_y_11)  # -> out, slice_surface; inputs target_brep: Brep, view_vector: Vector3d; same code as box_center_slice_py
ball_r_to_wall_ratio = Slider(0.68, range=0.6..1)
box_center_slice_py_18 = Python3Script(target_brep=splint_body, slice_surface=box_center_slice_py_17.slice_surface)  # -> out, result_curves, result_points; inputs target_brep: Brep, slice_surface: Surface; same code as box_center_slice_py_2
multiplication_11 = Multiplication(A=wall_thickness_2, B=ball_r_to_wall_ratio)
list_item_7 = ListItem(List=box_center_slice_py_18.result_points, Index="2", Wrap=False)  # -> flatten(Item)
xy_plane_6 = XYPlane(Origin=list_item_7)
scale_nu_3 = ScaleNU(Geometry=box_center_slice_py_17.slice_surface, Plane=xy_plane_6, ScaleX="0.75", ScaleY=1, ScaleZ="0.75")  # -> Geometry, Transform
nub_radius = Panel(multiplication_11)
xy_plane_7 = XYPlane(Origin=Point(0, 0, 0))
ball_r_to_wall_ratio_2 = Slider(0.67, range=0.6..1)
sphere = Sphere(Base=xy_plane_7, Radius=nub_radius)
multiplication_12 = Multiplication(A=wall_thickness_2, B=ball_r_to_wall_ratio_2, C="-1")
unit_z_11 = UnitZ(Factor=multiplication_12)
panel_20 = Panel("-50, 0, 0")  # disabled

panel_21 = Panel(box_center_slice_py_18.result_points)
panel_22 = Panel(list_item_7)
multiplication_13 = Multiplication(A=mid_splint_radius_5, B="0.55")
negative_6 = Negative(Value=multiplication_13)
vector_xyz = VectorXYZ(XComponent=multiplication_13, YComponent=0, ZComponent=negative_6)  # -> Vector, Length

panel_23 = Panel(vector_xyz.Vector)
move_16 = Move(Geometry=scale_nu_3.Geometry, Motion=panel_23)  # -> Geometry, Transform
box_center_slice_py_19 = Python3Script(target_brep=splint_body, slice_surface=move_16.Geometry)  # -> out, result_curves, result_points; inputs target_brep: Brep, slice_surface: Surface; same code as box_center_slice_py_2

join_curves_3 = JoinCurves(Curves=box_center_slice_py_19.result_curves, Preserve=False)  # -> flatten(Curves)

area_4 = Area(Geometry=join_curves_3)  # -> Area, Centroid
move_17 = Move(Geometry=area_4.Centroid, Motion=unit_z_11)  # -> Geometry, Transform
move_to_point = MoveToPoint(Geometry=sphere, PointA=xy_plane_7, PointB=move_17.Geometry)  # -> Moved, Vector, Transform
solid_difference_5 = SolidDifference(BrepsA=splint_body, BrepsB=move_to_point.Moved)
entwine_9 = Entwine(Branch00=solid_difference_5, FlattenInputs=True)  # disabled
cluster_8 = Cluster_2(base_move_vector=panel_20, geo_data=entwine_9)  # -> geometry, out; disabled
splint_w_direction = Brep(solid_difference_5)

panel_24 = Panel(join_curves_3)

# ----
# Orienting To Build Plate
# Tip Slant Line, describes the angle necessary to bring the front cut line of the splint down to the build platform.
tip_slant_line_3 = Line(tip_slant_line_2)
finishedsplint = Brep(splint_w_direction)
unit_x_4 = UnitX(Factor=1)
xz_plane_3 = XZPlane(Origin=Point(0, 0, 0))
end_points_7 = EndPoints(Curve=tip_slant_line_3)  # -> Start, End
angle_2 = Angle(VectorA=tip_slant_line_3, VectorB=unit_x_4, Plane=xz_plane_3)  # -> Angle, Reflex
point_8 = Point(end_points_7.End)
point_9 = Point(end_points_7.Start)
negative_7 = Negative(Value=angle_2.Angle)
plane_origin = PlaneOrigin(Base=xz_plane_3, Origin=point_8)
rotate_7 = Rotate(Geometry=finishedsplint, Angle=angle_2.Angle, Plane=plane_origin)  # -> Geometry, Transform
entwine_10 = Entwine(Branch00=rotate_7.Geometry, FlattenInputs=True)  # disabled
transform_8 = Transform(Geometry=tip_slant_line_3, Transform=rotate_7.Transform)
panel_25 = Panel("-50, 0, 0")  # disabled
cluster_9 = Cluster_2(base_move_vector=panel_25, geo_data=entwine_10)  # -> geometry, out; disabled
curve_middle_3 = CurveMiddle(Curve=transform_8)
deconstruct_3 = Deconstruct(Point=curve_middle_3)  # -> XComponent, YComponent, ZComponent
negative_8 = Negative(Value=deconstruct_3.ZComponent)
unit_z_12 = UnitZ(Factor=negative_8)
move_18 = Move(Geometry=rotate_7.Geometry, Motion=unit_z_12)  # -> Geometry, Transform
move_19 = Move(Geometry=curve_middle_3, Motion=move_18.Transform)  # -> Geometry, Transform
# Radial Arrangement
oriented_flat_splint = Brep(move_18.Geometry)
floor_centroid = Point(move_19.Geometry)
list_length = ListLength(List=oriented_flat_splint)
xy_plane_8 = XYPlane(Origin=Point(0, 0, 0))
multiplication_14 = Multiplication(A=list_length, B="9")
circle = Circle(Plane=xy_plane_8, Radius=multiplication_14)
divide_curve = DivideCurve(Curve=circle, Count=list_length, Kinks=False)  # -> Points, Tangents, Parameters
move_to_point_2 = MoveToPoint(Geometry=oriented_flat_splint, PointA=floor_centroid, PointB=divide_curve.Points)  # -> Moved, Vector, Transform
radial_orientation_splint = Brep(move_to_point_2.Moved)
flatorientedsplint = Brep(oriented_flat_splint)

radial_floor_centroid = Point(divide_curve.Points)

# ----
# Final Meshing
# And Smoothing
# Bake Me
number_slider_4 = Slider(0.12, range=0.05..0.2)
orientedsplint = Brep(radial_orientation_splint)
shrinkwrap = ShrinkWrap(
    Geometry=orientedsplint,
    EdgeLength=number_slider_4,
    Offset=0,
    Smoothing=Slider(8, range=0..10),
    Optimization=10,
    FillHoles=True)
splint_smooth_mesh = Mesh(shrinkwrap)

# ----
# Preview Steps
inner_finger_form = Brep(inner_shell_brep_3)
preform_barrel = Brep(finger_model_rotate.Geometry)
side_cutter_surface_2 = Surface(side_cutter_surface)
side_cutter_volume_3 = Brep(side_cutter_volume_2)
comfort_trimmed_splint_brep_3 = Brep(comfort_trimmed_splint_brep_2)
splint_w_direction_2 = Brep(splint_w_direction)
splint_body_oriented = Mesh(flatorientedsplint)
splint_body_smooth = Mesh(splint_smooth_mesh)
entwine_11 = Entwine(Branch00=preform_barrel, Branch01=side_cutter_surface_2, FlattenInputs=True)
entwine_12 = Entwine(Branch00=preform_barrel, Branch01=side_cutter_volume_3, FlattenInputs=True)
movecomplex_cl = MoveComplexCL(base_move_vector="60, 0, 0", geo_data=inner_finger_form)
movecomplex_cl_2 = MoveComplexCL(base_move_vector="180, 0, 0", geo_data=entwine_12)
movecomplex_cl_3 = MoveComplexCL(base_move_vector="240, 0, 0", geo_data=comfort_trimmed_splint_brep_3)
movecomplex_cl_4 = MoveComplexCL(base_move_vector="300, 0, 0", geo_data=splint_w_direction_2)
movecomplex_cl_5 = MoveComplexCL(base_move_vector="120, 0, 0", geo_data=entwine_11)
movecomplex_cl_6 = MoveComplexCL(base_move_vector="360, 0, 0", geo_data=splint_body_oriented)
movecomplex_cl_7 = MoveComplexCL(base_move_vector="500, 0, 0", geo_data=splint_body_smooth)
merge_3 = Merge(
    Data1=movecomplex_cl,
    Data2=movecomplex_cl_5,
    Data3=movecomplex_cl_2,
    Data4=movecomplex_cl_3,
    Data5=movecomplex_cl_4,
    Data6=movecomplex_cl_6,
    Data7=movecomplex_cl_7)  # -> flatten(Result)
random_color = RandomColor(Data=merge_3, Seed=2, FastMode=False)
custom_preview = CustomPreview(Geometry=merge_3, Material=random_color)

list_item_8 = ListItem(List=preform_barrel, Index=number_slider_2, Wrap=False)
list_item_9 = ListItem(List=side_cutter_surface_2, Index=number_slider_2, Wrap=False)
splint_mesh = Mesh(splint_smooth_mesh)
savemeshpy = Python3Script(geo_input=splint_mesh, output_file_dir=output_dir_out, jobname=root_filename_out, bool_activate=dev_activate_toggle)  # -> out; inputs geo_input: Mesh; disabled
# ---------- savemeshpy: Python ----------
# See: https://discourse.mcneel.com/t/how-to-optimise-ghpython-obj-export/87598/76

# This code is intended to be run inside a Grasshopper Python component
# It exports a given mesh to an OBJ or STL file using Rhino's export functionality
# Node inputs:
#   geo_input: The input mesh to be exported (Rhino.Geometry.Mesh)
#   output_file_dir: The directory where the exported file will be saved (string)
#   jobname: The base name for the exported file (string)

# Start standard gh python imports
from pathlib import Path
import sys
from importlib import reload #FOR DEV ONLY

ghFileDir = str(Path.joinpath(Path(ghenv.Component.OnPingDocument().FilePath).resolve().parents[0], "src"))
if ghFileDir not in sys.path:
    print("ghFileDir needed to be included")
    sys.path.append(ghFileDir)
import splintcommon
reload(splintcommon)
# End standard gh python imports

import time
splintcommon.log(f'Save Mesh Running at: ({time.strftime("%H:%M:%S", time.localtime())})')

import scriptcontext as sc
# import rhinoscriptsyntax as rs
import System
import Rhino
import random
import string
import os
import traceback

def add_layer(layer_name=None, layer_color=None):
    """Adds a new layer to the active Rhino document.
    
    Args:
      layer_name (str): An optional layer name.
      layer_color (System.Drawing.Color): An optional layer color.
    Returns:
      The index of the new layer.
    """
    sc.doc = Rhino.RhinoDoc.ActiveDoc
    if layer_name != None:
        # Check whether the layer name is valid
        if not Rhino.DocObjects.Layer.IsValidName(layer_name):
            raise ValueError("{} is not a valid layer name."\
                .format(layer_name))
        # Check whether a layer with the same name already exists
        layer_index = sc.doc.Layers.Find(layer_name, True)
        if layer_index >= 0:
            raise ValueError("A layer with the name {} already exists."\
                .format(layer_name))
    else:
        layer_name = sc.doc.Layers.GetUnusedLayerName(False)
    
    # Check whether the layer color is valid
    if layer_color != None:
        if not isinstance(layer_color, System.Drawing.Color):
            raise ValueError("{} is not a valid layer color."\
                .format(layer_color))
    else:
        layer_color = System.Drawing.Color.Black # default layer color
    
    # Add a new layer to the active document
    layer_index = sc.doc.Layers.Add(layer_name, layer_color)
    if layer_index < 0:
        raise ValueError("Unable to add layer {} to document."\
            .format(layer_name))
    return layer_index
    

def delete_layer(layer):
    """Deletes an existing layer from the active Rhino document. 
    The layer to be removed cannot be the current layer and 
    it will be deleted even if it contains objects.
    
    Args:
      layer (str\id): A name or id of an existing layer.
    Returns:
      True or False, indicating success or failure.
    """
    sc.doc = Rhino.RhinoDoc.ActiveDoc
    layer_index = sc.doc.Layers.Find(layer, True)
    if layer_index < 0:
        raise ValueError("The layer {} does not exist.".format(layer))
    rc = sc.doc.Layers.Purge(layer_index, True)
    sc.doc.Views.Redraw()
    return rc
    

def bake_mesh(layer, mesh, mesh_name=None):
    """Bakes a mesh object to the active Rhino document.
    
    Args:
      layer (str\id): The name or id of an existing layer.
      mesh (Rhino.Geometry.Mesh): A mesh object to bake.
      mesh_name (str): An optional mesh object name.
    Returns:
      The GUID of the baked mesh.
    """

    splintcommon.log(f"mesh type:{type(mesh)}")
    # mesh = rs.coercemesh(mesh)
    # splintcommon.log(f"mesh type:{type(mesh)}")

    sc.doc = Rhino.RhinoDoc.ActiveDoc
    # Check whether the mesh is a mesh object
    if mesh.ObjectType != Rhino.DocObjects.ObjectType.Mesh:
        raise ValueError("{} is not a mesh.".format(mesh))
    # Create the mesh object attributes
    attr = Rhino.DocObjects.ObjectAttributes()
    # Set the mesh object layer index attribute
    layer_index = sc.doc.Layers.Find(layer, True)
    if layer_index < 0:
        if layer == "Default":
            raise ValueError("The layer {} can't be baked to.".format(layer))
        else:
            raise ValueError("The layer {} does not exist.".format(layer))    
    else:
        attr.LayerIndex = layer_index
    # Set the mesh object name attribute
    if mesh_name != None:
        attr.Name = mesh_name
    # Bake the mesh to the active Rhino documemnt
    mesh_id = sc.doc.Objects.AddMesh(mesh, attr)
    return mesh_id

def get_obj_settings():
    splintcommon.log("Using OBJ mesh settings")
    """Returns the settings for the OBJ export command as a string."""
    # Formatting options
    cfg = "_Geometry=_Mesh "
    cfg += "_EndOfLine=CRLF "
    cfg += "_ExportRhinoObjectNames=_ExportObjectsAsOBJGroups "
    cfg += "_ExportMeshTextureCoordinates=_Yes "
    cfg += "_ExportMeshVertexNormals=_Yes "
    cfg += "_ExportMeshVertexColors=_Yes "
    cfg += "_CreateNGons=_No "
    cfg += "_ExportMaterialDefinitions=_No "
    cfg += "_YUp=_Yes "
    cfg += "_WrapLongLines=_No "
    cfg += "_VertexWelding=_Unmodified "
    cfg += "_WritePrecision=4 "
    cfg += "_Enter "
    # Detailed options
    cfg += "_DetailedOptions "
    cfg += "_JaggedSeams=_No "
    cfg += "_PackTextures=_No "
    cfg += "_Refine=_No "
    cfg += "_SimplePlane=_No "
    # Advanced options
    cfg += "_AdvancedOptions "
    cfg += "_Angle=0 "
    cfg += "_AspectRatio=0 "
    cfg += "_Distance=0.0 "
    cfg += "_Density=0.5 "
    cfg += "_Grid=0 "
    cfg += "_MaxEdgeLength=0 "
    cfg += "_MinEdgeLength=0.0001 "
    cfg += "_Enter _Enter" # remove the last _Enter to check if density is set
    return cfg, "obj"

def get_stl_settings_default():
    #[ANGLE,ASPECT RATIO,MAX DIST TO SRF,GRID,DENSITY,MAX EDGE LEN,MIN EDGE LEN]
    #Change list below as needed
    setting_list=[15,0,0.01,16,0,0,0.001]   
    return get_stl_settings(*setting_list)

def get_stl_settings(ang,ar,dist,grid,den,maxL=0,minL=.0001):
    splintcommon.log("Using STL mesh settings")
    e_str = "_ExportFileAs=_Binary "
    e_str+= "_ExportUnfinishedObjects=_Yes "
    e_str+= "_UseSimpleDialog=_No "
    e_str+= "_Enter _DetailedOptions "
    e_str+= "_JaggedSeams=_No "
    e_str+= "_PackTextures=_No "
    e_str+= "_Refine=_Yes "
    e_str+= "_SimplePlane=_Yes "
    # e_str+= "_AdvancedOptions "
    # e_str+= "_Angle={} ".format(ang)
    # e_str+= "_AspectRatio={} ".format(ar)
    # e_str+= "_Distance={} ".format(dist)
    # e_str+= "_Density={} ".format(den)
    # e_str+= "_Grid={} ".format(grid)
    # e_str+= "_MaxEdgeLength={} ".format(maxL)
    # e_str+= "_MinEdgeLength={} ".format(minL)
    e_str+= "_Enter _Enter"
    return e_str, "stl"

def export_mesh_files(meshes, path, filename, debug=False, asObj=True):
    """Exports a collection of meshes to an OBJ file.
    
    Args:
      meshes (list): A list of Rhino.Geometry.Mesh objects.
      path (str): An absolute path pointing to a directory.
      filename (str): A filename (without extension).
      debug (bool): Optional True to print debug information.
    Returns:
      True or False, indicating success or failure.
    """

    sc.doc = Rhino.RhinoDoc.ActiveDoc
    sc.doc.Views.RedrawEnabled = True # JG - False
    if debug: 
        now = time.process_time()
        elapsed = 0.0
        
    # Create a temporary layer
    splintcommon.log(f"export_mesh_files: Creating temp layer")
    layer = "".join(random.choice(string.ascii_uppercase) for _ in range(9))
    layer_index = add_layer(layer)
    if debug: 
        then, now = now, time.process_time()
        elapsed += now - then
        splintcommon.log("Creating temporary layer: {0:.4f} seconds".format(now-then))
        
    # Bake the temporary mesh(es)
    splintcommon.log(f"export_mesh_files: Baking temp mesh(es)")
    mesh_ids = [bake_mesh(layer, mesh) for mesh in meshes]
    if debug: 
        then, now = now, time.process_time()
        elapsed += now - then
        splintcommon.log("Creating temporary mesh(es): {0:.4f} seconds".format(now-then))
    
    # Unselect all objects in the scene
    sc.doc.Objects.UnselectAll()
    # Select the baked mesh object(s)
    for mid in mesh_ids:
        sc.doc.Objects.Select(mid)
    if debug: 
        then, now = now, time.process_time()
        elapsed += now - then
        splintcommon.log("Unselecting and selecting: {0:.4f} seconds".format(now-then))
    
    # Export the selected mesh object(s) to mesh file
    splintcommon.log(f"export_mesh_files: exporting to file")
    export_config, export_extension = get_obj_settings() if asObj else get_stl_settings_default()
    export_fname = "{}.{}".format(filename, export_extension)
    export_fpath = Path(os.path.join(path, export_fname))
    splintcommon.log(f"export_mesh_files: Export Values: {export_fname=} {export_fpath=}")
    
    if export_fpath.exists():
        splintcommon.log(f"export_mesh_files: REMOVING EXISTING MESH FILE: {export_fpath}")
        export_fpath.unlink()
        time.sleep(1.0)
        splintcommon.log(f"export_mesh_files: testing... MeshStillExists:{export_fpath.exists()}")

    splintcommon.log(f"export_mesh_files: exporting to file")

    cmd = '_-Export _Pause "{}" {} _Enter'.format(export_fpath, export_config) # _Enter
    # see: https://discourse.mcneel.com/t/export-command-line-options/87537/5
    splintcommon.log(f"export_mesh_files: RUNNING cmd: '{cmd}'")
    
    #start = Rhino.DocObjects.RhinoObject.NextRuntimeSerialNumber
    rc = Rhino.RhinoApp.RunScript(cmd, True)

    splintcommon.log(f"export_mesh_files: Completion {rc=}")

    #end = Rhino.DocObjects.RhinoObject.NextRuntimeSerialNumber
    #global __command_serial_numbers
    #__command_serial_numbers = None
    #if start != end:
        #__command_serial_numbers = (start, end)
    
    if debug: 
        then, now = now, time.process_time()
        elapsed += now - then
        splintcommon.log("Exporting Mesh Result: {0:.4f} seconds result={1}".format(now-then, rc))
    
    # Delete the temporary layer and meshes
    splintcommon.log(f"export_mesh_files: cleaning up temp layer")
    delete_layer(layer)
    
    if debug: 
        then, now = now, time.process_time()
        elapsed += now - then
        splintcommon.log("Cleaning up: {0:.4f} seconds\n".format(now-then))
        splintcommon.log("Total elapsed: {0:.4f} seconds".format(elapsed))

    sc.doc.Views.RedrawEnabled = True

    splintcommon.log(f"export_mesh_files: Returning result: {rc=}")

    return rc

def saveMeshToFile(inputMesh, directory, rootFilename):
    try:
        splintcommon.log(f"inputMesh type: {inputMesh}")
        splintcommon.log(f"{directory=}")
        splintcommon.log(f"{rootFilename=}")
        
        if inputMesh is None or directory is None or rootFilename is None:        
            raise ValueError("Missing required inputs for saving file")

        #TODO, Validate the path more completely
        if "." in directory or "." in rootFilename:
            raise ValueError(f"Path must not contain dot character: {directory}")

        result = export_mesh_files([inputMesh], directory, rootFilename, True, False)

        if not result:
            raise ValueError(f"FAIL: mesh export failed. {result=}")
        else:
            splintcommon.log(f'SUCCESS: Saved to {rootFilename} in {directory}')
            splintcommon.confirm_job_is_processed_and_exit(jobname, True, "mesh exported normally")

    except Exception as e:
        errMsg = f"Exception: {traceback.format_exc()}"
        splintcommon.log(errMsg)
        splintcommon.confirm_job_is_processed_and_exit(jobname, False, errMsg)

if geo_input is None:
    message = f"No mesh input To Process {geo_input=}"
    splintcommon.log(message)
    splintcommon.confirm_job_is_processed_and_exit(jobname, False, message)
else:
    saveMeshToFile(geo_input, output_file_dir, jobname)
# ---------- end savemeshpy ----------
savemeshpy_2 = Python3Script(geo_input=splint_mesh, output_dir=output_dir_out, root_filename=root_filename_out, bool_activate=dev_activate_toggle)  # -> out; inputs geo_input: Mesh
# ---------- savemeshpy_2: Python ----------
# This file represents a stub for a GhPython component in Grasshopper.
# It sets up the environment to import and use the splintcommon or other external modules.

from pathlib import Path
import sys
from importlib import reload #FOR DEV
import time

# Walk up through nested clusters to find the root GH document (necessary for use in nested clusters)
doc = ghenv.Component.OnPingDocument()
while not doc.FilePath and doc.Owner:
    doc = doc.Owner.OnPingDocument()
ghFileDir = str(Path(doc.FilePath).resolve().parent / "src")

print(f"{ghFileDir=}")

if ghFileDir not in sys.path:
    print("ghFileDir needed to be included")
    sys.path.append(ghFileDir)

import splintcommon
reload(splintcommon) #FOR DEV
from splintcommon import log

#splintcommon module is now available for use in this GhPython component
splintcommon.log(f'GhPython Node initialized at {time.ctime()}')

#Your code here

import splintmeshes
reload(splintmeshes)

# With error handling
try:
    log(f"Logging to {output_dir=} {root_filename=}")
    splintmeshes.save_mesh(geo_input, output_dir, root_filename, format_type="stl")
    log("Export succeeded")
except splintmeshes.MeshExportError as e:
    log("Export failed: {}".format(e))
except ValueError as e:
    log("Bad input: {}".format(e))
# ---------- end savemeshpy_2 ----------
panel_26 = Panel(savemeshpy_2)

# ==== cluster ExtLnPts
extensiondist = ClusterInput()
midpoint = ClusterInput()
startpoint = ClusterInput()
midpoint_2 = Point(midpoint)
startpoint_2 = Point(startpoint)
extensiondist_2 = Number(extensiondist)
line = Line(StartPoint=startpoint_2, EndPoint=midpoint_2)
extend_curve = ExtendCurve(Curve=line, Type=0, Start="0", End=extensiondist_2)
end_points = EndPoints(Curve=extend_curve)  # -> Start, End
endpoint = Point(end_points.End)
endpoint_2 = ClusterOutput(endpoint)

# ==== cluster VizVector
arrowlen = ClusterInput()
text = ClusterInput()
arrowlen_2 = Number(arrowlen)
text_2 = Text(text)
start = ClusterInput()
direction = ClusterInput()
division = Division(A=arrowlen_2, B="4")
line_sdl = LineSDL(Start=start, Direction=direction, Length=arrowlen_2)
end_points = EndPoints(Curve=line_sdl)  # -> Start, End
line = ClusterOutput(line_sdl)
plane_normal = PlaneNormal(Origin=end_points.End, ZAxis=line_sdl)
annotation_dot = AnnotationDot(Location=end_points.End, PrimaryText=text_2)  # -> AnnotationDot, Location, PrimaryText, TextHeight
cone = Cone(Base=plane_normal, Radius=division, Length=division)  # -> Cone, Tip
cone_2 = ClusterOutput(cone.Cone)
annotation_dot_2 = ClusterOutput(annotation_dot.AnnotationDot)

# ==== cluster VizPlane
plane = ClusterInput()
deconstruct_plane = DeconstructPlane(Plane=plane)  # -> Origin, XAxis, YAxis, ZAxis
arrow = VizVector(start=deconstruct_plane.Origin, direction=deconstruct_plane.XAxis, arrowlen="3", text="X")  # -> cone_2, line, annotation_dot_2
arrow_2 = VizVector(start=deconstruct_plane.Origin, direction=deconstruct_plane.YAxis, arrowlen="3", text="Y")  # -> cone_2, line, annotation_dot_2
arrow_3 = VizVector(start=deconstruct_plane.Origin, direction=deconstruct_plane.ZAxis, arrowlen="3", text="Z")  # -> cone_2, line, annotation_dot_2
tip = Brep([arrow.cone_2, arrow_2.cone_2, arrow_3.cone_2])
line = Line([arrow.line, arrow_2.line, arrow_3.line])
annotation_dot = AnnotationDot([arrow.annotation_dot_2, arrow_2.annotation_dot_2, arrow_3.annotation_dot_2])
tip_2 = ClusterOutput(tip)
line_2 = ClusterOutput(line)
annotation_dot_2 = ClusterOutput(annotation_dot)

# ==== cluster OuterBarrelTrimmer_CL
trim_rectangles = ClusterInput()
point_b = ClusterInput()
point_a = ClusterInput()
point_c = ClusterInput()
point_a_2 = Point(flatten(point_a))
point_b_2 = Point(flatten(point_b))
point_c_2 = Point(flatten(point_c))
trim_rectangles_2 = Rectangle(trim_rectangles)
circle_3pt = Circle3Pt(PointA=point_a_2, PointB=point_b_2, PointC=point_c_2)  # -> Circle, Plane, Radius
offset_curve = OffsetCurve(Curve=circle_3pt.Circle, Distance="10", Corners=1)  # -> flatten(Curve)
entwine = Entwine(Branch00=offset_curve, Branch01=circle_3pt.Circle, FlattenInputs=True)
transpose_py = Python3Script(data=entwine)  # -> out, result; inputs data: tree of GeometryBase; same code as transpose_py
boundary_surfaces = BoundarySurfaces(Edges=transpose_py.result)  # -> flatten(Surfaces)
area = Area(Geometry=trim_rectangles_2)  # -> Area, Centroid
input_surface_brep = Brep(graft(boundary_surfaces))
trim_face_plane = Plane(circle_3pt.Plane)
scale = Scale(Geometry=trim_rectangles_2, Center=area.Centroid, Factor="5")  # -> simplify(Geometry), Transform
list_length = ListLength(List=input_surface_brep)
input_surface_brep_2 = Brep(input_surface_brep)  # disabled
unit_z = UnitZ(Factor="-1")
deconstruct_plane = DeconstructPlane(Plane=trim_face_plane)  # -> Origin, XAxis, YAxis, ZAxis
repeat_data = RepeatData(Data=unit_z, Length=list_length)  # -> graft(Data)
entwine_2 = Entwine(Branch00=input_surface_brep_2, FlattenInputs=True)  # disabled
negative = Negative(Value=deconstruct_plane.ZAxis)
trim_surface = Python3Script(input_surface=input_surface_brep, trim_rectangles=scale.Geometry, keep_direction=repeat_data, x=Toggle(False))  # -> out, flatten(trim_surface); inputs input_surface: Brep, trim_rectangles: list of Brep, keep_direction: Vector3d
# ---------- trim_surface: Python ----------
# This file represents a stub for a GhPython component in Grasshopper.
# It sets up the environment to import and use the splintcommon or other external modules.

from pathlib import Path
import sys
from importlib import reload #FOR DEV
import time

# Walk up through nested clusters to find the root GH document (necessary for use in nested clusters)
doc = ghenv.Component.OnPingDocument()
while not doc.FilePath and doc.Owner:
    doc = doc.Owner.OnPingDocument()
ghFileDir = str(Path(doc.FilePath).resolve().parent / "src")
print(f"{ghFileDir=}")

if ghFileDir not in sys.path:
    print("ghFileDir needed to be included")
    sys.path.append(ghFileDir)

import splintcommon
reload(splintcommon) #FOR DEV

#splintcommon module is now available for use in this GhPython component
splintcommon.log(f'GhPython Node initialized at {time.ctime()}')

import Rhino.Geometry as rg
import FeatureIdentification as fi
reload(fi)

# Diagnostics: what did GH pass us this invocation?
print("--- DIAGNOSTICS ---")
print("trim_rectangles type: {}".format(type(trim_rectangles).__name__))
if hasattr(trim_rectangles, '__len__'):
    print("trim_rectangles len: {}".format(len(trim_rectangles)))
    for i, tr in enumerate(trim_rectangles):
        print("  [{}]: {}".format(i, type(tr).__name__))
else:
    print("trim_rectangles: single item {}".format(type(trim_rectangles).__name__))

print("input_surface type: {}".format(type(input_surface).__name__))
print("keep_direction type: {}".format(type(keep_direction).__name__))
print("keep_direction: ({}, {}, {})".format(keep_direction.X, keep_direction.Y, keep_direction.Z))
print("--- END DIAGNOSTICS ---")

trim_surface = fi.trim_surface_with_direction(
    trim_rectangles,
    input_surface,
    keep_direction
)
# ---------- end trim_surface ----------
panel = Panel("-50, 50, 0")  # disabled
multiplication = Multiplication(A=deconstruct_plane.ZAxis, B="7")
multiplication_2 = Multiplication(A=negative, B="20")
cluster = Cluster(base_move_vector=panel, geo_data=entwine_2)  # -> geometry, out; disabled
panel_2 = Panel(trim_surface.out)
extrude = Extrude(Base=trim_surface.trim_surface, Direction=multiplication_2)
move = Move(Geometry=extrude, Motion=multiplication)  # -> flatten(Geometry), Transform
panel_3 = Panel(scale.Geometry)
trimmer_brep = Brep(move.Geometry)
trim_surface_2 = ClusterOutput(trim_surface.trim_surface)
trimmer_brep_2 = ClusterOutput(trimmer_brep)
panel_4 = Panel(move.Geometry)

# ==== cluster ConeCreator
number_slider = Slider(0, range=0..5)
list = ClusterInput()
point_a = ClusterInput()
point_b = ClusterInput()
point_c = ClusterInput()
list_item = ListItem(List=flatten(list), Index=number_slider, Wrap=False)
list_item_2 = ListItem(List=flatten(point_a), Index=number_slider, Wrap=False)
list_item_3 = ListItem(List=flatten(point_c), Index=number_slider, Wrap=False)
list_item_4 = ListItem(List=flatten(point_b), Index=number_slider, Wrap=False)
splint_center_point = Point(flatten(list))
splint_center_point_2 = Point(flatten(splint_center_point))
point_a_2 = Point(flatten(point_a))
point_c_2 = Point(flatten(point_c))
point_b_2 = Point(flatten(point_b))
splint_center_point_3 = Point(flatten(splint_center_point))
ext_ln_pts = ExtLnPts(startpoint=splint_center_point_3, midpoint=point_a_2, extensiondist="-5")
ext_ln_pts_2 = ExtLnPts(startpoint=splint_center_point_3, midpoint=point_b_2, extensiondist="-5")
ext_ln_pts_3 = ExtLnPts(startpoint=splint_center_point_3, midpoint=point_c_2, extensiondist="-5")
ext_ln_pts_4 = ExtLnPts(startpoint=splint_center_point_2, midpoint=point_a_2, extensiondist="5")
ext_ln_pts_5 = ExtLnPts(startpoint=splint_center_point_2, midpoint=point_b_2, extensiondist="5")
ext_ln_pts_6 = ExtLnPts(startpoint=splint_center_point_2, midpoint=point_c_2, extensiondist="5")
point_ax = Point(ext_ln_pts_4)
point_bx = Point(ext_ln_pts_5)
point_cx = Point(ext_ln_pts_3)
point_cx_2 = Point(ext_ln_pts_6)
point_bx_2 = Point(ext_ln_pts_2)
point_ax_2 = Point(ext_ln_pts)
line = Line(StartPoint=splint_center_point_3, EndPoint=ext_ln_pts_4)
circle_3pt = Circle3Pt(PointA=point_cx, PointB=point_bx_2, PointC=point_ax_2)  # -> Circle, Plane, Radius
circle_3pt_2 = Circle3Pt(PointA=point_cx_2, PointB=point_bx, PointC=point_ax)  # -> Circle, Plane, Radius
entwine = Entwine(Branch0X=circle_3pt.Circle, Branch1X=circle_3pt_2.Circle, FlattenInputs=False)
merge = Merge(Data1=circle_3pt.Circle, Data2=circle_3pt_2.Circle)
transpose_py = Python3Script(data=entwine)  # -> out, result; inputs data: tree of GeometryBase; same code as transpose_py
loft_options = LoftOptions(Closed=False, Adjust=True, Rebuild=0, Refit=0, Type=2)
panel = Panel(transpose_py.result)
loft = Loft(Curves=transpose_py.result, Options=loft_options)
cap_holes = CapHoles(Brep=loft)
brep = ClusterOutput(cap_holes)

# ==== cluster MoveComplexCL
base_move_vector = ClusterInput()
geo_data = ClusterInput()
geo_data_2 = Geometry(geo_data)
base_move_vector_2 = Vector(base_move_vector)
transpose_py = Python3Script(data=geo_data_2)  # -> out, result; inputs data: tree of GeometryBase; same code as transpose_py
python_3_script = Python3Script(data=transpose_py.result, base_vector=base_move_vector_2, z_separation="40")  # -> out, vectors; inputs data: tree, base_vector: Vector3d, z_separation: Double; same code as python_3_script
move = Move(Geometry=transpose_py.result, Motion=python_3_script.vectors)  # -> Geometry, Transform
panel = Panel(python_3_script.out)
geometry = Geometry(move.Geometry)
geometry_2 = ClusterOutput(geometry)

# ==== cluster Cluster_2
base_move_vector = ClusterInput()
geo_data = ClusterInput()
base_move_vector_2 = Vector(base_move_vector)
geo_data_2 = Geometry(geo_data)
transpose_py = Python3Script(data=geo_data_2)  # -> out, result; inputs data: tree of GeometryBase; same code as transpose_py
python_3_script = Python3Script(data=transpose_py.result, base_vector=base_move_vector_2, z_separation="40")  # -> out, vectors; inputs data: tree, base_vector: Vector3d, z_separation: Double; same code as python_3_script
out = ClusterOutput(python_3_script.out)
move = Move(Geometry=transpose_py.result, Motion=python_3_script.vectors)  # -> Geometry, Transform
geometry = ClusterOutput(move.Geometry)

# ==== cluster Cluster
geo_data = ClusterInput()
base_move_vector = ClusterInput()
base_move_vector_2 = Vector(base_move_vector)
geo_data_2 = Geometry(geo_data)
panel = Panel(geo_data_2)
transpose_py = Python3Script(data=geo_data_2)  # -> out, result; inputs data: tree of GeometryBase
# ---------- transpose_py: Python ----------
# Input: data (Tree Access)
# Output: result

from Grasshopper import DataTree
from Grasshopper.Kernel.Data import GH_Path

branches = [list(data.Branch(i)) for i in range(data.BranchCount)]

print("Branch count: {}".format(data.BranchCount))
for i, b in enumerate(branches):
    print("  Branch {}: {} items, path {}".format(i, len(b), data.Path(i)))

count = min(len(b) for b in branches)
print("Transposing: {} branches x {} items".format(len(branches), count))

result = DataTree[object]()
for i in range(count):
    path = GH_Path(i)
    for b in branches:
        result.Add(b[i], path)

print("Output: {} branches x {} items each".format(result.BranchCount, result.Branch(0).Count if result.BranchCount > 0 else 0))
# ---------- end transpose_py ----------
python_3_script = Python3Script(data=transpose_py.result, base_vector=base_move_vector_2, z_separation="40")  # -> out, vectors; inputs data: tree, base_vector: Vector3d, z_separation: Double
# ---------- python_3_script: Python ----------
# This file represents a stub for a GhPython component in Grasshopper.
# It sets up the environment to import and use the splintcommon or other external modules.

from pathlib import Path
import sys
from importlib import reload #FOR DEV
import time

# Walk up through nested clusters to find the root GH document (necessary for use in nested clusters)
doc = ghenv.Component.OnPingDocument()
while not doc.FilePath and doc.Owner:
    doc = doc.Owner.OnPingDocument()
ghFileDir = str(Path(doc.FilePath).resolve().parent / "src")

print(f"{ghFileDir=}")

if ghFileDir not in sys.path:
    print("ghFileDir needed to be included")
    sys.path.append(ghFileDir)

import splintcommon
reload(splintcommon) #FOR DEV

#splintcommon module is now available for use in this GhPython component
splintcommon.log(f'GhPython Node initialized at {time.ctime()}')

#Your code here

# Inputs:
#   data         (Tree Access, type hint: ghdoc Object)
#   base_vector  (Item Access, type hint: Vector3d)
#   z_separation (Item Access, type hint: float)
# Output:
#   vectors

import Rhino.Geometry as rg
from Grasshopper import DataTree
from Grasshopper.Kernel.Data import GH_Path

branch_count = data.BranchCount
print("Branches: {}, z_separation: {}".format(branch_count, z_separation))

vectors = DataTree[rg.Vector3d]()

for i in range(branch_count):
    path = data.Path(i)
    item_count = data.Branch(i).Count
    vec = rg.Vector3d(base_vector.X, base_vector.Y, base_vector.Z + z_separation * i)
    print("  Branch {} ({}): {} items, vec Z={:.2f}".format(i, path, item_count, vec.Z))
    # One vector per item so the tree matches the geometry tree for Move
    for j in range(item_count):
        vectors.Add(vec, path)
# ---------- end python_3_script ----------
out = ClusterOutput(python_3_script.out)
move = Move(Geometry=transpose_py.result, Motion=python_3_script.vectors)  # -> Geometry, Transform
geometry = ClusterOutput(move.Geometry)
