# Grasshopper definition SizingRings.gh (Grasshopper 1.0.8)
# plug-ins: Pufferfish, PTComponentLibrary

geo_algorithm_name = Panel("SizingRings")
# Sizing Rings
is_production_mode = BooleanToggle(False)
toggle_job_make_it_go = BooleanToggle(True)
band_width_mm = Panel("7.5")
axial_band_thickness_mm = Panel("1.5")
factoryautomatorpy = Python3Script(is_production_mode=is_production_mode, geo_algorithm_name=geo_algorithm_name, toggleJob=toggle_job_make_it_go)  # -> out, root_filename, output_dir, objectID, raw_data; inputs is_production_mode: Boolean, toggleJob: Boolean
# ---------- factoryautomatorpy: Python ----------
from pathlib import Path
import sys
from importlib import reload #FOR DEV
import time

ghFileDir = str(Path.joinpath(Path(ghenv.Component.OnPingDocument().FilePath).resolve().parents[0], "src"))
print(f"{ghFileDir=}")

if ghFileDir not in sys.path:
    print("ghFileDir needed to be included")
    sys.path.append(ghFileDir)

import splintcommon
reload(splintcommon) #FOR DEV
from splintcommon import mark_generation_start
mark_generation_start()
splintcommon.log(f'FactoryAutomatorPY Running at: ({time.strftime("%H:%M:%S", time.localtime())})')
# ==================== Component Code ===========================

def float_range(start, stop, count):
    current = start
    step = (stop - start) / (count - 1)
    result_range = []
    for c in range(count):
        result_range.append(start + (step * c))
    return result_range

job_data, objectID, root_filename, output_dir, raw_data = splintcommon.load_job_data(is_production_mode, geo_algorithm_name)

# This mapping must match the schema of the data in the DB for this geometry type
# c_left_mm = job_data["c_left_mm"]
# c_right_mm = job_data["c_right_mm"]
# full_perimeter_mm = job_data["full_perimeter_mm"]
# right_forward_offset_mm = job_data["right_forward_offset_mm"]
# b_left_slit = job_data.get("b_left_slit", False)
# b_right_slit = job_data.get("b_right_slit", False)
# band_width_mm = job_data.get("band_width_mm", 7.5)
# splintcommon.log(f"Result data {c_left_mm=} {c_right_mm=} {full_perimeter_mm=} {right_forward_offset_mm=} {b_left_slit=} {b_right_slit=}")
# ---------- end factoryautomatorpy ----------
objectid = Panel(factoryautomatorpy.objectID)
panel = Panel(factoryautomatorpy.out)

# ----
# Circumference Sizing Circles
panel_2 = Panel("5.0")
grid_count = Panel("5")
grid_gap = Panel("17")
min_circumference = Panel("20.0")
count = Panel("25")
axial_band_thickness_mm_2 = Number(axial_band_thickness_mm)
series = Series(Start=min_circumference, Step=panel_2, Count=count)
c2r_py = Python3Script(Circumference=series)  # -> Radius
# ---------- c2r_py: Python ----------
import math


Radius = Circumference / (2 * math.pi)
# ---------- end c2r_py ----------
outer_r = Addition(A=c2r_py, B=axial_band_thickness_mm_2)
last_item = ListItem(List=c2r_py, Index=-1, Wrap=True)
addition = Addition(A=last_item, B=grid_gap)
planar_grid = PlanarGrid(
    BasePoint=Point(0, 0, 0),
    IDir=Vector(1, 0, 0),
    JDir=Vector(0, 1, 0),
    IDistance=addition,
    JDistance=addition,
    INumber=grid_count,
    JNumber=grid_count)
grid_rearrangement_py = Python3Script(grid_in=planar_grid)  # -> out, grid_out; inputs grid_in: tree
# ---------- grid_rearrangement_py: Python ----------
# This file represents a stub for a GhPython component in Grasshopper.
# It sets up the environment to import and use the splintcommon or other external modules.

from pathlib import Path
import sys
from importlib import reload #FOR DEV
import time

# Walk up through nested clusters to find the root GH document (necessary for use in nested clusters)
doc = ghenv.Component.OnPingDocument()
while not doc.FilePath and doc.Owner:
    doc = doc.Owner.OnPingDocument()
ghFileDir = str(Path(doc.FilePath).resolve().parent / "src")

print(f"{ghFileDir=}")

if ghFileDir not in sys.path:
    print("ghFileDir needed to be included")
    sys.path.append(ghFileDir)

import splintcommon
reload(splintcommon) #FOR DEV
from splintcommon import mark_generation_start
mark_generation_start()

#splintcommon module is now available for use in this GhPython component
splintcommon.log(f'1. GhPython Node initialized at {time.ctime()}')

#Component code here

import DataTreeUtils
reload(DataTreeUtils)
print("DataTreeUtils from:", DataTreeUtils.__file__)
from DataTreeUtils import tree_to_grid, grid_to_tree, reverse_columns, reorder_column_rows

grid = tree_to_grid(grid_in)               # x is the tree input

print("testing 12:30")
#Then scramble the columns so small and large items checkerboard next to each other
grid = reorder_column_rows(grid, [0, 4, 2, 3, 1], [1, 3])

grid = reorder_column_rows(grid, [3, 1, 2, 0, 4], [0, 2, 4])



grid_out = grid_to_tree(grid)
print("done")
# ---------- end grid_rearrangement_py ----------
data = Data(flatten(grid_rearrangement_py.grid_out))
list_indices = ListIndices(List=data)
smaller_than = SmallerThan(FirstNumber=list_indices, SecondNumber=count)  # -> SmallerThan, OrEqualTo
location_data = Data(flatten(grid_rearrangement_py.grid_out))
last_item_2 = ListItem(List=series, Index=-1, Wrap=True)
debug_grid_gen_py = Python3Script()  # -> out, grid_out
# ---------- debug_grid_gen_py: Python ----------
# This file represents a stub for a GhPython component in Grasshopper.
# It sets up the environment to import and use the splintcommon or other external modules.

from pathlib import Path
import sys
from importlib import reload #FOR DEV
import time

# Walk up through nested clusters to find the root GH document (necessary for use in nested clusters)
doc = ghenv.Component.OnPingDocument()
while not doc.FilePath and doc.Owner:
    doc = doc.Owner.OnPingDocument()
ghFileDir = str(Path(doc.FilePath).resolve().parent / "src")

print(f"{ghFileDir=}")

if ghFileDir not in sys.path:
    print("ghFileDir needed to be included")
    sys.path.append(ghFileDir)

import splintcommon
reload(splintcommon) #FOR DEV
from splintcommon import mark_generation_start
mark_generation_start()

#splintcommon module is now available for use in this GhPython component
splintcommon.log(f'1. GhPython Node initialized at {time.ctime()}')

#Component code here

import DataTreeUtils
reload(DataTreeUtils)
print("DataTreeUtils from:", DataTreeUtils.__file__)
from DataTreeUtils import tree_to_grid, grid_to_tree, reverse_columns, reorder_column_rows

col_vals = ["a", "b", "c", "d", "e"]
row_vals = ["0", "1", "2", "3", "4"]
grid = []

for row_val in row_vals:
    out_row = []
    for col_val in col_vals:
        out_row.append(col_val + row_val)
    print(out_row)
    grid.append(out_row)

print(f"[0][0] == {grid[0][0]}")
print(f"[4][4] == {grid[4][4]}")


grid_out = grid_to_tree(grid)
# ---------- end debug_grid_gen_py ----------
letter_grid = Data(flatten(debug_grid_gen_py.grid_out))
cull_pattern = CullPattern(List=data, CullPattern=smaller_than.SmallerThan)
max_circumference = Panel(last_item_2)
max_radius = Panel(last_item)
center_points = Point(cull_pattern)
annotation_dot = AnnotationDot(Location=location_data, PrimaryText=letter_grid)  # -> AnnotationDot, Location, PrimaryText, TextHeight
annotation_dot_2 = AnnotationDot(Location=center_points, PrimaryText=c2r_py)  # -> AnnotationDot, Location, PrimaryText, TextHeight
circumference_values = Number(series)
inner_radius_values = Number(c2r_py)
outer_radius_values = Number(outer_r)
circle_inner = Circle(Plane=center_points, Radius=c2r_py)
circle_outer = Circle(Plane=center_points, Radius=outer_r)
center_points_2 = Point(center_points)

# ----
# Chain Rings
inner_radius_values_2 = Number(inner_radius_values)
chain_hole_radius = Panel("3.0")
band_width_mm_2 = Number(band_width_mm)
axial_band_thickness_mm_3 = Number(axial_band_thickness_mm)
outer_radius_values_2 = Number(outer_radius_values)
intersection_nudge = Panel("0.1")
chain_ring_height_ratio = Panel("1.0")
center_points_3 = Point(center_points_2)
addition_2 = Addition(A=chain_hole_radius, B=axial_band_thickness_mm_3)
addition_3 = Addition(A=outer_radius_values_2, B=chain_hole_radius, C=intersection_nudge)
deconstruct = Deconstruct(Point=center_points_3)  # -> XComponent, YComponent, ZComponent
X = Multiplication(A=chain_ring_height_ratio, B=band_width_mm_2)
chain_ring_angle = Panel("45")
chain_hole_center_dist = Number(addition_3)
chain_hole_outer_radius = Number(addition_2)
unit_z = UnitZ(Factor=X)
sin = Sine(Value=degrees(chain_ring_angle))
cos = Cosine(Value=degrees(chain_ring_angle))
X_2 = Multiplication(A=sin, B=chain_hole_center_dist)
X_3 = Multiplication(A=cos, B=chain_hole_center_dist)
addition_4 = Addition(A=deconstruct.YComponent, B=X_3)
addition_5 = Addition(A=deconstruct.XComponent, B=X_2)
construct_point = ConstructPoint(XCoordinate=addition_5, YCoordinate=addition_4, ZCoordinate=deconstruct.ZComponent)
chain_hole_centers = Point(construct_point)
circle = Circle(Plane=chain_hole_centers, Radius=chain_hole_radius)
circle_2 = Circle(Plane=chain_hole_centers, Radius=chain_hole_outer_radius)
boundary_surfaces = BoundarySurfaces(Edges=[circle, circle_2])
extrude = Extrude(Base=boundary_surfaces, Direction=unit_z)
chain_rings = Brep(extrude)
chain_ring_angle_2 = Number(chain_ring_angle)

# ----
# Main Rings
inner_circle = Circle(circle_inner)
center_points_4 = Point(center_points_2)
band_width_mm_3 = Number(band_width_mm)
inner_circle_2 = Circle(circle_outer)
boundary_surfaces_2 = BoundarySurfaces(Edges=[inner_circle, inner_circle_2])
unit_z_2 = UnitZ(Factor=band_width_mm_3)
division = Division(A=band_width_mm_3, B="2")
unit_z_3 = UnitZ(Factor=division)
extrude_2 = Extrude(Base=boundary_surfaces_2, Direction=unit_z_2)
move = Move(Geometry=center_points_4, Motion=unit_z_3)  # -> Geometry, Transform
center_points_raised = Point(move.Geometry)
solid_rings = Brep(extrude_2)

# ----
# Join Pieces
solid_rings_2 = Brep(solid_rings)
chain_rings_2 = Brep(chain_rings)
merge = Merge(Data1=solid_rings_2, Data2=chain_rings_2)
solid_union = SolidUnion(Breps=merge)

# ----
# Size Embossing Gun
axial_band_thickness_mm_4 = Number(axial_band_thickness_mm)
center_points_5 = Point(center_points_raised)
circumference_values_2 = Number(circumference_values)
object_brep = Brep(solid_union)
unit_x = UnitX(Factor="-1")
xy_plane = XYPlane(Origin=Point(0, 0, 0))
unit_z_4 = UnitZ(Factor=1)
text = Text(circumference_values_2)
rotate = Rotate(Geometry=unit_x, Angle=degrees("135"), Plane=xy_plane)  # -> Geometry, Transform
boolean_toggle = BooleanToggle(True)
textgun_py = Python3Script(
    splint_brep=object_brep,
    object_id=text,
    text_up_vector=unit_z_4,
    wall_thickness_mm=axial_band_thickness_mm_4,
    text_size="5.5",
    text_projection_vector=rotate.Geometry,
    extrusion_depth_factor="0.4",
    projection_origin=center_points_5,
    x=boolean_toggle)  # -> out, embossedBrep, originalTextBreps, final_text_plane, projected_letters; inputs splint_brep: Brep, object_id: String, text_up_vector: Vector3d, text_size: Double, text_projection_vector: Vector3d, extrusion_depth_factor: Double, projection_origin: Point3d
# ---------- textgun_py: Python ----------
# This file represents a stub for a GhPython component in Grasshopper.
# It sets up the environment to import and use the splintcommon or other external modules.

from pathlib import Path
import sys
from importlib import reload #FOR DEV ONLY
import time

# In normal GH doc
ghFileDir = None
try:
    ghFileDir = str(Path.joinpath(Path(ghenv.Component.OnPingDocument().FilePath).resolve().parents[0], "src"))
except:
    # In GH Cluster
    ghFileDir = str(Path.joinpath(Path(ghenv.Component.OnPingDocument().Owner.OnPingDocument().FilePath).resolve().parents[0], "src"))

print(f"{ghFileDir=}")

if ghFileDir not in sys.path:
    print("ghFileDir needed to be included")
    sys.path.append(ghFileDir)

import splintcommon
reload(splintcommon) #FOR DEV

#splintcommon module is now available for use in this GhPython component
splintcommon.log(f'GhPython Node initialized at {time.ctime()}')

import TextGun
reload(TextGun) #FOR DEV
from TextGun import emboss_text

embossedBrep, originalTextBreps, projected_letters, final_text_plane = emboss_text(
    target_brep=splint_brep,
    text_content=object_id,
    wall_thickness_mm=wall_thickness_mm,
    text_size=text_size,
    text_up_vector=text_up_vector,
    text_projection_vector=text_projection_vector,
    extrusion_depth_factor=extrusion_depth_factor,
    projection_origin=projection_origin,
    emboss_inside=False,
    align_to_surface_normal=True
)
# ---------- end textgun_py ----------
reverse = Reverse(Vector=rotate.Geometry)
textgun_py_2 = Python3Script(
    splint_brep=textgun_py.embossedBrep,
    object_id=text,
    text_up_vector=unit_z_4,
    wall_thickness_mm=axial_band_thickness_mm_4,
    text_size="5.5",
    text_projection_vector=reverse,
    extrusion_depth_factor="0.4",
    projection_origin=center_points_5,
    x=boolean_toggle)  # -> out, embossedBrep, originalTextBreps, final_text_plane, projected_letters; inputs splint_brep: Brep, object_id: String, text_up_vector: Vector3d, text_size: Double, text_projection_vector: Vector3d, extrusion_depth_factor: Double, projection_origin: Point3d; same code as textgun_py
brep = Brep(textgun_py.originalTextBreps)
panel_3 = Panel(textgun_py.out)
ring_with_embossed_size = Brep(textgun_py_2.embossedBrep)

brep_2 = Brep(textgun_py.projected_letters)

# ----
# Slit
center_points_6 = Point(center_points_2)  # disabled
chain_ring_angle_3 = Number(chain_ring_angle_2)  # disabled
outer_radius_values_3 = Number(outer_radius_values)  # disabled
slit_thickness = Panel("0.5")  # disabled
number_slider = Slider(180, range=0..180)  # disabled
brep_3 = Brep(ring_with_embossed_size)  # disabled
deconstruct_2 = Deconstruct(Point=center_points_6)  # -> XComponent, YComponent, ZComponent; disabled
addition_6 = Addition(A=chain_ring_angle_3, B=number_slider)  # disabled
opposite_slit_angle = Panel(addition_6)  # disabled
cos_2 = Cosine(Value=degrees(addition_6))  # disabled
sin_2 = Sine(Value=degrees(addition_6))  # disabled
X_4 = Multiplication(A=cos_2, B=outer_radius_values_3)  # disabled
X_5 = Multiplication(A=sin_2, B=outer_radius_values_3)  # disabled
addition_7 = Addition(A=deconstruct_2.XComponent, B=X_5)  # disabled
addition_8 = Addition(A=deconstruct_2.YComponent, B=X_4)  # disabled
construct_point_2 = ConstructPoint(XCoordinate=addition_7, YCoordinate=addition_8, ZCoordinate=deconstruct_2.ZComponent)  # disabled
center_point = Point(center_points_3)  # disabled
number_slider_2 = Slider(90, range=0..90)  # disabled
line = Line(StartPoint=center_point, EndPoint=construct_point_2)  # disabled
xy_plane_2 = XYPlane(Origin=center_point)  # disabled
rotate_2 = Rotate(Geometry=line, Angle=degrees(number_slider_2), Plane=xy_plane_2)  # -> Geometry, Transform; disabled
rotate_3 = Rotate(Geometry=xy_plane_2, Angle=degrees(opposite_slit_angle), Plane=xy_plane_2)  # -> Geometry, Transform; disabled
unit_vector = UnitVector(Vector=rotate_2.Geometry)  # disabled
slice_plane = Plane(rotate_3.Geometry)  # disabled
unit_vector_2 = UnitVector(Vector=line)  # disabled
deconstruct_plane = DeconstructPlane(Plane=slice_plane)  # -> Origin, XAxis, YAxis, ZAxis; disabled
box_center_slice_py = Python3Script(target_brep=ring_with_embossed_size, view_vector=unit_vector, bbox_plane=rotate_3.Geometry)  # -> out, slice_surface, y_size, x_size; inputs target_brep: Brep, view_vector: Vector3d, bbox_plane: Plane; disabled
# ---------- box_center_slice_py: Python ----------
# This file represents a stub for a GhPython component in Grasshopper.
# It sets up the environment to import and use the splintcommon or other external modules.

from pathlib import Path
import sys
from importlib import reload #FOR DEV
import time

# In normal GH doc
ghFileDir = None
try:
    ghFileDir = str(Path.joinpath(Path(ghenv.Component.OnPingDocument().FilePath).resolve().parents[0], "src"))
except:
    # In GH Cluster
    ghFileDir = str(Path.joinpath(Path(ghenv.Component.OnPingDocument().Owner.OnPingDocument().FilePath).resolve().parents[0], "src"))

print(f"{ghFileDir=}")

if ghFileDir not in sys.path:
    print("ghFileDir needed to be included")
    sys.path.append(ghFileDir)

import splintcommon
reload(splintcommon) #FOR DEV

#splintcommon module is now available for use in this GhPython component
splintcommon.log(f'GhPython Node initialized at {time.ctime()}')

import FeatureIdentification
reload(FeatureIdentification) #FOR DEV
from FeatureIdentification import box_center_slice

import Rhino.Geometry as rg

# Get a slice plane at the center, facing +Y direction
slice_surface, sizes = box_center_slice(
    target_brep=target_brep,
    bbox_plane=bbox_plane,
    choose_side_vector=view_vector,
    return_size=True,
)

print(f"{sizes=}")

x_size = sizes[0]

y_size = sizes[1]

print(f"{y_size=}")
# ---------- end box_center_slice_py ----------
multiplication = Multiplication(A=unit_vector_2, B=box_center_slice_py.x_size)  # disabled
area = Area(Geometry=box_center_slice_py.slice_surface)  # -> Area, Centroid; disabled
construct_plane = ConstructPlane(Origin=area.Centroid, XAxis=deconstruct_plane.XAxis, YAxis=deconstruct_plane.YAxis)  # disabled
move_2 = Move(Geometry=box_center_slice_py.slice_surface, Motion=multiplication)  # -> Geometry, Transform; disabled
panel_4 = Panel("0.5")  # disabled
panel_5 = Panel("2.0")  # disabled
scale_nu = ScaleNU(Geometry=move_2.Geometry, Plane=construct_plane, ScaleX=panel_4, ScaleY=1, ScaleZ=panel_5)  # -> Geometry, Transform; disabled
slitbot_brep_py = Python3Script(splint_brep=brep_3, slit_panel=scale_nu.Geometry, slit_thickness=slit_thickness)  # -> out, brep_out, flatten(side_a_edges), flatten(side_b_edges), side_a_cutter, side_b_cutter; inputs splint_brep: Brep, slit_panel: Brep, slit_thickness: Double; disabled
# ---------- slitbot_brep_py: Python ----------
# This file represents a stub for a GhPython component in Grasshopper.
# It sets up the environment to import and use the splintcommon or other external modules.

from pathlib import Path
import sys
from importlib import reload #FOR DEV
import time

# Walk up through nested clusters to find the root GH document (necessary for use in nested clusters)
doc = ghenv.Component.OnPingDocument()
while not doc.FilePath and doc.Owner:
    doc = doc.Owner.OnPingDocument()
ghFileDir = str(Path(doc.FilePath).resolve().parent / "src")

print(f"{ghFileDir=}")

if ghFileDir not in sys.path:
    print("ghFileDir needed to be included")
    sys.path.append(ghFileDir)

import splintcommon
reload(splintcommon) #FOR DEV
from splintcommon import mark_generation_start
mark_generation_start()

#splintcommon module is now available for use in this GhPython component
splintcommon.log(f'GhPython Node initialized at {time.ctime()}')

#Component code here

import BrepSlit
reload(BrepSlit)
from BrepSlit import cut_slit

fillet_radius = 0.3

brep_out, side_a_edges, side_b_edges, side_a_cutter, side_b_cutter = cut_slit(splint_brep, slit_panel, slit_thickness, fillet_radius)

print(f"{side_a_edges=}")
print(f"{side_b_edges=}")
# ---------- end slitbot_brep_py ----------
brep_4 = Brep(slitbot_brep_py.side_a_cutter)  # disabled
brep_5 = Brep(slitbot_brep_py.side_b_cutter)  # disabled
# Report Results
# Bake Me
# Initial Geometry
# Solid Construction Geometry
slitted_brep = Brep(slitbot_brep_py.brep_out)  # disabled

number_slider_3 = Slider(0.12, range=0.05..0.2)

# ----
# Report Results
# NOTE: Let's make sure everything stays in Breps until this phase
sizing_ring_breps = Brep(ring_with_embossed_size)
output_dir_out = Text(factoryautomatorpy.output_dir)
root_filename_out = Text(factoryautomatorpy.root_filename)
axial_band_thickness_mm_5 = Number(axial_band_thickness_mm)
tunable_mesh_conversion_py = Python3Script(breps_in=sizing_ring_breps)  # -> out, meshes_out; inputs breps_in: list of Brep
# ---------- tunable_mesh_conversion_py: Python ----------
# This file represents a stub for a GhPython component in Grasshopper.
# It sets up the environment to import and use the splintcommon or other external modules.

from pathlib import Path
import sys
from importlib import reload #FOR DEV
import time

# Walk up through nested clusters to find the root GH document (necessary for use in nested clusters)
doc = ghenv.Component.OnPingDocument()
while not doc.FilePath and doc.Owner:
    doc = doc.Owner.OnPingDocument()
ghFileDir = str(Path(doc.FilePath).resolve().parent / "src")

print(f"{ghFileDir=}")

if ghFileDir not in sys.path:
    print("ghFileDir needed to be included")
    sys.path.append(ghFileDir)

import splintcommon
reload(splintcommon) #FOR DEV
from splintcommon import mark_generation_start
mark_generation_start()

#splintcommon module is now available for use in this GhPython component
splintcommon.log(f'GhPython Node initialized at {time.ctime()}')

#Component code here

import splintmeshes
reload(splintmeshes)
from splintmeshes import convert_to_export_meshes


meshes_out = convert_to_export_meshes(
    breps_in,
    quality="high",
    target_edge_length=0.05, #1.1
    max_edge_length=1.1, #1.1
    min_edge_length=0.03,
    jagged_seams=False,
    simple_planes=True, #True
    refine_grid=False, #False
    weld_angle_degrees=45,
    smoothing_iterations=0,
    repair_if_needed=True,
    require_closed=True,
    require_manifold=True,
    shrinkwrap_fallback=True
)

# Previous to 5/11/26 these were good, but caused slits to be healed:
# meshes_out = convert_to_export_meshes(
#     breps_in,
#     quality="high",
#     target_edge_length=1.1,
#     max_edge_length=1.1,
#     min_edge_length=0.03,
#     jagged_seams=False,
#     simple_planes=True,
#     refine_grid=False,
#     weld_angle_degrees=45,
#     smoothing_iterations=0,
#     repair_if_needed=True,
#     require_closed=True,
#     require_manifold=True,
#     shrinkwrap_fallback=True
# )


# 7.39 mb and good detail all around!
# meshes_out = convert_to_export_meshes(
#     breps_in,
#     quality="high",
#     target_edge_length=1.1,
#     max_edge_length=1.1,
#     min_edge_length=0.03,
#     jagged_seams=False,
#     simple_planes=True,
#     refine_grid=False,
#     weld_angle_degrees=45,
#     smoothing_iterations=0,
#     repair_if_needed=True,
#     require_closed=True,
#     require_manifold=True,
#     shrinkwrap_fallback=False
# )

# # 10mb, text good, bottoms rounded
# meshes_out = convert_to_export_meshes(
#     breps_in,
#     quality="high",
#     target_edge_length=0.9,
#     max_edge_length=0.9,
#     min_edge_length=0.02,
#     jagged_seams=False,
#     simple_planes=True,
#     refine_grid=False,
#     weld_angle_degrees=45,
#     smoothing_iterations=0,
#     repair_if_needed=True,
#     require_closed=True,
#     require_manifold=True,
#     shrinkwrap_fallback=False
# )

# 8Mb, good text, rounding on tops and bottoms
# meshes_out = convert_to_export_meshes(
#     breps_in,
#     quality="fast",
#     target_edge_length=1.5,
#     max_edge_length=2.0,
#     min_edge_length=0.10,
#     smoothing_iterations=0,
#     repair_if_needed=True,
#     require_closed=True,
#     require_manifold=True,
#     shrinkwrap_fallback=False
# )
# ---------- end tunable_mesh_conversion_py ----------
dev_activate_toggle = BooleanToggle(False)

meshes = Geometry(tunable_mesh_conversion_py.meshes_out)  # disabled
shrinkwrap = ShrinkWrap(
    Geometry=sizing_ring_breps,
    EdgeLength="0.2",
    Offset=0,
    Smoothing=Slider(8, range=0..10),
    Optimization=10,
    FillHoles=True)  # disabled
meshes_2 = Geometry(meshes)  # disabled
slitbot_mesh_py = Python3Script(mesh_in=meshes_2, slit_panel_in=scale_nu.Geometry, slit_thickness=slit_thickness)  # -> out, mesh_out, flatten(side_a_edges), flatten(side_b_edges), side_a_cutter, side_b_cutter; inputs mesh_in: Mesh, slit_panel_in: Brep, slit_thickness: Double; disabled
# ---------- slitbot_mesh_py: Python ----------
# This file represents a stub for a GhPython component in Grasshopper.
# It sets up the environment to import and use the splintcommon or other external modules.

from pathlib import Path
import sys
from importlib import reload #FOR DEV
import time

# Walk up through nested clusters to find the root GH document (necessary for use in nested clusters)
doc = ghenv.Component.OnPingDocument()
while not doc.FilePath and doc.Owner:
    doc = doc.Owner.OnPingDocument()
ghFileDir = str(Path(doc.FilePath).resolve().parent / "src")

print(f"{ghFileDir=}")

if ghFileDir not in sys.path:
    print("ghFileDir needed to be included")
    sys.path.append(ghFileDir)

import splintcommon
reload(splintcommon) #FOR DEV
from splintcommon import mark_generation_start
mark_generation_start()

#splintcommon module is now available for use in this GhPython component
splintcommon.log(f'GhPython Node initialized at {time.ctime()}')

#Component code here

import BrepSlit
reload(BrepSlit)
from BrepSlit import cut_slit_mesh #cut_slit

fillet_radius = 0.3

#brep_out, side_a_edges, side_b_edges, side_a_cutter, side_b_cutter = cut_slit(splint_brep, slit_panel, slit_thickness, fillet_radius)
mesh_out, side_a_edges, side_b_edges, side_a_surface, side_b_surface = cut_slit_mesh(
    mesh_in,
    slit_panel_in,
    slit_thickness,
    fillet_radius,
    tolerance=None
)

print(f"{side_a_edges=}")
print(f"{side_b_edges=}")
# ---------- end slitbot_mesh_py ----------
slitted_mesh = Mesh(slitbot_mesh_py.mesh_out)  # disabled

output_meshes = Geometry(slitted_mesh)
qa_py = Python3Script(output_breps=output_meshes)  # -> out, py_wall_probe_data; inputs output_breps: list of Brep
# ---------- qa_py: Python ----------
# This file represents a stub for a GhPython component in Grasshopper.
# It sets up the environment to import and use the splintcommon or other external modules.

from pathlib import Path
import sys
from importlib import reload #FOR DEV
import time

# Walk up through nested clusters to find the root GH document (necessary for use in nested clusters)
doc = ghenv.Component.OnPingDocument()
while not doc.FilePath and doc.Owner:
    doc = doc.Owner.OnPingDocument()
ghFileDir = str(Path(doc.FilePath).resolve().parent / "src")

print(f"{ghFileDir=}")

if ghFileDir not in sys.path:
    print("ghFileDir needed to be included")
    sys.path.append(ghFileDir)

import splintcommon
reload(splintcommon) #FOR DEV
from splintcommon import mark_generation_start, log
mark_generation_start()

#splintcommon module is now available for use in this GhPython component
splintcommon.log(f'GhPython Node initialized at {time.ctime()}')

#Component code here


import BrepInspect
reload(BrepInspect)
from BrepInspect import inspect_solid_breps

all_ok = inspect_solid_breps(output_breps, verbose=True)

py_wall_probe_data = [{"all_breps_ok": all_ok}]

if not all_ok:
    log("Breps failed structural inspection")
# ---------- end qa_py ----------
panel_6 = Panel(qa_py.out)
py_wall_probe_data = Data(qa_py.py_wall_probe_data)
savemeshpy = Python3Script(
    final_mesh=output_meshes,
    output_dir=output_dir_out,
    root_filename=root_filename_out,
    bool_activate=dev_activate_toggle,
    axial_band_thickness_mm=axial_band_thickness_mm_5,
    py_wall_probe_data=py_wall_probe_data)  # -> out; inputs final_mesh: list of Mesh, axial_band_thickness_mm: Double
# ---------- savemeshpy: Python ----------
# This file represents a stub for a GhPython component in Grasshopper.
# It sets up the environment to import and use the splintcommon or other external modules.

from pathlib import Path
import sys
from importlib import reload #FOR DEV
import time

# Walk up through nested clusters to find the root GH document (necessary for use in nested clusters)
doc = ghenv.Component.OnPingDocument()
while not doc.FilePath and doc.Owner:
    doc = doc.Owner.OnPingDocument()
ghFileDir = str(Path(doc.FilePath).resolve().parent / "src")

print(f"{ghFileDir=}")

if ghFileDir not in sys.path:
    print("ghFileDir needed to be included")
    sys.path.append(ghFileDir)

import splintcommon
reload(splintcommon) #FOR DEV
from splintcommon import log, gh_decode

#splintcommon module is now available for use in this GhPython component
splintcommon.log(f'GhPython Node initialized at {time.ctime()}')

#Component code here

import splintmeshes
reload(splintmeshes)
from splintmeshes import save_job_output

wall_probe_data = gh_decode(py_wall_probe_data)

# With error handling
try:
    log(f"Logging to {output_dir=} {root_filename=}")
    #splintmeshes.save_mesh(final_splint_mesh, output_dir, root_filename, format_type="stl")

    save_job_output(final_mesh, output_dir, root_filename, format_type="3mf", custom_metadata={
        "wall_probe_data": wall_probe_data,
        "axial_band_thickness_mm": axial_band_thickness_mm,
    })
    log(f"Export succeeded: {output_dir=} {root_filename=}")
except splintmeshes.MeshExportError as e:
    log("Export failed: {}".format(e))
except ValueError as e:
    log("Bad input: {}".format(e))
# ---------- end savemeshpy ----------
panel_7 = Panel(savemeshpy)
