# Grasshopper definition cylinder.gh (Grasshopper 1.0.8)
# plug-ins: Pufferfish

# ---- group: DEV Values
is_production_mode = BooleanToggle(True)
geo_algorithm_name = Panel("cylinder")
cylinder_radius_mm = Panel("50.0")
cylinder_height_mm = Panel("10.0")
toggle_job_make_it_go = BooleanToggle(True)

# ----
factoryautomatorpy = Python3Script(
    is_production_mode=is_production_mode,
    geo_algorithm_name=geo_algorithm_name,
    cylinder_radius=cylinder_radius_mm,
    cylinder_height=cylinder_height_mm,
    x=toggle_job_make_it_go)  # -> out, cylinder_radius_out, cylinder_height_out, root_filename_out, output_dir_out; inputs is_production_mode: Boolean, cylinder_radius: Double, cylinder_height: Double, x: Boolean
# ---------- factoryautomatorpy: Python ----------
from pathlib import Path
import sys
from importlib import reload #FOR DEV
import time

ghFileDir = str(Path.joinpath(Path(ghenv.Component.OnPingDocument().FilePath).resolve().parents[0], "src"))
print(f"{ghFileDir=}")

if ghFileDir not in sys.path:
    print("ghFileDir needed to be included")
    sys.path.append(ghFileDir)

import splintcommon
reload(splintcommon) #FOR DEV
from splintcommon import mark_generation_start
mark_generation_start()
splintcommon.log(f'FactoryAutomatorPY Running at: ({time.strftime("%H:%M:%S", time.localtime())})')
# ==================== Component Code ===========================

def float_range(start, stop, count):
    current = start
    step = (stop - start) / (count - 1)
    result_range = []
    for c in range(count):
        result_range.append(start + (step * c))
    return result_range

print(f"{is_production_mode=} {geo_algorithm_name=}")

job_data, objectID, root_filename_out, output_dir_out, raw_data = splintcommon.load_job_data(is_production_mode, geo_algorithm_name)

# This mapping must match the schema of the data in the DB for this geometry type
cylinder_radius_out = job_data["radius"]
cylinder_height_out = job_data["height"]
jobname = job_data["jobname"]

splintcommon.log(f"Result data {geo_algorithm_name=} {objectID=} {jobname=} {cylinder_radius_out=} {cylinder_height_out=}")
# ---------- end factoryautomatorpy ----------
panel = Panel(factoryautomatorpy.out)

# ----
# Wall Probe Data
splints_w_direction_indicator = Brep()  # disabled
py_finger_model = Data()  # disabled
inner_shell_brep = Brep()  # disabled
wall_probe_data = Python3Script(py_finger_models=py_finger_model, meshes=splints_w_direction_indicator)  # -> out, preview_geo, py_wall_probe_data; inputs py_finger_models: list, meshes: list; disabled
# ---------- wall_probe_data: Python ----------
# This file represents a stub for a GhPython component in Grasshopper.
# It sets up the environment to import and use the splintcommon or other external modules.

from pathlib import Path
import sys
from importlib import reload #FOR DEV
import time

# Walk up through nested clusters to find the root GH document (necessary for use in nested clusters)
doc = ghenv.Component.OnPingDocument()
while not doc.FilePath and doc.Owner:
    doc = doc.Owner.OnPingDocument()
ghFileDir = str(Path(doc.FilePath).resolve().parent / "src")

print(f"{ghFileDir=}")

if ghFileDir not in sys.path:
    print("ghFileDir needed to be included")
    sys.path.append(ghFileDir)

import splintcommon
reload(splintcommon) #FOR DEV
from splintcommon import mark_generation_start
mark_generation_start()

#splintcommon module is now available for use in this GhPython component
splintcommon.log(f'GhPython Node initialized at {time.ctime()}')

#Component code here

import splintmeasurement
reload(splintmeasurement)
from splintmeasurement import measure_thickness_probes_batch #measure_thickness_probes
import math

# Define probes relevant to this splint type
#  the probe direction is in the perp frame's local coordinates, not world coordinates. 
#The perp frame is constructed at each joint/phalanx location with:
# XAxis = lateral (perpendicular to finger, sideways)
# YAxis = dorsal (perpendicular to finger, toward back of hand)
# ZAxis = finger centerline direction
# So (0, 1, 0) means "along the perp frame's YAxis" which is dorsal -- but that's dorsal 
# relative to the finger segment at that location. When the finger is flexed, the perp frame 
# rotates with it, so dorsal at PIP points in a different world direction than dorsal at MCP.
# If your finger is posed flat on a table along +X with palm down (-Z), then at the MCP: 
# XAxis ~ +Y (lateral), YAxis ~ +Z (dorsal/up), ZAxis ~ +X (finger direction). 
# That matches world XY expectations. But if MCP is flexed, the downstream frames rotate accordingly.

PROBES = [
    # Straight up at MCP
    ("pip_dorsal", "pip", 0.0, (0, 1, 0)),
    # 30 deg from dorsal toward medial (right) at MCP
    ("pip_dorsal_medial_30", "pip", 0.0, (-math.sin(math.radians(30)), math.cos(math.radians(30)), 0)),
    # which is: (-0.5, 0.866, 0.0)
]

# finger_result is your FingerModelResult from create_finger_model_result()
# splint_mesh is the meshed shell after boolean difference (outer - inner)
probe_thicknesses, preview_geo = measure_thickness_probes_batch(py_finger_models, splints, PROBES)

print(f"{probe_thicknesses=}")
print(f"{preview_geo=}")

py_wall_probe_data = [probe_thicknesses] #necessary for passing py data
# ---------- end wall_probe_data ----------
panel_2 = Panel(py_finger_model)  # disabled
geometry = Geometry(wall_probe_data.preview_geo)  # disabled
panel_3 = Panel(wall_probe_data.py_wall_probe_data)  # disabled
panel_4 = Panel(wall_probe_data.out)  # disabled
number_slider = Slider(0, range=0..4)  # disabled
py_wall_probe_data = Data(wall_probe_data.py_wall_probe_data)  # disabled
list_item = ListItem(List=geometry, Index=number_slider, Wrap=False)  # disabled

xy_plane = XYPlane(Origin=Point(0, 0, 0))
cylinder_radius = Number(factoryautomatorpy.cylinder_radius_out)
cylinder_height = Number(factoryautomatorpy.cylinder_height_out)
output_dir = Text(factoryautomatorpy.output_dir_out)
root_filename = Text(factoryautomatorpy.root_filename_out)
cylinder = Cylinder(Base=xy_plane, Radius=cylinder_radius, Length=cylinder_height)
cap_holes = CapHoles(Brep=cylinder)
settings_quality = SettingsQuality()
mesh_brep = MeshBrep(Brep=cap_holes, Settings=settings_quality)

# ----
# TODO: Do a proper probe check!
cylinder_radius_2 = Number(cylinder_radius)
cylinder_height_2 = Number(cylinder_height)

kill_on_completion = BooleanToggle(False)
dev_activate_toggle = BooleanToggle(True)
output_dir_2 = Text(output_dir)
root_filename_2 = Text(root_filename)
mesh = Mesh(mesh_brep)
is_mesh_closed = IsMeshClosed(Mesh=mesh_brep)
savemeshpy = Python3Script(
    final_mesh=mesh,
    output_dir=output_dir_2,
    root_filename=root_filename_2,
    bool_activate=dev_activate_toggle,
    radius_true=cylinder_radius_2,
    height_true=cylinder_height_2)  # -> out; inputs final_mesh: Mesh
# ---------- savemeshpy: Python ----------
# This file represents a stub for a GhPython component in Grasshopper.
# It sets up the environment to import and use the splintcommon or other external modules.

from pathlib import Path
import sys
from importlib import reload #FOR DEV
import time

# Walk up through nested clusters to find the root GH document (necessary for use in nested clusters)
doc = ghenv.Component.OnPingDocument()
while not doc.FilePath and doc.Owner:
    doc = doc.Owner.OnPingDocument()
ghFileDir = str(Path(doc.FilePath).resolve().parent / "src")

print(f"{ghFileDir=}")

if ghFileDir not in sys.path:
    print("ghFileDir needed to be included")
    sys.path.append(ghFileDir)

import splintcommon
reload(splintcommon) #FOR DEV
from splintcommon import log, gh_decode

#splintcommon module is now available for use in this GhPython component
splintcommon.log(f'GhPython Node initialized at {time.ctime()}')

#Component code here

import splintmeshes
reload(splintmeshes)
from splintmeshes import save_job_output

# With error handling
try:
    log(f"Logging to {output_dir=} {root_filename=}")
    #splintmeshes.save_mesh(final_splint_mesh, output_dir, root_filename, format_type="stl")

    save_job_output(final_mesh, output_dir, root_filename, "stl", custom_metadata={
        "radius_true": radius_true,
        "height_true": height_true,
    })
    log(f"Export succeeded: {output_dir=} {root_filename=}")
except splintmeshes.MeshExportError as e:
    log("Export failed: {}".format(e))
except ValueError as e:
    log("Bad input: {}".format(e))
# ---------- end savemeshpy ----------
panel_5 = Panel(is_mesh_closed)
panel_6 = Panel(savemeshpy)
