# Grasshopper definition stax_splint_v1.gh (Grasshopper 1.0.8)
# plug-ins: Pufferfish, Bowerbird2, Wombat

# NOTE: Flexion: Positive flexion curls down towards palm
# 
# Negative curls upwards away from palm
example_devdata = Panel("""    "distal_phalange_l_mm": 26.0,
    "middle_phalange_l_mm": 27.0,
    "tip_circumference_mm": 49.0,
    "dip_circumference_mm": 50.5,
    "mid_phalange_circumference_mm": 55.0,
    "pip_circumference_mm": 64.0,
    "flexion_degrees": -5.0,
    "lateral_flexion_degrees": 0.0""")
note = Panel("""ADD
Lateral Curve!!!""")
# Stax Splint
is_production_mode = BooleanToggle(True)
axial_band_thickness_mm = Panel("1.75")
output_dir_test = Panel("/Users/jon/Desktop/gh_output/")
root_filename = Panel("staxsplint_test")
geo_algorithm_name = Panel("stax_splint_v1")
toggle_job = BooleanToggle(False)
wall_thickness = Number(axial_band_thickness_mm)
factoryautomatorpy = Python3Script(
    is_production_mode=is_production_mode,
    geo_algorithm_name=geo_algorithm_name,
    root_filename=root_filename,
    output_dir=output_dir_test,
    toggleJob=toggle_job)  # -> out, distal_phalange_l_mm, middle_phalange_l_mm, tip_circumference_mm, dip_circumference_mm, mid_phalange_circumference_mm, pip_circumference_mm, flexion_degrees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; inputs is_production_mode: Boolean, root_filename: String, toggleJob: Boolean
# ---------- factoryautomatorpy: Python ----------
from pathlib import Path
import sys
from importlib import reload #FOR DEV ONLY
import time

ghFileDir = str(Path.joinpath(Path(ghenv.Component.OnPingDocument().FilePath).resolve().parents[0], "src"))
print(f"{ghFileDir=}")

if ghFileDir not in sys.path:
    print("ghFileDir needed to be included")
    sys.path.append(ghFileDir)

import splintcommon
reload(splintcommon) #FOR DEV ONLY

# import Rhino
# print(f"{Rhino.RhinoDoc.ActiveDoc.ModelAbsoluteTolerance}")
# Rhino.RhinoDoc.ActiveDoc.ModelAbsoluteTolerance = 0.00001
# print(f"{Rhino.RhinoDoc.ActiveDoc.ModelAbsoluteTolerance}")


splintcommon.log(f'FactoryAutomatorPY Running at: ({time.strftime("%H:%M:%S", time.localtime())})')

jobname = "LocalDev"
objectID = "LOCL"

job_data, objectID, root_filename, output_dir, raw_data = splintcommon.load_job_data(is_production_mode, geo_algorithm_name)

# This mapping must match the schema of the data in the DB for this geometry type
distal_phalange_l_mm = job_data["distal_phalange_l_mm"]
middle_phalange_l_mm = job_data["middle_phalange_l_mm"]
tip_circumference_mm = job_data["tip_circumference_mm"]
dip_circumference_mm = job_data["dip_circumference_mm"]
mid_phalange_circumference_mm = job_data["mid_phalange_circumference_mm"]
pip_circumference_mm = job_data["pip_circumference_mm"]
flexion_degrees = job_data["flexion_degrees"]
lateral_flexion_degrees = job_data["lateral_flexion_degrees"]

splintcommon.log(f"Result data {geo_algorithm_name=} {objectID=} {job_data=}")
# ---------- end factoryautomatorpy ----------
# NOTE: Lateral Flexion: Positive lateral flexion curls right
# 
# Negative curls left
panel = Panel(factoryautomatorpy.out)

# ----
# Value Prep
c2r_py = Python3Script(c=factoryautomatorpy.mid_phalange_circumference_mm)  # -> r; inputs c: Double
# ---------- c2r_py: Python ----------
import math


r = (c/math.pi)/2
# ---------- end c2r_py ----------
c2r_py_2 = Python3Script(c=factoryautomatorpy.tip_circumference_mm)  # -> r; inputs c: Double; same code as c2r_py
wall_thickness_2 = Number(wall_thickness)
l_middle = Number(factoryautomatorpy.distal_phalange_l_mm)
l_distal = Number(factoryautomatorpy.distal_phalange_l_mm)
c2r_py_3 = Python3Script(c=factoryautomatorpy.pip_circumference_mm)  # -> r; inputs c: Double; same code as c2r_py
c2r_py_4 = Python3Script(c=factoryautomatorpy.dip_circumference_mm)  # -> r; inputs c: Double; same code as c2r_py
flexion_degrees = Number(factoryautomatorpy.flexion_degrees)
radius_dip = Number(c2r_py_4)
radius_pip = Number(c2r_py_3)
radius_tip = Number(c2r_py_2)
radius_mid = Number(c2r_py)
addition = Addition(A=radius_tip, B=wall_thickness_2)
addition_2 = Addition(A=radius_mid, B=wall_thickness_2)
addition_3 = Addition(A=radius_pip, B=wall_thickness_2)
addition_4 = Addition(A=radius_dip, B=wall_thickness_2)
addition_5 = Addition(A=l_distal, B=wall_thickness_2)
addition_6 = Addition(A=flexion_degrees, B=Slider(0, range=-20..30))
radius_mid_shell = Number(addition_2)
radius_tip_shell = Number(addition)
radius_dip_shell = Number(addition_4)
radius_pip_shell = Number(addition_3)
l_distal_shell = Number(addition_5)

c2r_py_5 = Python3Script(c=factoryautomatorpy.dip_circumference_mm)  # -> r; inputs c: Double; same code as c2r_py
distal_phalange_l_mm = Number(factoryautomatorpy.distal_phalange_l_mm)
middle_phalange_l_mm = Number(factoryautomatorpy.middle_phalange_l_mm)
dip_radius = Number(c2r_py_5)

# ----
# Finger Preform Solid
# Notes: The infinity_flex is not specific to one joint, but we will model it surrounding the pip joint
shell_thickness = Number(wall_thickness)
dip_circumference_mm = Number(factoryautomatorpy.dip_circumference_mm)
lateral_flexion_degrees = Number(factoryautomatorpy.lateral_flexion_degrees)
distal_phalange_l_mm_2 = Number(factoryautomatorpy.distal_phalange_l_mm)
middle_phalange_l_mm_2 = Number(factoryautomatorpy.middle_phalange_l_mm)
tip_circumference_mm = Number(factoryautomatorpy.tip_circumference_mm)
mid_phalange_circumference_mm = Number(factoryautomatorpy.mid_phalange_circumference_mm)
pip_circumference_mm = Number(factoryautomatorpy.pip_circumference_mm)
flexion_degrees_2 = Number(factoryautomatorpy.flexion_degrees)
fingermodel_py = Python3Script(
    toggle=Toggle(True),
    shell_thickness=shell_thickness,
    distal_phalange_l_mm=distal_phalange_l_mm_2,
    middle_phalange_l_mm=middle_phalange_l_mm_2,
    tip_circumference_mm=tip_circumference_mm,
    dip_circumference_mm=dip_circumference_mm,
    mid_phalange_circumference_mm=mid_phalange_circumference_mm,
    pip_circumference_mm=pip_circumference_mm,
    flexion_degrees=flexion_degrees_2,
    lateral_flexion_degrees=lateral_flexion_degrees)  # -> out, cFinger_brep, cCenterline, cComponents, sCenterline, sFinger_brep, sComponents, splintBlank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; inputs shell_thickness: Double, distal_phalange_l_mm: Double, middle_phalange_l_mm: Double, tip_circumference_mm: Double, dip_circumference_mm: Double, mid_phalange_circumference_mm: Double, pip_circumference_mm: Double, flexion_degrees: Double, lateral_flexion_degrees: Double
# ---------- fingermodel_py: Python ----------
# This file represents a stub for a GhPython component in Grasshopper.
# It sets up the environment to import and use the splintcommon or other external modules.

from pathlib import Path
import sys
from importlib import reload #FOR DEV
import time

# Walk up through nested clusters to find the root GH document (necessary for use in nested clusters)
doc = ghenv.Component.OnPingDocument()
while not doc.FilePath and doc.Owner:
    doc = doc.Owner.OnPingDocument()
ghFileDir = str(Path(doc.FilePath).resolve().parent / "src")

print(f"{ghFileDir=}")

if ghFileDir not in sys.path:
    print("ghFileDir needed to be included")
    sys.path.append(ghFileDir)

import splintcommon
reload(splintcommon) #FOR DEV

#splintcommon module is now available for use in this GhPython component
splintcommon.log(f'GhPython Node initialized at {time.ctime()}')

#Component code here

from importlib import reload
from dataclasses import replace

import FingerModel
reload(FingerModel)
from FingerModel import create_finger_model_result, FingerParams

import BrepDifference
reload(BrepDifference) #FOR DEV ONLY
from BrepDifference import robust_brep_difference

# Refresher, order of elements:
# metacarpel numb, mcp, proximal, pip, middle, dip, distal

# input values to work with:
# shell_thickness
# distal_phalange_l_mm
# middle_phalange_l_mm
# tip_circumference_mm
# dip_circumference_mm
# mid_phalange_circumference_mm
# pip_circumference_mm
# flexion_degrees

# The model input values that we need to provide or compute:

coreParams = FingerParams(
    # Segment range - generate full finger or subset
    start_at="pip",
    end_at="tip",

    # Joint circumferences (mm)
    # mcp_circ=root_circ,
    # proximal_mid_circ=root_circ,
    pip_circ=pip_circumference_mm,
    middle_mid_circ=mid_phalange_circumference_mm,
    dip_circ=dip_circumference_mm,
    distal_mid_circ=(dip_circumference_mm + tip_circumference_mm)/2,
    tip_circ=tip_circumference_mm,

    # Metacarpal stub length
    # metacarpal_len=None,

    # Phalanx lengths (mm)
    #proximal_len=,
    middle_len=middle_phalange_l_mm,
    distal_len=distal_phalange_l_mm,
    
    # Joint angles (degrees) - positive = curl toward palm
    # mcp_flex=0.0,
    # pip_flex=0.0,
    dip_flex=flexion_degrees,

    # mcp_lateral=0.0,
    # pip_lateral=0.0,
    # dip_lateral=0.0,
    pad_rise=0.5,
)

# Create the finger model
coreResult = create_finger_model_result(coreParams)
cFinger_brep = coreResult.finger_brep

# Create the shell params
shellParams = replace(coreParams, shell_thickness=shell_thickness, start_at="middle", end_at="tip")
# shellParams.trim_start=("pip", -1 * trimDistAroundPIP)
# shellParams.trim_end=("pip", trimDistAroundPIP)

# Create the shell model
shellResult = create_finger_model_result(shellParams)
sFinger_brep = shellResult.finger_brep

# Subtract inner from shell to create hollow splint
splintBlank, success, method = robust_brep_difference(
    minuend=shellResult.finger_brep,      # subtract FROM this (larger)
    subtrahend=coreResult.finger_brep,    # subtract this (smaller)
    base_tolerance=0.001
)

splintBlankCenterline = shellResult.centerline

if success:
    print(f"Hollow splint created via {method}")
else:
    print(f"Difference failed: {method}")

shell_pip_hoop = shellResult.get_cross_section("pip", 0.1)
shell_mid_dip_hoop = shellResult.get_cross_section("dip")
shell_shaped_tip_hoop = shellResult.get_cross_section("tip")

# Now you can query cross-sections on either result, e.g.:
# dip_curves = shellResult.get_cross_section("dip", offset=0.0)
# mid_section = shellResult.get_cross_section("middle", offset=0.5)
# ---------- end fingermodel_py ----------
shell_shaped_tip_hoop = Curve(fingermodel_py.shell_shaped_tip_hoop)
material_shell_brep = Brep(fingermodel_py.splintBlank)
inner_shell_brep = Brep(fingermodel_py.cFinger_brep)
shell_mid_dip_hoop = Curve(fingermodel_py.shell_mid_dip_hoop)
outer_shell_brep = Brep(fingermodel_py.sFinger_brep)
splint_centerline = Curve(fingermodel_py.splintBlankCenterline)
shell_pip_hoop = Curve(fingermodel_py.shell_pip_hoop)
finger_analog = Brep(inner_shell_brep)
splint_shell = Brep(material_shell_brep)

panel_2 = Panel(fingermodel_py.out)
enable_jiggle = BooleanToggle(False)  # disabled
run_it_toggle = BooleanToggle(True)  # disabled
allowable_jiggle = Panel("0.1, 0.0, 0.1")  # disabled
max_jiggle_cycles = Panel("3")  # disabled
bool_jig_union_py = Python3Script(jiggleToleranceVector=allowable_jiggle, maxAttempts=max_jiggle_cycles, enableJiggle=enable_jiggle, x=run_it_toggle)  # -> out, unionedBrep, jiggleCount, testedPoints; inputs breps: list of Brep, jiggleToleranceVector: Vector3d, maxAttempts: Int32, enableJiggle: Boolean; disabled
# ---------- bool_jig_union_py: Python ----------
from pathlib import Path
import sys
from importlib import reload #FOR DEV ONLY
import time

ghFileDir = str(Path.joinpath(Path(ghenv.Component.OnPingDocument().FilePath).resolve().parents[0], "src"))
print(f"{ghFileDir=}")

if ghFileDir not in sys.path:
    print("ghFileDir needed to be included")
    sys.path.append(ghFileDir)

import cmpJiggleUnion
reload(cmpJiggleUnion) #FOR DEV ONLY

#inputs
# breps - breps to union together
# jiggleToleranceVector - 3D vector specifying the amount of allowed motion in a single jiggle in each direction
# maxAttempts - How many times to loop through the whole list of breps nudging them randomly
# enableJiggle - sometimes for development just doing the normal union and returning is desirable

print(f"jiggle {maxAttempts=} X={jiggleToleranceVector.X}, Y={jiggleToleranceVector.Y}, Z={jiggleToleranceVector.Z}")
jigUnion = cmpJiggleUnion.cmpJiggleUnion(breps, jiggleToleranceVector, maxAttempts, enableJiggle)
unionedBrep, jiggleCount, testedPoints = jigUnion.run();
# ---------- end bool_jig_union_py ----------

# ----
# Feature Identification
panel_3 = Panel("-1")
shell_shaped_tip_hoop_2 = Curve(shell_shaped_tip_hoop)
shell_pip_hoop_2 = Curve(shell_pip_hoop)
shell_mid_dip_hoop_2 = Curve(shell_mid_dip_hoop)
splint_shell_2 = Brep(splint_shell)
up_z = UnitZ(Factor=1)
up_x = UnitX(Factor=1)
down_z = UnitZ(Factor=panel_3)
pt_in_dir = PTInDir(curve=shell_pip_hoop_2, search_dir_v=up_z)
pt_in_dir_2 = PTInDir(curve=shell_shaped_tip_hoop_2, search_dir_v=up_z)
pt_in_dir_3 = PTInDir(curve=shell_mid_dip_hoop_2, search_dir_v=up_z)
pt_in_dir_4 = PTInDir(curve=shell_shaped_tip_hoop_2, search_dir_v=down_z)
pt_in_dir_brep = PTInDirBrep(brep=splint_shell_2, search_dir_v=up_x)
pt_in_dir_5 = PTInDir(curve=shell_mid_dip_hoop_2, search_dir_v=down_z)
# Top PIP back opening starting point
panel_4 = Panel("0.1")
# Bottom DIP back opening starting point
panel_5 = Panel("0.1")
locate_pt_on_brep = LocatePTOnBrep(start_pt=pt_in_dir, end_pt=pt_in_dir_3, param=panel_4, brep=splint_shell_2)
locate_pt_on_brep_2 = LocatePTOnBrep(start_pt=pt_in_dir_5, end_pt=pt_in_dir_4, param=panel_5, brep=splint_shell_2)
splint_low_rear_pt = Point(locate_pt_on_brep_2)
splint_high_rear_pt = Point(locate_pt_on_brep)
high_dip_pt = Point(pt_in_dir_3)
tip_pt = Point(pt_in_dir_brep)
high_root_pt = Point(pt_in_dir)

finger_analog_2 = Brep(finger_analog)
splint_shell_3 = Brep(splint_shell)

# ----
# NOTE: The Mid and distal planes here are derived in preparation for lateral curvature of a finger
# Trim Planes
extrusion_plane_offset = Panel("30")
distal_pts = Merge(Data1=splint_low_rear_pt, Data2=high_dip_pt, Data3=tip_pt)  # -> flatten(Result)
mid_pts = Merge(Data1=high_dip_pt, Data2=splint_low_rear_pt, Data3=splint_low_rear_pt)  # -> flatten(Result)
distal_average = Average(Input=distal_pts)
distal_plane_fit = PlaneFit(Points=distal_pts)  # -> Plane, Deviation
distal_plane_fit_2 = PlaneFit(Points=mid_pts)  # -> Plane, Deviation
deconstruct_plane = DeconstructPlane(Plane=distal_plane_fit.Plane)  # -> Origin, XAxis, YAxis, ZAxis
deconstruct_plane_2 = DeconstructPlane(Plane=distal_plane_fit_2.Plane)  # -> Origin, XAxis, YAxis, ZAxis
multiplication = Multiplication(A=deconstruct_plane.ZAxis, B=extrusion_plane_offset)
multiplication_2 = Multiplication(A=deconstruct_plane_2.ZAxis, B=extrusion_plane_offset)
move = Move(Geometry=distal_plane_fit.Plane, Motion=multiplication)  # -> Geometry, Transform
move_2 = Move(Geometry=distal_plane_fit_2.Plane, Motion=multiplication_2)  # -> Geometry, Transform

preview_points = Merge(Data1=high_root_pt, Data2=splint_high_rear_pt, Data3=splint_low_rear_pt, Data4=high_dip_pt, Data5=tip_pt)  # -> flatten(Result)
construct_domain = ConstructDomain(DomainStart="0", DomainEnd="1")
unit_x = UnitX(Factor=1)  # disabled
item_in_direction_cl = ItemInDirectionCL(selection_direction_v=unit_x)  # disabled
output_geometry = Geometry(item_in_direction_cl)  # disabled
surface = Surface(output_geometry)  # disabled
panel_6 = Panel("0, 0, 0")  # disabled
panel_7 = Panel("10")  # disabled
panel_8 = Panel("5")  # disabled
panel_9 = Panel("50")  # disabled
point = Point(panel_6)  # disabled
addition_7 = Addition(A=panel_7, B=panel_8)  # disabled
yz_plane = YZPlane(Origin=point)  # disabled
circle = Circle(Plane=yz_plane, Radius=addition_7)  # disabled
circle_2 = Circle(Plane=yz_plane, Radius=panel_7)  # disabled
merge = Merge(Data1=circle_2, Data2=circle)  # -> flatten(Result); disabled
boundary_surfaces = BoundarySurfaces(Edges=merge)  # disabled
unit_x_2 = UnitX(Factor=panel_9)  # disabled
move_3 = Move(Geometry=point, Motion=unit_x_2)  # -> Geometry, Transform; disabled
extrude = Extrude(Base=boundary_surfaces, Direction=unit_x_2)  # disabled
line = Line(StartPoint=point, EndPoint=move_3.Geometry)  # disabled
curve = Curve(merge)  # disabled
brepventilation_py = Python3Script(input_brep=extrude, brep_centerline=line, protected_curves=curve)  # -> out, result; inputs input_brep: Brep, brep_centerline: Polyline, protected_curves: list of Curve; disabled
# ---------- brepventilation_py: Python ----------
# This file represents a stub for a GhPython component in Grasshopper.
# It sets up the environment to import and use the splintcommon or other external modules.

from pathlib import Path
import sys
from importlib import reload #FOR DEV
import time

# Walk up through nested clusters to find the root GH document (necessary for use in nested clusters)
doc = ghenv.Component.OnPingDocument()
while not doc.FilePath and doc.Owner:
    doc = doc.Owner.OnPingDocument()
ghFileDir = str(Path(doc.FilePath).resolve().parent / "src")

print(f"{ghFileDir=}")

if ghFileDir not in sys.path:
    print("ghFileDir needed to be included")
    sys.path.append(ghFileDir)

import splintcommon
reload(splintcommon) #FOR DEV

splintcommon.log(f'BrepVentilation Node initialized at {time.ctime()}')

# -- Build a finger model and hollow shell for testing ventilation --

import BrepVentilation
reload(BrepVentilation)
from BrepVentilation import ventilate_brep


# Protected curves: open ends of the splint
protected = []

splintcommon.log(f"Protected curves: {len(protected_curves)}")

# Ventilate
# ventilated_result, hole_count = ventilate_brep(
#     input_brep=input_brep,
#     centerline=brep_centerline,
#     hole_radius=1.5,
#     clearance_radius=2.0,
#     protected_curves=protected_curves,
#     strategy="helical",
#     spacing_along=0.5,
#     angular_step=2, #137.5,
#     angles_per_station = 14
# )

ventilated_result, hole_count = ventilate_brep(
    input_brep, brep_centerline,
    hole_radius=2.0, clearance_radius=2.5,
    protected_curves=protected_curves,
    strategy="random",
    max_holes=100, max_attempts=2000,
    seed=22
)

splintcommon.log(f"Ventilation complete: {hole_count} holes")

# Outputs for Grasshopper preview
result = ventilated_result         # ventilated splint brep
# ---------- end brepventilation_py ----------
root_filename_out = Text(factoryautomatorpy.root_filename_out)
output_dir_out = Text(factoryautomatorpy.output_dir_out)
dev_activate_toggle = BooleanToggle(True)

# ----
# Shell Formation
outer_shell_cl = FingerCL(
    l_middle=l_middle,
    l_distal=l_distal_shell,
    flexion_degrees=addition_6,
    radius_tip=radius_tip_shell,
    radius_dip=radius_dip_shell,
    radius_mid=radius_mid_shell,
    radius_pip=radius_pip_shell)  # -> mid_line_5, distal_core_line_3, pip_hoop_2, mid_hoop_2, mid_dip_hoop_2, dip_sphere_3, distal_dip_hoop_2, tip_sphere_3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
finger_cl = FingerCL(
    l_middle=l_middle,
    l_distal=l_distal,
    flexion_degrees=addition_6,
    radius_tip=radius_tip,
    radius_dip=radius_dip,
    radius_mid=radius_mid,
    radius_pip=radius_pip)  # -> mid_line_5, distal_core_line_3, pip_hoop_2, mid_hoop_2, mid_dip_hoop_2, dip_sphere_3, distal_dip_hoop_2, tip_sphere_3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
unit_x_3 = UnitX(Factor="-0.1")
move_4 = Move(Geometry=finger_cl.whole_finger, Motion=unit_x_3)  # -> Geometry, Transform
outer_shell_brep_2 = Brep(outer_shell_cl.whole_finger)
shell_tip_shaped = Brep(outer_shell_cl.tip_shaped_2)
shell_shaped_tip_hoop_3 = Curve(outer_shell_cl.shaped_tip_hoop_2)
shell_mid_dip_hoop_3 = Curve(outer_shell_cl.mid_dip_hoop_2)
shell_pip_hoop_3 = Curve(outer_shell_cl.pip_hoop_2)

finger_analog_3 = Brep(move_4.Geometry)

solid_difference = SolidDifference(BrepsA=outer_shell_brep_2, BrepsB=finger_analog_3)
splint_shell_4 = Brep(solid_difference)

# ----
# Cutting Surfaces
# DISTAL
# MID
mid_line = Line(StartPoint=splint_high_rear_pt, EndPoint=splint_low_rear_pt)
distal_average_point = Point(distal_average)
tip_pt_2 = Point(tip_pt)
high_dip_pt_2 = Point(high_dip_pt)
merge_2 = Merge(Data1=tip_pt_2, Data2=distal_average_point, Data3=high_dip_pt_2)  # -> flatten(Result)
nurbs_curve = NurbsCurve(Vertices=merge_2, Degree="2", Periodic=False)  # -> Curve, Length, Domain
extend_curve = ExtendCurve(Curve=mid_line, Type=0, Start="20", End="20")
extend_curve_2 = ExtendCurve(Curve=nurbs_curve.Curve, Type=0, Start="20", End="20")
extrusion_plane_offset_2 = Panel(extrusion_plane_offset)
multiplication_3 = Multiplication(A=extrusion_plane_offset_2, B="-2")
distal_cutting_curve = Curve(extend_curve_2)
cutting_extrusion = Panel(multiplication_3)
transform = Transform(Geometry=distal_cutting_curve, Transform=move.Transform)
multiplication_4 = Multiplication(A=deconstruct_plane.ZAxis, B=cutting_extrusion)
multiplication_5 = Multiplication(A=deconstruct_plane_2.ZAxis, B=cutting_extrusion)
distal_2d_extrude = Extrude(Base=transform, Direction=multiplication_4)
tip_cutter_surface = Brep(distal_2d_extrude)

rebuild_curve = RebuildCurve(Curve=extend_curve, Count="10", Domain=construct_domain, EndTangents=False)

mid_cutting_curve = Curve(rebuild_curve)
transform_2 = Transform(Geometry=mid_cutting_curve, Transform=move_2.Transform)
mid_2d_extrude = Extrude(Base=transform_2, Direction=multiplication_5)
tail_cutter_surface = Brep(mid_2d_extrude)

# ----
# Solid Forming
tail_cutter_surface_2 = Brep(tail_cutter_surface)
distal_average_point_2 = Point(distal_average)
splint_shell_5 = Brep(splint_shell)
high_dip_pt_3 = Point(high_dip_pt)
tip_cutter_surface_2 = Brep(tip_cutter_surface)
area = Area(Geometry=tip_cutter_surface_2)  # -> Area, Centroid
area_2 = Area(Geometry=tail_cutter_surface_2)  # -> Area, Centroid
line_2 = Line(StartPoint=distal_average_point_2, EndPoint=area.Centroid)
line_3 = Line(StartPoint=high_dip_pt_3, EndPoint=area_2.Centroid)
unit_vector = UnitVector(Vector=line_2)
unit_vector_2 = UnitVector(Vector=line_3)
line_sdl = LineSDL(Start=distal_average_point_2, Direction=unit_vector, Length="50")
line_sdl_2 = LineSDL(Start=high_dip_pt_3, Direction=unit_vector_2, Length="50")
extrude_2 = Extrude(Base=tip_cutter_surface_2, Direction=line_sdl)
extrude_3 = Extrude(Base=tail_cutter_surface_2, Direction=line_sdl_2)
solid_difference_2 = SolidDifference(BrepsA=splint_shell_5, BrepsB=extrude_2)
solid_difference_3 = SolidDifference(BrepsA=solid_difference_2, BrepsB=extrude_3)
splint_brep = Brep(solid_difference_3)

# ----
# ID Embossing Gun
wall_thickness_3 = Number(wall_thickness)
distal_phalange_l_mm_3 = Number(distal_phalange_l_mm)
splint_brep_2 = Brep(splint_brep)
middle_phalange_l_mm_3 = Number(middle_phalange_l_mm)
side_projection_angle = Panel("-90")
dip_radius_2 = Number(dip_radius)
splint_shell_6 = Brep(splint_shell)
text_size = Slider(3.3, range=2.5..6)
objectid = Text(factoryautomatorpy.objectID)
object_text_py = Python3Script(breps=splint_brep_2, objectId=objectid)  # -> out, textOutput; inputs breps: list of Brep, objectId: String
# ---------- object_text_py: Python ----------
"""Grasshopper Script"""
a = "Hello Python 3 in Grasshopper!"
print(a)

brepCount = 0
if breps is not None:
    brepCount = len(breps)


if brepCount <= 1:
    textOutput = f"-\n{objectId}"
else:
    textOutput = [f"{i}\n{objectId}" for i in range(1, brepCount + 1)]

print(f"{textOutput=}")
# ---------- end object_text_py ----------
unit_y = UnitY(Factor=1)
unit_z = UnitZ(Factor=1)
yz_plane_2 = YZPlane(Origin=Point(0, 0, 0))
box_center_slice_py = Python3Script(target_brep=splint_brep_2, view_vector=unit_y)  # -> out, slice_surface; inputs target_brep: Brep, view_vector: Vector3d
# ---------- box_center_slice_py: Python ----------
# This file represents a stub for a GhPython component in Grasshopper.
# It sets up the environment to import and use the splintcommon or other external modules.

from pathlib import Path
import sys
from importlib import reload #FOR DEV
import time

# In normal GH doc
ghFileDir = None
try:
    ghFileDir = str(Path.joinpath(Path(ghenv.Component.OnPingDocument().FilePath).resolve().parents[0], "src"))
except:
    # In GH Cluster
    ghFileDir = str(Path.joinpath(Path(ghenv.Component.OnPingDocument().Owner.OnPingDocument().FilePath).resolve().parents[0], "src"))

print(f"{ghFileDir=}")

if ghFileDir not in sys.path:
    print("ghFileDir needed to be included")
    sys.path.append(ghFileDir)

import splintcommon
reload(splintcommon) #FOR DEV

#splintcommon module is now available for use in this GhPython component
splintcommon.log(f'GhPython Node initialized at {time.ctime()}')

import FeatureIdentification
reload(FeatureIdentification) #FOR DEV
from FeatureIdentification import box_center_slice

import Rhino.Geometry as rg

# Get a slice plane at the center, facing +Y direction
slice_surface = box_center_slice(
    target_brep=target_brep,
    bbox_plane=rg.Plane.WorldXY,
    choose_side_vector=view_vector
)
# ---------- end box_center_slice_py ----------
side_projection_angle_2 = Number(side_projection_angle)
bounding_box = BoundingBox(Content=splint_brep_2, Plane=PlaneXY(0, 0, 0))  # -> Box, Box_2
objectid_w_index_text = Text(reverse(objectid))
rotate = Rotate(Geometry=unit_y, Angle=degrees(side_projection_angle_2), Plane=yz_plane_2)  # -> Geometry, Transform
intersection_z_offset = Panel("1.25")
volume = Volume(Geometry=bounding_box.Box)  # -> Volume, Centroid
transform_3 = Transform(Geometry=unit_z, Transform=rotate.Transform)
negative = Negative(Value=dip_radius_2)
intersection_x_offset = Panel("0.5")
added_rotation = Panel("90")
multiplication_6 = Multiplication(A=negative, B=intersection_z_offset)
multiplication_7 = Multiplication(A=middle_phalange_l_mm_3, B=intersection_x_offset)
addition_8 = Addition(A=side_projection_angle, B=added_rotation)
unit_z_2 = UnitZ(Factor=multiplication_6)
line_sdl_3 = LineSDL(Start=volume.Centroid, Direction=rotate.Geometry, Length=Slider(4, range=0..10))
centroid = Point(volume.Centroid)
unit_x_4 = UnitX(Factor=multiplication_7)
unit_z_3 = UnitZ(Factor=multiplication_7)
vizvector = Arrow(start=volume.Centroid, direction=transform_3, arrowlen="4", text="up")  # -> cone_2, line, annotation_dot_2
vizvector_2 = Arrow(start=volume.Centroid, direction=rotate.Geometry, arrowlen="4", text="proj")  # -> cone_2, line, annotation_dot_2
unit_z_4 = UnitZ(Factor=1)
unit_y_2 = UnitY(Factor=1)
yz_plane_3 = YZPlane(Origin=centroid)
move_5 = Move(Geometry=box_center_slice_py.slice_surface, Motion=unit_x_4)  # -> Geometry, Transform
move_6 = Move(Geometry=move_5.Geometry, Motion=unit_z_2)  # -> Geometry, Transform
tip = Brep(vizvector.cone_2)
line_4 = Line(vizvector.line)
annotation_dot = AnnotationDot(vizvector.annotation_dot_2)
rotate_2 = Rotate(Geometry=move_6.Geometry, Angle=degrees(addition_8), Plane=yz_plane_3)  # -> Geometry, Transform
transform_4 = Transform(Geometry=unit_z_4, Transform=rotate_2.Transform)
transform_5 = Transform(Geometry=unit_y_2, Transform=rotate_2.Transform)
box_center_slice_py_2 = Python3Script(target_brep=splint_brep_2, slice_surface=rotate_2.Geometry, view_direction=transform_5, up_vector=transform_4)  # -> out, result_curves, result_points; inputs target_brep: Brep, slice_surface: Surface, view_direction: Vector3d, up_vector: Vector3d
# ---------- box_center_slice_py_2: Python ----------
# This file represents a stub for a GhPython component in Grasshopper.
# It sets up the environment to import and use the splintcommon or other external modules.

from pathlib import Path
import sys
from importlib import reload #FOR DEV
import time

# In normal GH doc
ghFileDir = None
try:
    ghFileDir = str(Path.joinpath(Path(ghenv.Component.OnPingDocument().FilePath).resolve().parents[0], "src"))
except:
    # In GH Cluster
    ghFileDir = str(Path.joinpath(Path(ghenv.Component.OnPingDocument().Owner.OnPingDocument().FilePath).resolve().parents[0], "src"))

print(f"{ghFileDir=}")

if ghFileDir not in sys.path:
    print("ghFileDir needed to be included")
    sys.path.append(ghFileDir)

import splintcommon
reload(splintcommon) #FOR DEV

#splintcommon module is now available for use in this GhPython component
splintcommon.log(f'GhPython Node initialized at {time.ctime()}')

import FeatureIdentification
reload(FeatureIdentification) #FOR DEV
from FeatureIdentification import intersect_with_reference

import Rhino.Geometry as rg

result_curves, result_points = intersect_with_reference(
    target_brep = target_brep, 
    slice_surface = slice_surface, 
    view_direction = view_direction, 
    up_vector=up_vector
)
# ---------- end box_center_slice_py_2 ----------
join_curves = JoinCurves(Curves=box_center_slice_py_2.result_curves, Preserve=False)  # -> flatten(Curves)
close_curve = CloseCurve(Curve=join_curves, Tolerance=0)
centroid_2 = Point(volume.Centroid)
area_3 = Area(Geometry=close_curve)  # -> Area, Centroid
deconstruct = Deconstruct(Point=area_3.Centroid)  # -> XComponent, YComponent, ZComponent
deconstruct_2 = Deconstruct(Point=centroid_2)  # -> XComponent, YComponent, ZComponent
panel_10 = Panel("-50, 0, 0")  # disabled
construct_point = ConstructPoint(XCoordinate=deconstruct.XComponent, YCoordinate=deconstruct_2.YComponent, ZCoordinate=deconstruct_2.ZComponent)
textgun_py = Python3Script(
    splint_brep=splint_brep_2,
    object_id=objectid_w_index_text,
    text_up_vector=transform_3,
    wall_thickness_mm=wall_thickness_3,
    text_size=text_size,
    text_projection_vector=rotate.Geometry,
    extrusion_depth_factor="0.5",
    projection_origin=construct_point,
    x=Toggle(False))  # -> out, embossedBrep, originalTextBreps, final_text_plane, projected_letters, text_protection; inputs splint_brep: Brep, object_id: String, text_up_vector: Vector3d, text_size: Double, text_projection_vector: Vector3d, extrusion_depth_factor: Double, projection_origin: Point3d
# ---------- textgun_py: Python ----------
# This file represents a stub for a GhPython component in Grasshopper.
# It sets up the environment to import and use the splintcommon or other external modules.

from pathlib import Path
import sys
from importlib import reload #FOR DEV ONLY
import time

# In normal GH doc
ghFileDir = None
try:
    ghFileDir = str(Path.joinpath(Path(ghenv.Component.OnPingDocument().FilePath).resolve().parents[0], "src"))
except:
    # In GH Cluster
    ghFileDir = str(Path.joinpath(Path(ghenv.Component.OnPingDocument().Owner.OnPingDocument().FilePath).resolve().parents[0], "src"))

print(f"{ghFileDir=}")

if ghFileDir not in sys.path:
    print("ghFileDir needed to be included")
    sys.path.append(ghFileDir)

import splintcommon
reload(splintcommon) #FOR DEV

#splintcommon module is now available for use in this GhPython component
splintcommon.log(f'GhPython Node initialized at {time.ctime()}')

import TextGun
reload(TextGun) #FOR DEV
from TextGun import emboss_text_with_protection

embossedBrep, originalTextBreps, projected_letters, final_text_plane, text_protection = emboss_text_with_protection(
    target_brep=splint_brep,
    text_content=object_id,
    wall_thickness_mm=wall_thickness_mm,
    text_size=text_size,
    text_up_vector=text_up_vector,
    text_projection_vector=text_projection_vector,
    extrusion_depth_factor=extrusion_depth_factor,
    projection_origin=projection_origin,
    emboss_inside=True
)
# ---------- end textgun_py ----------
plane = Plane(textgun_py.final_text_plane)
vizplane = VizPlane(plane=plane)  # -> tip_2, line_2, annotation_dot_2
brep = Brep(textgun_py.originalTextBreps)
plane_2 = Plane(textgun_py.final_text_plane)
tip_2 = Brep(vizplane.tip_2)
line_5 = Line(vizplane.line_2)
annotation_dot_2 = AnnotationDot(vizplane.annotation_dot_2)
splint_with_embossed_id = Brep(textgun_py.embossedBrep)
entwine = Entwine(
    Branch00=splint_brep_2,
    Branch01=splint_with_embossed_id,
    Branch02=rotate_2.Geometry,
    Branch03=area_3.Centroid,
    Branch04=construct_point,
    FlattenInputs=True)  # disabled
cluster = Cluster(base_move_vector=panel_10, geo_data=entwine)  # -> geometry, out; disabled
splint_with_embossed_id_2 = Brep(textgun_py.embossedBrep)
text_protection_curves = Curve(textgun_py.text_protection)

# ----
# Ventilate
tip_cutter_surface_3 = Brep(distal_2d_extrude)
text_protection_curves_2 = Curve(text_protection_curves)
splint_w_id = Brep(splint_with_embossed_id_2)
tail_cutter_surface_3 = Brep(mid_2d_extrude)
splint_shell_7 = Brep(splint_shell)
brep_brep = BrepBrep(BrepA=splint_shell_7, BrepB=tip_cutter_surface_3)  # -> Curves, Points
brep_brep_2 = BrepBrep(BrepA=splint_shell_7, BrepB=tail_cutter_surface_3)  # -> Curves, Points
merge_3 = Merge(Data1=brep_brep.Curves, Data2=brep_brep_2.Curves, Data3=text_protection_curves_2)  # -> flatten(Result)
protected_curves = Curve(merge_3)
splint_centerline_2 = Curve(splint_centerline)
brepventilation_py_2 = Python3Script(input_brep=splint_w_id, brep_centerline=splint_centerline_2, protected_curves=protected_curves)  # -> out, result; inputs input_brep: Brep, brep_centerline: Polyline, protected_curves: list of Curve
# ---------- brepventilation_py_2: Python ----------
# This file represents a stub for a GhPython component in Grasshopper.
# It sets up the environment to import and use the splintcommon or other external modules.

from pathlib import Path
import sys
from importlib import reload #FOR DEV
import time

# Walk up through nested clusters to find the root GH document (necessary for use in nested clusters)
doc = ghenv.Component.OnPingDocument()
while not doc.FilePath and doc.Owner:
    doc = doc.Owner.OnPingDocument()
ghFileDir = str(Path(doc.FilePath).resolve().parent / "src")

print(f"{ghFileDir=}")

if ghFileDir not in sys.path:
    print("ghFileDir needed to be included")
    sys.path.append(ghFileDir)

import splintcommon
reload(splintcommon) #FOR DEV

splintcommon.log(f'BrepVentilation Node initialized at {time.ctime()}')

# -- Build a finger model and hollow shell for testing ventilation --

import BrepVentilation
reload(BrepVentilation)
from BrepVentilation import ventilate_brep


# Protected curves: open ends of the splint
protected = []

splintcommon.log(f"Protected curves: {len(protected_curves)}")

# Ventilate
# ventilated_result, hole_count = ventilate_brep(
#     input_brep=input_brep,
#     centerline=brep_centerline,
#     hole_radius=1.5,
#     clearance_radius=2.5,
#     protected_curves=protected_curves,
#     strategy="helical",
#     spacing_along=0.5,
#     angular_step=2, #137.5,
#     angles_per_station = 14
# )


ventilated_result, hole_count = ventilate_brep(
    input_brep, brep_centerline,
    hole_radius=1.5, clearance_radius=2.2,
    protected_curves=protected_curves,
    strategy="random",
    max_holes=40, max_attempts=1000,
    seed=22
)

splintcommon.log(f"Ventilation complete: {hole_count} holes")

# Outputs for Grasshopper preview
result = ventilated_result         # ventilated splint brep
# ---------- end brepventilation_py_2 ----------
ventilated_brep = Brep(brepventilation_py_2.result)

mid_cut_line = Line(mid_line)

# ----
# Orienting To Build Plate
# Tip Slant Line, describes the angle necessary to bring the front cut line of the splint down to the build platform.
finishedsplint = Brep(ventilated_brep)
xz = XZPlane(Origin=Point(0, 0, 0))
X = UnitX(Factor=1)
end = EndPoints(Curve=mid_cut_line)  # -> Start, End
pt = Point(end.Start)
pt_2 = Point(end.End)
angle = Angle(VectorA=mid_cut_line, VectorB=X, Plane=xz)  # -> Angle, Reflex
deconstruct_3 = Deconstruct(Point=pt)  # -> XComponent, YComponent, ZComponent
pl_origin = PlaneOrigin(Base=xz, Origin=pt)
rotate_3 = Rotate(Geometry=finishedsplint, Angle=angle.Angle, Plane=pl_origin)  # -> Geometry, Transform
negative_2 = Negative(Value=deconstruct_3.ZComponent)
unit_z_5 = UnitZ(Factor=negative_2)
move_7 = Move(Geometry=rotate_3.Geometry, Motion=unit_z_5)  # -> Geometry, Transform
orientedsplint = Brep(move_7.Geometry)

panel_11 = Panel(brepventilation_py_2.out)

# ----
# Final Joining
# And Smoothing
number_slider = Slider(0.12, range=0.05..0.2)
orientedsplint_2 = Brep(orientedsplint)
shrinkwrap = ShrinkWrap(
    Geometry=orientedsplint_2,
    EdgeLength=number_slider,
    Offset=0,
    Smoothing=Slider(8, range=0..10),
    Optimization=10,
    FillHoles=True)
final_smooth_splint = Mesh(shrinkwrap)

mid_cutting_surface = Surface(tail_cutter_surface)
distal_cutting_surface = Surface(tip_cutter_surface)
savemeshpy = Python3Script(
    geo_input=final_smooth_splint,
    output_file_dir=output_dir_out,
    jobname=root_filename_out,
    bool_activate=dev_activate_toggle)  # -> out; inputs geo_input: Mesh
# ---------- savemeshpy: Python ----------
# See: https://discourse.mcneel.com/t/how-to-optimise-ghpython-obj-export/87598/76

# Start standard gh python imports
from pathlib import Path
import sys
from importlib import reload #FOR DEV ONLY

ghFileDir = str(Path.joinpath(Path(ghenv.Component.OnPingDocument().FilePath).resolve().parents[0], "src"))
if ghFileDir not in sys.path:
    print("ghFileDir needed to be included")
    sys.path.append(ghFileDir)
import splintcommon
reload(splintcommon)
# End standard gh python imports

import time
splintcommon.log(f'Save Mesh Running at: ({time.strftime("%H:%M:%S", time.localtime())})')

import scriptcontext as sc
# import rhinoscriptsyntax as rs
import System
import Rhino
import random
import string
import os
import traceback

def add_layer(layer_name=None, layer_color=None):
    """Adds a new layer to the active Rhino document.
    
    Args:
      layer_name (str): An optional layer name.
      layer_color (System.Drawing.Color): An optional layer color.
    Returns:
      The index of the new layer.
    """
    sc.doc = Rhino.RhinoDoc.ActiveDoc
    if layer_name != None:
        # Check whether the layer name is valid
        if not Rhino.DocObjects.Layer.IsValidName(layer_name):
            raise ValueError("{} is not a valid layer name."\
                .format(layer_name))
        # Check whether a layer with the same name already exists
        layer_index = sc.doc.Layers.Find(layer_name, True)
        if layer_index >= 0:
            raise ValueError("A layer with the name {} already exists."\
                .format(layer_name))
    else:
        layer_name = sc.doc.Layers.GetUnusedLayerName(False)
    
    # Check whether the layer color is valid
    if layer_color != None:
        if not isinstance(layer_color, System.Drawing.Color):
            raise ValueError("{} is not a valid layer color."\
                .format(layer_color))
    else:
        layer_color = System.Drawing.Color.Black # default layer color
    
    # Add a new layer to the active document
    layer_index = sc.doc.Layers.Add(layer_name, layer_color)
    if layer_index < 0:
        raise ValueError("Unable to add layer {} to document."\
            .format(layer_name))
    return layer_index
    

def delete_layer(layer):
    """Deletes an existing layer from the active Rhino document. 
    The layer to be removed cannot be the current layer and 
    it will be deleted even if it contains objects.
    
    Args:
      layer (str\id): A name or id of an existing layer.
    Returns:
      True or False, indicating success or failure.
    """
    sc.doc = Rhino.RhinoDoc.ActiveDoc
    layer_index = sc.doc.Layers.Find(layer, True)
    if layer_index < 0:
        raise ValueError("The layer {} does not exist.".format(layer))
    rc = sc.doc.Layers.Purge(layer_index, True)
    sc.doc.Views.Redraw()
    return rc
    

def bake_mesh(layer, mesh, mesh_name=None):
    """Bakes a mesh object to the active Rhino document.
    
    Args:
      layer (str\id): The name or id of an existing layer.
      mesh (Rhino.Geometry.Mesh): A mesh object to bake.
      mesh_name (str): An optional mesh object name.
    Returns:
      The GUID of the baked mesh.
    """

    splintcommon.log(f"mesh type:{type(mesh)}")
    # mesh = rs.coercemesh(mesh)
    # splintcommon.log(f"mesh type:{type(mesh)}")

    sc.doc = Rhino.RhinoDoc.ActiveDoc
    # Check whether the mesh is a mesh object
    if mesh.ObjectType != Rhino.DocObjects.ObjectType.Mesh:
        raise ValueError("{} is not a mesh.".format(mesh))
    # Create the mesh object attributes
    attr = Rhino.DocObjects.ObjectAttributes()
    # Set the mesh object layer index attribute
    layer_index = sc.doc.Layers.Find(layer, True)
    if layer_index < 0:
        if layer == "Default":
            raise ValueError("The layer {} can't be baked to.".format(layer))
        else:
            raise ValueError("The layer {} does not exist.".format(layer))    
    else:
        attr.LayerIndex = layer_index
    # Set the mesh object name attribute
    if mesh_name != None:
        attr.Name = mesh_name
    # Bake the mesh to the active Rhino documemnt
    mesh_id = sc.doc.Objects.AddMesh(mesh, attr)
    return mesh_id

def get_obj_settings():
    splintcommon.log("Using OBJ mesh settings")
    """Returns the settings for the OBJ export command as a string."""
    # Formatting options
    cfg = "_Geometry=_Mesh "
    cfg += "_EndOfLine=CRLF "
    cfg += "_ExportRhinoObjectNames=_ExportObjectsAsOBJGroups "
    cfg += "_ExportMeshTextureCoordinates=_Yes "
    cfg += "_ExportMeshVertexNormals=_Yes "
    cfg += "_ExportMeshVertexColors=_Yes "
    cfg += "_CreateNGons=_No "
    cfg += "_ExportMaterialDefinitions=_No "
    cfg += "_YUp=_Yes "
    cfg += "_WrapLongLines=_No "
    cfg += "_VertexWelding=_Unmodified "
    cfg += "_WritePrecision=4 "
    cfg += "_Enter "
    # Detailed options
    cfg += "_DetailedOptions "
    cfg += "_JaggedSeams=_No "
    cfg += "_PackTextures=_No "
    cfg += "_Refine=_No "
    cfg += "_SimplePlane=_No "
    # Advanced options
    cfg += "_AdvancedOptions "
    cfg += "_Angle=0 "
    cfg += "_AspectRatio=0 "
    cfg += "_Distance=0.0 "
    cfg += "_Density=0.5 "
    cfg += "_Grid=0 "
    cfg += "_MaxEdgeLength=0 "
    cfg += "_MinEdgeLength=0.0001 "
    cfg += "_Enter _Enter" # remove the last _Enter to check if density is set
    return cfg, "obj"

def get_stl_settings_default():
    #[ANGLE,ASPECT RATIO,MAX DIST TO SRF,GRID,DENSITY,MAX EDGE LEN,MIN EDGE LEN]
    #Change list below as needed
    setting_list=[15,0,0.01,16,0,0,0.001]   
    return get_stl_settings(*setting_list)

def get_stl_settings(ang,ar,dist,grid,den,maxL=0,minL=.0001):
    splintcommon.log("Using STL mesh settings")
    e_str = "_ExportFileAs=_Binary "
    e_str+= "_ExportUnfinishedObjects=_Yes "
    e_str+= "_UseSimpleDialog=_No "
    e_str+= "_Enter _DetailedOptions "
    e_str+= "_JaggedSeams=_No "
    e_str+= "_PackTextures=_No "
    e_str+= "_Refine=_Yes "
    e_str+= "_SimplePlane=_Yes "
    # e_str+= "_AdvancedOptions "
    # e_str+= "_Angle={} ".format(ang)
    # e_str+= "_AspectRatio={} ".format(ar)
    # e_str+= "_Distance={} ".format(dist)
    # e_str+= "_Density={} ".format(den)
    # e_str+= "_Grid={} ".format(grid)
    # e_str+= "_MaxEdgeLength={} ".format(maxL)
    # e_str+= "_MinEdgeLength={} ".format(minL)
    e_str+= "_Enter _Enter"
    return e_str, "stl"

def export_mesh_files(meshes, path, filename, debug=False, asObj=True):
    """Exports a collection of meshes to an OBJ file.
    
    Args:
      meshes (list): A list of Rhino.Geometry.Mesh objects.
      path (str): An absolute path pointing to a directory.
      filename (str): A filename (without extension).
      debug (bool): Optional True to print debug information.
    Returns:
      True or False, indicating success or failure.
    """

    sc.doc = Rhino.RhinoDoc.ActiveDoc
    sc.doc.Views.RedrawEnabled = True # JG - False
    if debug: 
        now = time.process_time()
        elapsed = 0.0
        
    # Create a temporary layer
    splintcommon.log(f"export_mesh_files: Creating temp layer")
    layer = "".join(random.choice(string.ascii_uppercase) for _ in range(9))
    layer_index = add_layer(layer)
    if debug: 
        then, now = now, time.process_time()
        elapsed += now - then
        splintcommon.log("Creating temporary layer: {0:.4f} seconds".format(now-then))
        
    # Bake the temporary mesh(es)
    splintcommon.log(f"export_mesh_files: Baking temp mesh(es)")
    mesh_ids = [bake_mesh(layer, mesh) for mesh in meshes]
    if debug: 
        then, now = now, time.process_time()
        elapsed += now - then
        splintcommon.log("Creating temporary mesh(es): {0:.4f} seconds".format(now-then))
    
    # Unselect all objects in the scene
    sc.doc.Objects.UnselectAll()
    # Select the baked mesh object(s)
    for mid in mesh_ids:
        sc.doc.Objects.Select(mid)
    if debug: 
        then, now = now, time.process_time()
        elapsed += now - then
        splintcommon.log("Unselecting and selecting: {0:.4f} seconds".format(now-then))
    
    # Export the selected mesh object(s) to mesh file
    splintcommon.log(f"export_mesh_files: exporting to file")
    export_config, export_extension = get_obj_settings() if asObj else get_stl_settings_default()
    export_fname = "{}.{}".format(filename, export_extension)
    export_fpath = Path(os.path.join(path, export_fname))
    splintcommon.log(f"export_mesh_files: Export Values: {export_fname=} {export_fpath=}")
    
    if export_fpath.exists():
        splintcommon.log(f"export_mesh_files: REMOVING EXISTING MESH FILE: {export_fpath}")
        export_fpath.unlink()
        time.sleep(1.0)
        splintcommon.log(f"export_mesh_files: testing... MeshStillExists:{export_fpath.exists()}")

    splintcommon.log(f"export_mesh_files: exporting to file")

    cmd = '_-Export _Pause "{}" {} _Enter'.format(export_fpath, export_config) # _Enter
    # see: https://discourse.mcneel.com/t/export-command-line-options/87537/5
    splintcommon.log(f"export_mesh_files: RUNNING cmd: '{cmd}'")
    
    #start = Rhino.DocObjects.RhinoObject.NextRuntimeSerialNumber
    rc = Rhino.RhinoApp.RunScript(cmd, True)

    splintcommon.log(f"export_mesh_files: Completion {rc=}")

    #end = Rhino.DocObjects.RhinoObject.NextRuntimeSerialNumber
    #global __command_serial_numbers
    #__command_serial_numbers = None
    #if start != end:
        #__command_serial_numbers = (start, end)
    
    if debug: 
        then, now = now, time.process_time()
        elapsed += now - then
        splintcommon.log("Exporting Mesh Result: {0:.4f} seconds result={1}".format(now-then, rc))
    
    # Delete the temporary layer and meshes
    splintcommon.log(f"export_mesh_files: cleaning up temp layer")
    delete_layer(layer)
    
    if debug: 
        then, now = now, time.process_time()
        elapsed += now - then
        splintcommon.log("Cleaning up: {0:.4f} seconds\n".format(now-then))
        splintcommon.log("Total elapsed: {0:.4f} seconds".format(elapsed))

    sc.doc.Views.RedrawEnabled = True

    splintcommon.log(f"export_mesh_files: Returning result: {rc=}")

    return rc

def saveMeshToFile(inputMesh, directory, rootFilename):
    try:
        splintcommon.log(f"inputMesh type: {inputMesh}")
        splintcommon.log(f"{directory=}")
        splintcommon.log(f"{rootFilename=}")
        
        if inputMesh is None or directory is None or rootFilename is None:        
            raise ValueError("Missing required inputs for saving file")

        #TODO, Validate the path more completely
        if "." in directory or "." in rootFilename:
            raise ValueError(f"Path must not contain dot character: {directory}")

        result = export_mesh_files([inputMesh], directory, rootFilename, True, False)

        if not result:
            raise ValueError(f"FAIL: mesh export failed. {result=}")
        else:
            splintcommon.log(f'SUCCESS: Saved to {rootFilename} in {directory}')
            splintcommon.confirm_job_is_processed_and_exit(jobname, True, "mesh exported normally")

    except Exception as e:
        errMsg = f"Exception: {traceback.format_exc()}"
        splintcommon.log(errMsg)
        splintcommon.confirm_job_is_processed_and_exit(jobname, False, errMsg)

if geo_input is None:
    message = f"No mesh input To Process {geo_input=} {output_file_dir=} {jobname=}"
    splintcommon.log(message)
    splintcommon.confirm_job_is_processed_and_exit(jobname, False, message)
else:
    splintcommon.log(f"Mesh is present. {output_file_dir=} {jobname=}")
    saveMeshToFile(geo_input, output_file_dir, jobname)
# ---------- end savemeshpy ----------
panel_12 = Panel(savemeshpy)

# ----
# ID Gun
objectid_2 = Text(factoryautomatorpy.objectID)
splint_brep_3 = Brep(splint_brep)
wall_thickness_4 = Number(wall_thickness)
text_size_2 = Slider(3.3, range=2.5..6)
xz_plane = XZPlane(Origin=Point(0, 0, 0))
to = Volume(Geometry=splint_brep_3)  # -> Volume, Centroid
bb_text = BBText(Location=xz_plane, Text=objectid_2, Size=text_size_2, Bold=Toggle(True), HorizontalAlignment=0, VerticalAlignment=0)
bounding_box_2 = BoundingBox(Content=bb_text, Plane=PlaneXY(0, 0, 0), UnionBox=True)  # -> Box, Box_2
from = Volume(Geometry=bounding_box_2.Box)  # -> Volume, Centroid
line_6 = Line(StartPoint=from.Centroid, EndPoint=to.Centroid)
side_projection_angle_3 = Slider(-28, range=-90..90)
boundary_surfaces_2 = BoundarySurfaces(Edges=bb_text)
unit_y_3 = UnitY(Factor=1)
yz_plane_4 = YZPlane(Origin=Point(0, 0, 0))
move_8 = Move(Geometry=boundary_surfaces_2, Motion=line_6)  # -> Geometry, Transform
rotate_4 = Rotate(Geometry=unit_y_3, Angle=degrees(side_projection_angle_3), Plane=yz_plane_4)  # -> Geometry, Transform
transform_6 = Transform(Geometry=move_8.Geometry, Transform=rotate_4.Transform)  # -> flatten(Geometry)
finishedsplintbrep = Brep(splint_brep_3)
area_4 = Area(Geometry=transform_6)  # -> Area, Centroid
text_projection_vector = Vector(rotate_4.Geometry)
vector_display = VectorDisplay(Anchor=to.Centroid, Vector=text_projection_vector)
wall_thickness_5 = Number(wall_thickness_4)
project_point = ProjectPoint(Point=area_4.Centroid, Direction=text_projection_vector, Geometry=finishedsplintbrep)  # -> Point, Index
multiplication_8 = Multiplication(A=text_projection_vector, B=wall_thickness_5, C="0.8")

extrude_4 = Extrude(Base=transform_6, Direction=multiplication_8)  # -> flatten(Extrusion)
volume_2 = Volume(Geometry=extrude_4)  # -> Volume, Centroid
line_7 = Line(StartPoint=volume_2.Centroid, EndPoint=project_point.Point)

move_to_point = MoveToPoint(Geometry=extrude_4, PointA=volume_2.Centroid, PointB=project_point.Point)  # -> Moved, Vector, Transform
solid_difference_4 = SolidDifference(BrepsA=finishedsplintbrep, BrepsB=move_to_point.Moved)
splint_w_id_2 = Brep(solid_difference_4)

# ----
# Preview Steps
preview_points_2 = Point(preview_points)
inner_finger_form = Brep(finger_analog_2)
preform_barrel = Brep(splint_shell_3)
splint_body_smooth = Mesh(final_smooth_splint)
splint_brep_4 = Brep(splint_brep)
orientedsplint_3 = Brep(orientedsplint)
merge_4 = Merge(Data1=preform_barrel, Data2=distal_cutting_surface, Data3=mid_cutting_surface, Data4=preview_points_2)  # -> flatten(Result)
merge_5 = Merge(Data1=splint_brep_4)  # -> flatten(Result)
merge_6 = Merge(Data1=splint_body_smooth)  # -> flatten(Result)
merge_7 = Merge(Data1=orientedsplint_3)  # -> flatten(Result)
move_9 = Move(Geometry=merge_4, Motion="140, 0, 0")  # -> Geometry, Transform
move_10 = Move(Geometry=merge_5, Motion="220, 0, 0")  # -> Geometry, Transform
move_11 = Move(Geometry=merge_6, Motion="340, 0, 0")  # -> Geometry, Transform
move_12 = Move(Geometry=merge_7, Motion="285, 0, 0")  # -> Geometry, Transform

merge_8 = Merge(Data1=inner_finger_form)  # -> flatten(Result)

move_13 = Move(Geometry=merge_8, Motion="80, 0, 0")  # -> Geometry, Transform
merge_9 = Merge(Data1=move_13.Geometry, Data2=move_9.Geometry, Data3=move_10.Geometry, Data4=move_12.Geometry, Data5=move_11.Geometry)  # -> flatten(Result)
random_color = RandomColor(Data=merge_9, Seed=2, FastMode=False)
custom_preview = CustomPreview(Geometry=merge_9, Material=random_color)

# ==== cluster ItemInDirectionCL
selection_direction_v = ClusterInput()
input_geometries = ClusterInput()
input_geometries_2 = Geometry(input_geometries)
selection_direction_v_2 = Vector(selection_direction_v)
bounding_box = BoundingBox(Content=input_geometries_2, Plane=PlaneXY(0, 0, 0), UnionBox=True)  # -> Box, Box_2
bounding_box_2 = BoundingBox(Content=input_geometries_2, Plane=PlaneXY(0, 0, 0))  # -> Box, Box_2
volume = Volume(Geometry=bounding_box.Box)  # -> Volume, Centroid
line_sdl = LineSDL(Start=volume.Centroid, Direction=selection_direction_v_2, Length="1")
volume_2 = Volume(Geometry=bounding_box_2.Box)  # -> Volume, Centroid
sort_along_curve = SortAlongCurve(Points=volume_2.Centroid, Curve=line_sdl)  # -> Points, Indices
list_item = ListItem(List=sort_along_curve.Indices, Index="-1", Wrap=True)
list_item_2 = ListItem(List=input_geometries_2, Index=list_item, Wrap=True)
output_geometry = Geometry(list_item_2)
output_geometry_2 = ClusterOutput(output_geometry)

# ==== cluster FingerCL
flexion_degrees = ClusterInput()
radius_tip = ClusterInput()
radius_mid = ClusterInput()
radius_dip = ClusterInput()
radius_pip = ClusterInput()
l_middle = ClusterInput()
l_distal = ClusterInput()
intersection_nudge = Panel("0.05")
intersection_nudge_2 = Panel("-0.05")
intersection_nudge_3 = Panel("0.05")
rebuild = Panel("16")
unit_x = UnitX(Factor="-1")
number_slider = Slider(0, range=0..2)  # disabled

# ----
# Skeleton Geometry
# Note: Subtraction is necessary because the distal length includes the tip radius
flexion_degrees_2 = Number(flexion_degrees)
radius_tip_2 = Number(radius_tip)
radius_mid_2 = Number(radius_mid)
radius_dip_2 = Number(radius_dip)
radius_pip_2 = Number(radius_pip)
unit_x_2 = UnitX(Factor=1)
l_middle_2 = Number(l_middle)
l_distal_2 = Number(l_distal)
xz_plane = XZPlane(Origin=Point(0, 0, 0))
mid_line = LineSDL(Start=xz_plane, Direction=unit_x_2, Length=l_middle_2)
# NOTE: Intersection Nudging: We will attempt to taper each next section to be slightly smaller at the begginning to join the segments
end_points = EndPoints(Curve=mid_line)  # -> Start, End
distal_core_len = Subtraction(A=l_distal_2, B=radius_tip_2)
r_minus = Subtraction(A=radius_dip_2, B=intersection_nudge)
dip_sph = Sphere(Base=end_points.End, Radius=r_minus)
mid_line_2 = Line(mid_line)
_0_mid_frame = PerpFrame(Curve=mid_line_2, Parameter="0.5")
_0_mid_frame_2 = PerpFrame(Curve=mid_line_2, Parameter="0")
_1_mid_frame = PerpFrame(Curve=mid_line_2, Parameter="1")
circle_cnr = CircleCNR(Center=_0_mid_frame, Normal=_0_mid_frame, Radius=radius_mid_2)

multiplication = Multiplication(A=flexion_degrees_2, B="-1")
pip_sph = Sphere(Base=end_points.Start, Radius=radius_pip_2)
dip_sph_2 = Sphere(Base=end_points.End, Radius=radius_dip_2)

rotate = Rotate(Geometry=unit_x_2, Angle=degrees(multiplication), Plane=xz_plane)  # -> Geometry, Transform
distal_core_line = LineSDL(Start=end_points.End, Direction=rotate.Geometry, Length=distal_core_len)
distal_line = Line(distal_core_line)
_0_distal_frame = PerpFrame(Curve=distal_line, Parameter="0")
pip_hoop_seg0 = BrepPlane(Brep=pip_sph, Plane=_0_mid_frame_2)  # -> Curves, Points
dip_hoop_seg0 = BrepPlane(Brep=dip_sph_2, Plane=_1_mid_frame)  # -> Curves, Points
dip_hoop_seg1 = BrepPlane(Brep=dip_sph, Plane=_0_distal_frame)  # -> Curves, Points
list_item = ListItem(List=dip_hoop_seg0.Curves, Index=0, Wrap=True)
list_item_2 = ListItem(List=pip_hoop_seg0.Curves, Index=0, Wrap=True)
flip_curve = FlipCurve(Curve=circle_cnr, Guide=list_item_2)  # -> Curve, Flag
list_item_3 = ListItem(List=dip_hoop_seg1.Curves, Index=0, Wrap=True)
pip_hoop = Curve(list_item_2)
mid_hoop = Curve(flip_curve.Curve)

radius_mid_3 = Number(radius_mid)
mid_line_3 = Line(mid_line_2)
unit_z = UnitZ(Factor=radius_mid_3)
move = Move(Geometry=mid_line_3, Motion=unit_z)  # -> Geometry, Transform
extend_curve = ExtendCurve(Curve=move.Geometry, Type=0, Start="1000", End="1000")
reparameterize_curve = ReparameterizeCurve(Curve=extend_curve)  # -> Reparameterized, Original
seam_alignment_line = Line(reparameterize_curve.Reparameterized)

distal_core_line_2 = Line(distal_line)
distal_dip_hoop = Curve(list_item_3)
mid_dip_hoop = Curve(list_item)
mid_line_4 = Line(mid_line_2)
dip_sphere = Brep(dip_sph)
dip_sphere_2 = Brep(dip_sphere)
mid_line_5 = ClusterOutput(mid_line_4)
distal_core_line_3 = ClusterOutput(distal_core_line_2)
pip_hoop_2 = ClusterOutput(pip_hoop)
mid_hoop_2 = ClusterOutput(mid_hoop)
dip_sphere_3 = ClusterOutput(dip_sphere_2)
mid_dip_hoop_2 = ClusterOutput(mid_dip_hoop)
distal_dip_hoop_2 = ClusterOutput(distal_dip_hoop)

# ----
# Tip Shaping
tip_taper_percent = Slider(0.7, range=0..1)
tip_angle = Slider(10, range=-20..20)
intersection_nudge_4 = Panel("0.05")
distal_core_line_4 = Line(distal_core_line_2)
radius_tip_3 = Number(radius_tip)
r_minus_2 = Subtraction(A=radius_tip_3, B=intersection_nudge_4)
end_points_2 = EndPoints(Curve=distal_core_line_4)  # -> Start, End
tip_sph = Sphere(Base=end_points_2.End, Radius=r_minus_2)
tip_sphere = Brep(tip_sph)
tip_sphere_2 = Brep(tip_sphere)
brep_line = BrepLine(Brep=tip_sphere_2, Line=distal_core_line_4, LimitToFirst=False)  # -> Curves, Points
list_item_4 = ListItem(List=brep_line.Points, Index="0", Wrap=True)
list_item_5 = ListItem(List=brep_line.Points, Index="1", Wrap=True)
line = Line(StartPoint=list_item_4, EndPoint=list_item_5)
curve_middle = CurveMiddle(Curve=line)
multiplication_2 = Multiplication(A=radius_tip_3, B=tip_taper_percent)
xz_plane_2 = XZPlane(Origin=curve_middle)
flatten_tip = BooleanToggle(True)
rotate_2 = Rotate(Geometry=line, Angle=degrees(tip_angle), Plane=xz_plane_2)  # -> Geometry, Transform
taper = Taper(
    Geometry=tip_sphere_2,
    Axis=rotate_2.Geometry,
    Start=radius_tip_3,
    End=multiplication_2,
    Flat=flatten_tip,
    Infinite=False,
    Rigid=False)
_1_distal_frame = PerpFrame(Curve=distal_core_line_4, Parameter="1")
tip_hoop_seg1 = BrepPlane(Brep=taper, Plane=_1_distal_frame)  # -> Curves, Points

join_curves = JoinCurves(Curves=tip_hoop_seg1.Curves, Preserve=False)

list_item_6 = ListItem(List=join_curves, Index=0, Wrap=True)
offset_curve = OffsetCurve(Curve=list_item_6, Distance="3", Corners=1)
boundary_surfaces = BoundarySurfaces(Edges=offset_curve)
divide_curve = DivideCurve(Curve=offset_curve, Count="16", Kinks=False)  # -> Points, Tangents, Parameters
# Create Blunt Based Tip For Joining
plane_fit = PlaneFit(Points=divide_curve.Points)  # -> Plane, Deviation
deconstruct_plane = DeconstructPlane(Plane=plane_fit.Plane)  # -> Origin, XAxis, YAxis, ZAxis
multiplication_3 = Multiplication(A=deconstruct_plane.ZAxis, B="-0.1")
multiplication_4 = Multiplication(A=deconstruct_plane.ZAxis, B="-30")
move_2 = Move(Geometry=boundary_surfaces, Motion=multiplication_3)  # -> Geometry, Transform
extrude = Extrude(Base=move_2.Geometry, Direction=multiplication_4)
tip_hoop = Curve(list_item_6)
solid_difference = SolidDifference(BrepsA=taper, BrepsB=extrude)
tip_shaped = Brep(solid_difference)

shaped_tip_hoop = Curve(tip_hoop)
tip_shaped_2 = ClusterOutput(tip_shaped)
tip_sphere_3 = ClusterOutput(tip_sphere)
shaped_tip_hoop_2 = ClusterOutput(shaped_tip_hoop)

# ----
# Distal Phalange
distal_dip_hoop_3 = Curve(distal_dip_hoop)
tip_hoop_2 = Curve(tip_hoop)
seam_alignment_line_2 = Line(seam_alignment_line)
offset_curve_2 = OffsetCurve(Curve=distal_dip_hoop_3, Distance=intersection_nudge_2, Corners=1)
distal_dip_hoop_for_phalange = Curve(offset_curve_2)

offset_curve_3 = OffsetCurve(Curve=tip_hoop_2, Distance=intersection_nudge_3, Corners=1)
tip_hoop_for_phalange = Curve(offset_curve_3)

# ----
# Mid Phalange
pip_hoop_3 = Curve(pip_hoop)
mid_dip_hoop_3 = Curve(mid_dip_hoop)
seam_alignment_line_3 = Line(seam_alignment_line)
mid_hoop_3 = Curve(mid_hoop)
merge = Merge(Data1=pip_hoop_3, Data2=mid_hoop_3, Data3=mid_dip_hoop_3)  # -> flatten(Result)
degree = Panel("3")
points = Panel("16")
closed = BooleanToggle(False)
loft_options = LoftOptions(Closed=closed, Adjust=False, Rebuild=rebuild, Refit=0, Type=0)

merge_2 = Merge(Data1=distal_dip_hoop_for_phalange, Data2=tip_hoop_for_phalange)  # -> flatten(Result)
rebuild_curve = RebuildCurve(Curve=merge_2, Count=points, Degree=degree, EndTangents=False)
curve_align_curve_seams = CurveAlignCurveSeams(Curves=rebuild_curve, Guide=seam_alignment_line_2, Snap=False)  # -> Aligned, Points, ResultBoolean
point = Point(curve_align_curve_seams.Points)
loft = Loft(Curves=curve_align_curve_seams.Aligned, Options=loft_options)
cap_holes = CapHoles(Brep=loft)
distal_phalange = Brep(cap_holes)

rebuild_curve_2 = RebuildCurve(Curve=merge, Count=points, Degree=degree, EndTangents=False)

curve_align_curve_seams_2 = CurveAlignCurveSeams(Curves=rebuild_curve_2, Guide=seam_alignment_line_3, Snap=False)  # -> Aligned, Points, ResultBoolean
point_2 = Point(curve_align_curve_seams_2.Points)
loft_2 = Loft(Curves=curve_align_curve_seams_2.Aligned, Options=loft_options)
cap_holes_2 = CapHoles(Brep=loft_2)
mid_phalange = Brep(cap_holes_2)

brep_brep = BrepBrep(BrepA=mid_phalange, BrepB=dip_sphere_2)  # -> Curves, Points
panel = Panel(brep_brep.Curves)
reliable_union_cl = ReliableUnionCL(brep1=distal_phalange, brep2=tip_shaped, seam_alignment_line=seam_alignment_line, join_axis_vector=unit_x)
reliable_union_cl_2 = ReliableUnionCL(brep1=mid_phalange, brep2=dip_sphere_2, seam_alignment_line=seam_alignment_line, join_axis_vector=unit_x)
brep_brep_2 = BrepBrep(BrepA=distal_phalange, BrepB=tip_shaped)  # -> Curves, Points
reliable_union_cl_3 = ReliableUnionCL(brep1=reliable_union_cl_2, brep2=reliable_union_cl, seam_alignment_line=seam_alignment_line, join_axis_vector=unit_x)
panel_2 = Panel(brep_brep_2.Curves)
brep_brep_3 = BrepBrep(BrepA=reliable_union_cl_2, BrepB=reliable_union_cl)  # -> Curves, Points
panel_3 = Panel(brep_brep_3.Curves)
list_item_7 = ListItem(List=reliable_union_cl_3, Index=number_slider, Wrap=True)  # disabled
whole_finger = ClusterOutput(reliable_union_cl_3)

# ==== cluster PTInDir
search_dir_v = ClusterInput()
curve = ClusterInput()
search_dir_v_2 = Vector(search_dir_v)
curve_2 = Curve(curve)
area = Area(Geometry=curve_2)  # -> Area, Centroid
multiplication = Multiplication(A=search_dir_v_2)
move = Move(Geometry=area.Centroid, Motion=multiplication)  # -> Geometry, Transform
curve_closest_point = CurveClosestPoint(Point=move.Geometry, Curve=curve_2)  # -> Point, Parameter, Distance
point = ClusterOutput(curve_closest_point.Point)

# ==== cluster LocatePTOnBrep
end_pt = ClusterInput()
param = ClusterInput()
brep = ClusterInput()
start_pt = ClusterInput()
end_pt_2 = Point(end_pt)
param_2 = Number(param)
brep_2 = Brep(brep)
start_pt_2 = Point(start_pt)
line = Line(StartPoint=start_pt_2, EndPoint=end_pt_2)
reparameterize_curve = ReparameterizeCurve(Curve=line)  # -> Reparameterized, Original
evaluate_curve = EvaluateCurve(Curve=reparameterize_curve.Reparameterized, Parameter=param_2)  # -> Point, Tangent, Angle
brep_closest_point = BrepClosestPoint(Point=evaluate_curve.Point, Brep=brep_2)  # -> Point, Normal, Distance
point = ClusterOutput(brep_closest_point.Point)

# ==== cluster PTInDirBrep
search_dir_v = ClusterInput()
brep = ClusterInput()
search_dir_v_2 = Vector(search_dir_v)
brep_2 = Brep(brep)
volume = Volume(Geometry=brep_2)  # -> Volume, Centroid
line_sdl = LineSDL(Start=volume.Centroid, Direction=search_dir_v_2, Length="1000")
end_points = EndPoints(Curve=line_sdl)  # -> Start, End
brep_closest_point = BrepClosestPoint(Point=end_points.End, Brep=brep_2)  # -> Point, Normal, Distance
point = ClusterOutput(brep_closest_point.Point)

# ==== cluster VizPlane
plane = ClusterInput()
deconstruct_plane = DeconstructPlane(Plane=plane)  # -> Origin, XAxis, YAxis, ZAxis
arrow = Arrow(start=deconstruct_plane.Origin, direction=deconstruct_plane.XAxis, arrowlen="3", text="X")  # -> cone_2, line, annotation_dot_2
arrow_2 = Arrow(start=deconstruct_plane.Origin, direction=deconstruct_plane.YAxis, arrowlen="3", text="Y")  # -> cone_2, line, annotation_dot_2
arrow_3 = Arrow(start=deconstruct_plane.Origin, direction=deconstruct_plane.ZAxis, arrowlen="3", text="Z")  # -> cone_2, line, annotation_dot_2
tip = Brep([arrow.cone_2, arrow_2.cone_2, arrow_3.cone_2])
line = Line([arrow.line, arrow_2.line, arrow_3.line])
annotation_dot = AnnotationDot([arrow.annotation_dot_2, arrow_2.annotation_dot_2, arrow_3.annotation_dot_2])
tip_2 = ClusterOutput(tip)
line_2 = ClusterOutput(line)
annotation_dot_2 = ClusterOutput(annotation_dot)

# ==== cluster Cluster
base_move_vector = ClusterInput()
geo_data = ClusterInput()
base_move_vector_2 = Vector(base_move_vector)
geo_data_2 = Geometry(geo_data)
transpose_py = Python3Script(data=geo_data_2)  # -> out, result; inputs data: tree of GeometryBase
# ---------- transpose_py: Python ----------
# Input: data (Tree Access)
# Output: result

from Grasshopper import DataTree
from Grasshopper.Kernel.Data import GH_Path

branches = [list(data.Branch(i)) for i in range(data.BranchCount)]

print("Branch count: {}".format(data.BranchCount))
for i, b in enumerate(branches):
    print("  Branch {}: {} items, path {}".format(i, len(b), data.Path(i)))

count = min(len(b) for b in branches)
print("Transposing: {} branches x {} items".format(len(branches), count))

result = DataTree[object]()
for i in range(count):
    path = GH_Path(i)
    for b in branches:
        result.Add(b[i], path)

print("Output: {} branches x {} items each".format(result.BranchCount, result.Branch(0).Count if result.BranchCount > 0 else 0))
# ---------- end transpose_py ----------
python_3_script = Python3Script(data=transpose_py.result, base_vector=base_move_vector_2, z_separation="40")  # -> out, vectors; inputs data: tree, base_vector: Vector3d, z_separation: Double
# ---------- python_3_script: Python ----------
# This file represents a stub for a GhPython component in Grasshopper.
# It sets up the environment to import and use the splintcommon or other external modules.

from pathlib import Path
import sys
from importlib import reload #FOR DEV
import time

# Walk up through nested clusters to find the root GH document (necessary for use in nested clusters)
doc = ghenv.Component.OnPingDocument()
while not doc.FilePath and doc.Owner:
    doc = doc.Owner.OnPingDocument()
ghFileDir = str(Path(doc.FilePath).resolve().parent / "src")

print(f"{ghFileDir=}")

if ghFileDir not in sys.path:
    print("ghFileDir needed to be included")
    sys.path.append(ghFileDir)

import splintcommon
reload(splintcommon) #FOR DEV

#splintcommon module is now available for use in this GhPython component
splintcommon.log(f'GhPython Node initialized at {time.ctime()}')

#Your code here

# Inputs:
#   data         (Tree Access, type hint: ghdoc Object)
#   base_vector  (Item Access, type hint: Vector3d)
#   z_separation (Item Access, type hint: float)
# Output:
#   vectors

import Rhino.Geometry as rg
from Grasshopper import DataTree
from Grasshopper.Kernel.Data import GH_Path

branch_count = data.BranchCount
print("Branches: {}, z_separation: {}".format(branch_count, z_separation))

vectors = DataTree[rg.Vector3d]()

for i in range(branch_count):
    path = data.Path(i)
    item_count = data.Branch(i).Count
    vec = rg.Vector3d(base_vector.X, base_vector.Y, base_vector.Z + z_separation * i)
    print("  Branch {} ({}): {} items, vec Z={:.2f}".format(i, path, item_count, vec.Z))
    # One vector per item so the tree matches the geometry tree for Move
    for j in range(item_count):
        vectors.Add(vec, path)
# ---------- end python_3_script ----------
out = ClusterOutput(python_3_script.out)
move = Move(Geometry=transpose_py.result, Motion=python_3_script.vectors)  # -> Geometry, Transform
geometry = ClusterOutput(move.Geometry)

# ==== cluster ReliableUnionCL
seam_alignment_line = ClusterInput()
join_axis_vector = ClusterInput()
brep1 = ClusterInput()
# Trim Solid is not always working
brep2 = ClusterInput()
brep1_2 = Brep(brep1)
brep2_2 = Brep(brep2)
seam_alignment_line_2 = Line(seam_alignment_line)
python_3_script = Python3Script(x=brep1_2, y=brep2_2)  # -> out, a
# ---------- python_3_script: Python ----------
import Rhino
print(f"{Rhino.RhinoDoc.ActiveDoc.ModelAbsoluteTolerance}")
Rhino.RhinoDoc.ActiveDoc.ModelAbsoluteTolerance = 0.001
print(f"{Rhino.RhinoDoc.ActiveDoc.ModelAbsoluteTolerance}")
# ---------- end python_3_script ----------
join_axis_vector_2 = Vector(join_axis_vector)
reverse = Reverse(Vector=join_axis_vector_2)
merge = Merge(Data1=brep1_2, Data2=brep2_2)  # -> flatten(Result)
solid_union = SolidUnion(Breps=merge)  # -> flatten(Result)
panel = Panel(solid_union)
check_1_exists = Python3Script(geo=solid_union)  # -> out, doesExist, doesntExist; inputs geo: list of GeometryBase
# ---------- check_1_exists: Python ----------
from Rhino.Geometry import Brep

print(f"{geo=} type={type(geo)}")

isExisting = False

if geo is None:
    print("geo is None (root)")
    isExisting = False
elif type(geo) is Brep:
    print("geo is Brep. Yay.")
    isExisting = True
elif hasattr(geo, '__getitem__'):
    if geo[0] is None:
        print(f"geo[0] is None len={len(geo)}")
        isExisting = False
    else:
        isExisting = len(geo) == 1
        print(f"geo is list of {len(geo)} len. {isExisting=}")
else:
    print("fall through no recognized type")

doesExist = isExisting
doesntExist = not isExisting
print(f"{doesExist=} {doesntExist=}")
# ---------- end check_1_exists ----------
python_3_script_2 = Python3Script(passItems=check_1_exists.doesntExist, brep1=brep1_2, brep2=brep2_2)  # -> out, out_brep1, out_brep2; inputs brep1: Brep, brep2: Brep
# ---------- python_3_script_2: Python ----------
if passItems:
    out_brep1 = brep1
    out_brep2 = brep2
else:
    out_brep1 = None
    out_brep2 = None
# ---------- end python_3_script_2 ----------
deconstruct_brep = DeconstructBrep(Brep=python_3_script_2.out_brep1)  # -> Faces, Edges, Vertices
deconstruct_brep_2 = DeconstructBrep(Brep=python_3_script_2.out_brep2)  # -> Faces, Edges, Vertices
brep_join = BrepJoin(Breps=deconstruct_brep_2.Faces)  # -> Breps, Closed
brep_join_2 = BrepJoin(Breps=deconstruct_brep.Faces)  # -> Breps, Closed
merge_2 = Merge(Data1=brep_join_2.Breps, Data2=brep_join.Breps)  # -> flatten(Result)
solid_union_2 = SolidUnion(Breps=merge_2)  # -> flatten(Result)
loft_options = LoftOptions(Closed=False, Adjust=False, Rebuild=0, Refit=0, Type=0)
panel_2 = Panel(check_1_exists.out)
panel_3 = Panel(check_1_exists.doesntExist)
panel_4 = Panel(solid_union_2)
pick_n_choose = PickNChoose(Pattern=check_1_exists.doesntExist, Stream0=solid_union, Stream1=solid_union_2)
check_1_exists_2 = Python3Script(geo=solid_union_2)  # -> out, doesExist, doesntExist; inputs geo: list of GeometryBase; same code as check_1_exists
python_3_script_3 = Python3Script(passItems=check_1_exists_2.doesntExist, brep1=brep1_2, brep2=brep2_2)  # -> out, out_brep1, out_brep2; inputs brep1: Brep, brep2: Brep; same code as python_3_script_2
trim_solid = TrimSolid(Shape=python_3_script_3.out_brep1, Cutters=python_3_script_3.out_brep2)
trim_solid_2 = TrimSolid(Shape=python_3_script_3.out_brep2, Cutters=python_3_script_3.out_brep1)
list_item = ListItem(List=trim_solid_2, Index=Slider(0, range=0..1), Wrap=True)
directional_trim = DirectionalTrim(single_opening_brep=trim_solid, trim_shift_vector=join_axis_vector_2)  # -> trimmed_brep_2, naked_curve
directional_trim_2 = DirectionalTrim(single_opening_brep=list_item, trim_shift_vector=reverse)  # -> flatten(trimmed_brep_2), naked_curve
curve = Curve(directional_trim_2.naked_curve)
curve_2 = Curve(directional_trim.naked_curve)
flip_curve = FlipCurve(Curve=curve, Guide=curve_2)  # -> Curve, Flag
merge_3 = Merge(Data1=curve_2, Data2=flip_curve.Curve)  # -> flatten(Result)
trimmed_brep = Brep(directional_trim_2.trimmed_brep_2)
trimmed_brep_2 = Brep(directional_trim.trimmed_brep_2)
curve_align_curve_seams = CurveAlignCurveSeams(Curves=merge_3, Guide=seam_alignment_line_2, Snap=False)  # -> Aligned, Points, ResultBoolean
loft = Loft(Curves=curve_align_curve_seams.Aligned, Options=loft_options)
merge_4 = Merge(Data1=trimmed_brep_2, Data2=loft, Data3=trimmed_brep)  # -> flatten(Result)
brep_join_3 = BrepJoin(Breps=merge_4)  # -> Breps, Closed
panel_5 = Panel(pick_n_choose)
list_item_2 = ListItem(List=brep_join_3.Breps, Index=0, Wrap=True)
panel_6 = Panel(check_1_exists_2.out)
panel_7 = Panel(check_1_exists_2.doesntExist)
pick_n_choose_2 = PickNChoose(Pattern=check_1_exists_2.doesntExist, Stream0=pick_n_choose, Stream1=list_item_2)
result = ClusterOutput(pick_n_choose_2)

# ==== cluster Arrow
arrowlen = ClusterInput()
text = ClusterInput()
arrowlen_2 = Number(arrowlen)
text_2 = Text(text)
start = ClusterInput()
direction = ClusterInput()
division = Division(A=arrowlen_2, B="4")
line_sdl = LineSDL(Start=start, Direction=direction, Length=arrowlen_2)
end_points = EndPoints(Curve=line_sdl)  # -> Start, End
line = ClusterOutput(line_sdl)
plane_normal = PlaneNormal(Origin=end_points.End, ZAxis=line_sdl)
annotation_dot = AnnotationDot(Location=end_points.End, PrimaryText=text_2)  # -> AnnotationDot, Location, PrimaryText, TextHeight
cone = Cone(Base=plane_normal, Radius=division, Length=division)  # -> Cone, Tip
cone_2 = ClusterOutput(cone.Cone)
annotation_dot_2 = ClusterOutput(annotation_dot.AnnotationDot)

# ==== cluster DirectionalTrim
trim_shift_vector = ClusterInput()
single_opening_brep = ClusterInput()
single_opening_brep_2 = Brep(single_opening_brep)
trim_shift_vector_2 = Vector(trim_shift_vector)
brep_edges = BrepEdges(Brep=single_opening_brep_2)  # -> Naked, Interior, NonManifold
unit_vector = UnitVector(Vector=trim_shift_vector_2)
reverse = Reverse(Vector=unit_vector)
curve = Curve(flatten(brep_edges.Naked))
join_curves = JoinCurves(Curves=curve, Preserve=False)
point = Point("0, 0, 0")
multiplication = Multiplication(A=reverse, B="1000")
multiplication_2 = Multiplication(A=unit_vector, B="1000")
move = Move(Geometry=point, Motion=multiplication)  # -> Geometry, Transform
reparameterize_curve = ReparameterizeCurve(Curve=join_curves)  # -> Reparameterized, Original
line = Line(StartPoint=multiplication, EndPoint=multiplication_2)
divide_curve = DivideCurve(Curve=reparameterize_curve.Reparameterized, Count="10", Kinks=False)  # -> flatten(Points), Tangents, Parameters
plane_fit = PlaneFit(Points=divide_curve.Points)  # -> Plane, Deviation
move_2 = Move(Geometry=plane_fit.Plane, Motion=trim_shift_vector_2)  # -> Geometry, Transform
brep_plane = BrepPlane(Brep=single_opening_brep_2, Plane=move_2.Geometry)  # -> Curves, Points
split_brep = SplitBrep(Brep=single_opening_brep_2, Cutter=brep_plane.Curves)
bounding_box = BoundingBox(Content=split_brep, Plane=PlaneXY(0, 0, 0))  # -> Box, Box_2
volume = Volume(Geometry=bounding_box.Box)  # -> Volume, Centroid
sort_along_curve = SortAlongCurve(Points=volume.Centroid, Curve=line)  # -> Points, Indices
list_item = ListItem(List=sort_along_curve.Indices, Index="-1", Wrap=Toggle(True))
list_item_2 = ListItem(List=split_brep, Index=list_item, Wrap=True)
trimmed_brep = Brep(list_item_2)
brep_edges_2 = BrepEdges(Brep=trimmed_brep)  # -> Naked, Interior, NonManifold
join_curves_2 = JoinCurves(Curves=brep_edges_2.Naked, Preserve=False)
naked_curve = ClusterOutput(join_curves_2)
trimmed_brep_2 = ClusterOutput(trimmed_brep)
